# Grasshopper definition 700-pick-and-place-control.ghx (Grasshopper 1.0.7)

pt = Point(<point referenced from the Rhino model>)
xy = XYPlane(Origin=pt)
pflip = FlipPlane(Plane=xy, ReverseX=False, ReverseY=False, SwapAxes=True)
# Define one pick-up plane in any way you like,
# for example, reference a point from Rhino and assign a plane to it.
# 
# Make sure the plane is oriented in a way that makes sense
# for the robot to reach it. You can check this by observing the
# results of the IK solution for this pickup-plane.
# Use inverse kinematics of the robot to find
# feasible configurations to reach all planes of the current part.
# 
# In this case, we code the solution for a more compact visualization.
pick_frame = Data(xy)

# ----
# 4) Define pick-up plane
pt_2 = Point(<point referenced from the Rhino model>)
xy_2 = XYPlane(Origin=pt_2)
pflip_2 = FlipPlane(Plane=xy_2, ReverseX=False, ReverseY=False, SwapAxes=True)
place_frame = Data(pflip_2)

# ----
# 1) Load robot from ROS
# Load the robot from ROS.
# 
# Make sure ROS/MoveIt is running before you start (ie. "Compose up").
# Define assembly containing parts and frames
# 
# Connectivity is automatically detected and determines sequence
connect = BooleanToggle(True)
ros = ROSConnect(connect=connect)  # -> ros_client, is_connected; inputs port: Int32, connect: Boolean
#   port ip: The ip address ROS. Defaults to 127.0.0.1.
#   port port: The port of ROS. Defaults to 9090.
#   port connect: If True, connects to ROS. If False, disconnects from ROS. Defaults to False.
#   port ros_client: The ROS client.
#   port is_connected: True if connection established.
# ---------- ros: Python ----------
"""
Connect or disconnect to ROS.

COMPAS FAB v0.27.0
"""
from ghpythonlib.componentbase import executingcomponent as component
from scriptcontext import sticky as st

from compas_fab.backends import RosClient
from compas_fab.ghpython.components import create_id


class ROSConnect(component):
    def RunScript(self, ip, port, connect):
        ros_client = None

        ip = ip or '127.0.0.1'
        port = port or 9090

        key = create_id(self, 'ros_client')
        ros_client = st.get(key, None)

        if ros_client:
            st[key].close()
        if connect:
            st[key] = RosClient(ip, port)
            st[key].run(5)

        ros_client = st.get(key, None)
        is_connected = ros_client.is_connected if ros_client else False
        return (ros_client, is_connected)
# ---------- end ros ----------
load_robot = BooleanToggle(True)
robot = ROSRobot(ros_client=ros.ros_client, load=load_robot)  # -> robot; inputs load: Boolean
#   port ros_client: The ROS client.
#   port load: If True, loads the robot from ROS. Defaults to False.
# ---------- robot: Python ----------
"""
Load robot directly from ROS.

COMPAS FAB v0.27.0
"""
from compas_ghpython.artists import RobotModelArtist
from ghpythonlib.componentbase import executingcomponent as component
from scriptcontext import sticky as st

from compas_fab.ghpython.components import create_id


class ROSRobot(component):
    def RunScript(self, ros_client, load):
        key = create_id(self, 'robot')

        if ros_client and ros_client.is_connected and load:
            # Load URDF from ROS
            st[key] = ros_client.load_robot(load_geometry=True, precision='12f')
            st[key].artist = RobotModelArtist(st[key].model)

        robot = st.get(key, None)
        if robot:  # client sometimes need to be restarted, without needing to reload geometry
            robot.client = ros_client
        return robot
# ---------- end robot ----------
robot_2 = Data(robot)

# ----
# 3) Attach tool and robot table
# Define the tool and other static meshes
# 
# A tool is composed by a mesh and a frame. If you define only a visual mesh, it will be used for both visual and collision purposes. If the mesh is heavy, make sure you define a simplifed mesh for collision.
# 
# Static collision meshes such as robot's table are also added here.
robot_3 = Data(robot_2)
mesh = Mesh(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)
point = Point(Point(0, 5.779452988e-05, -0.0005099149768))
mesh_2 = Mesh(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)
xy_plane = XYPlane(Origin=point)
attached_tool = AttachedTool(robot=robot_2, visual_mesh=mesh, tcf_plane=xy_plane)  # -> robot; inputs visual_mesh: Mesh, collision_mesh: Mesh
#   port visual_mesh: A visual mesh for the tool.
#   port collision_mesh: A collision mesh for the tool.
#   port tcf_plane: The frame of the tool in tool0 frame.
#   port group: The planning group to which the tool should be attached.
# ---------- attached_tool: Python ----------
"""
Attach a tool to the robot.

COMPAS FAB v0.27.0
"""
from ghpythonlib.componentbase import executingcomponent as component
from compas_rhino.conversions import RhinoMesh
from compas_rhino.conversions import plane_to_compas_frame

from compas.geometry import Frame
from compas_fab.robots import Tool


class AttachToolComponent(component):
    def RunScript(self, robot, visual_mesh, collision_mesh, tcf_plane, group):
        if robot and robot.client and robot.client.is_connected and visual_mesh:
            if not collision_mesh:
                collision_mesh = visual_mesh

            c_visual_mesh = RhinoMesh.from_geometry(visual_mesh).to_compas()
            c_collision_mesh = RhinoMesh.from_geometry(collision_mesh).to_compas()

            if not tcf_plane:
                frame = Frame.worldXY()
            else:
                frame = plane_to_compas_frame(tcf_plane)
            tool = Tool(c_visual_mesh, frame, c_collision_mesh)

            robot.attach_tool(tool, group)

        return robot
# ---------- end attached_tool ----------
table = GhPythonScript(robot=robot_3, mesh=mesh_2)  # inputs mesh: Mesh
# ---------- table: Python ----------
from compas_fab.robots import PlanningScene
from compas_fab.robots import CollisionMesh
from compas_rhino.conversions import RhinoMesh

if robot:
    scene = PlanningScene(robot)
    mesh = RhinoMesh.from_geometry(mesh).to_compas()
    cm = CollisionMesh(mesh, "table")
    scene.add_collision_mesh(cm)
# ---------- end table ----------
robot_4 = Data(attached_tool)

# ----
# 2) Define assembly
zsize = Slider(0.0108, range=0.001..0.0999)
xgap = Slider(0.0039, range=0..0.005)
zgap = Slider(0.0047, range=0..0.005)
xsize = Slider(0.0865, range=0.001..0.0999)
ysize = Slider(0.03296, range=0.001..0.0999)
current_part_index = Slider(108, range=0..400)
wall_options = GhPythonScript(xsize=xsize, ysize=ysize, zsize=zsize, xgap=xgap, zgap=zgap)  # -> options
# ---------- wall_options: Python ----------
import collections

options = collections.namedtuple('Options', [
    'xsize',
    'ysize',
    'zsize',
    'xgap',
    'zgap',
])

options.xsize = xsize
options.ysize = ysize
options.zsize = zsize
options.xgap = xgap
options.zgap = zgap
# ---------- end wall_options ----------
crv = Curve(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)
crv_2 = Curve(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)
merge = Merge(Data1=crv_2, Data2=crv)
loft = Loft(Curves=merge, Options={Adjust=False, Closed=False, LoftEnds=0, LoftSimp=0, LoftType=0, Rebuild=10, Refit=0.01})
wall = GhPythonScript(surface=loft, options=wall_options)  # -> assembly, parts_geo; inputs surface: Surface
# ---------- wall: Python ----------
import math
import os
import sys

import compas
from compas.geometry import Box
from compas.geometry import Frame
from compas.geometry import Vector
from compas.geometry import Polyhedron
from compas.datastructures import Assembly
from compas.datastructures import Part

from compas.utilities import linspace
from compas_rhino.conversions import RhinoSurface

canvas = ghenv.Component.OnPingDocument()
folder = os.path.dirname(canvas.FilePath)
if folder not in sys.path:
    sys.path.append(folder)

# Default
if not options:
    xsize = 0.0215
    ysize = 0.01025
    zsize = 0.0065
    xgap = 0.0009
    zgap = 0.0002
else:
    xsize = options.xsize
    ysize = options.ysize
    zsize = options.zsize
    xgap = options.xgap
    zgap = options.zgap

surface = RhinoSurface.from_geometry(surface).to_compas()

parts_geo = []

wall_vertical_curve = surface.v_isocurve(0)
wall_height = wall_vertical_curve.length()
courses = int(math.ceil((wall_height / (zsize + zgap))))

assembly = Assembly()
half_brick = Box.from_diagonal([(-xsize / 4, -ysize / 2, 0), (xsize / 4, ysize / 2, -zsize)])
full_brick = Box.from_diagonal([(-xsize / 2, -ysize / 2, 0), (xsize / 2, ysize / 2, -zsize)])

for ri, row in enumerate(linspace(0, 1, courses)):
    _, u = wall_vertical_curve.rhino_curve.NormalizedLengthParameter(row)
    
    row_curve = surface.u_isocurve(u)
    row_length = row_curve.length()

    c = (row_length / (xsize + xgap))
    col_count = int(math.ceil(c))
    linspaced_vector = list(linspace(0, 1, col_count))
    half_brick_offset = linspaced_vector[1] / 2
    
    for ci, l in enumerate(linspaced_vector):
        if ri % 2:
            l += half_brick_offset

        if ci == 0 and ri % 2 == 0:
            l += half_brick_offset / 2
        if ci == col_count - 1 and ri % 2 == 0:
            l -= half_brick_offset / 2

        fits, col = row_curve.rhino_curve.NormalizedLengthParameter(l)
        if not fits: break

        point = row_curve.point_at(col)
        xaxis = row_curve.tangent_at(col)
        frame = Frame(point, xaxis, xaxis.cross(Vector.Zaxis()))

        if ri % 2 == 0 and ci in (0, col_count - 1):
            brick = half_brick.copy()
        else:
            brick = full_brick.copy()
            
        brick_shape = Polyhedron(*brick.to_vertices_and_faces(triangulated=True))
        part = Part(
            shape=brick_shape,
            frame=frame,
            course=ri,
            n=ci,
            xsize=brick.xsize,
            ysize=brick.ysize,
            zsize=brick.zsize,
        )
        assembly.add_part(part)

# Assembly attributes
assembly.attributes['courses'] = ri

parts_geo = [part.geometry for part in assembly.parts()]
#
#if save:
#    compas.json_dump({'assembly': assembly}, os.path.join(folder, 'session.json'), pretty=True)
# ---------- end wall ----------
edges = GhPythonScript(assembly=wall.assembly)  # -> assembly
# ---------- edges: Python ----------
import math
import os

import compas
from compas.geometry import Box
from compas.geometry import Plane
from compas.geometry import Frame
from compas.geometry import Vector
from compas.geometry import Translation
from compas.geometry import Polygon
from compas.geometry import Projection
from compas.datastructures import Mesh
from separation_axis_theorem import separating_axis_theorem

canvas = ghenv.Component.OnPingDocument()
folder = os.path.dirname(canvas.FilePath)

projection = Projection.from_plane(Plane.worldXY())

for part in assembly.parts():
    # Store XY projection
    projected_mesh = Mesh.from_shape(part.geometry.transformed(projection))
    part.attributes['projection'] = Polygon(projected_mesh.face_coordinates(0))

    # Calculate place frame
    part.attributes['place_frame'] = part.frame.transformed(Translation.from_vector([0, 0, part.attributes['zsize']]))

# Connect assembly graph
last_course_parts = None
for c in range(assembly.attributes['courses'] + 1):
    course_parts = list(assembly.graph.nodes_where_predicate(lambda key, attr: attr['part'].attributes['course'] == c))

    if last_course_parts:
        for key in course_parts:
            part1 = assembly.find_by_key(key)
            polygon1 = part1.attributes['projection']

            for p2_key in last_course_parts:
                part2 = assembly.find_by_key(p2_key)
                polygon2 = part2.attributes['projection']
                are_connected = separating_axis_theorem(polygon1.points, polygon2.points)
                if are_connected:
                    assembly.add_connection(part2, part1)

    last_course_parts = course_parts
#
#if save:
#    compas.json_dump({'assembly': assembly}, os.path.join(folder, 'session.json'), pretty=True)
# ---------- end edges ----------
frames = GhPythonScript(assembly=edges, current_part_index=current_part_index)  # -> current_part, place_frame, a; inputs current_part_index: Int32
# ---------- frames: Python ----------
from helpers import traverse
from helpers import draw_parts
from helpers import draw_connections
from helpers import draw_parts_attribute
from helpers import get_assembly_sequence
from compas.artists import Artist


a = []
a += draw_parts_attribute(assembly, 'place_frame')

top_course = assembly.attributes["courses"]
sequence = get_assembly_sequence(assembly, top_course)

for i in range(current_part_index):
    part = assembly.find_by_key(sequence[i])
    if (current_part_index-1) == i:
        place_frame = part.attributes['place_frame']
        current_part = part
# ---------- end frames ----------
viz = GhPythonScript(assembly=edges)  # -> out, a
# ---------- viz: Python ----------
import compas_ghpython
from compas.artists import Artist

def draw_connections(assembly):
    lines = []

    for u, v in assembly.connections():
        u = assembly.find_by_key(u)
        v = assembly.find_by_key(v)
        lines.append(
            {
                "start": list(u.frame.point),
                "end": list(v.frame.point),
            }
        )
    return compas_ghpython.draw_lines(lines)

a = []
a += draw_connections(assembly)
# ---------- end viz ----------
current_part_index_2 = Data(current_part_index)
target_plane = Data(frames.place_frame)
draw = Draw(cg=frames.place_frame)  # -> out, rg
#   port cg: The COMPAS geometry or datastructure to be drawn.
#   port rg: The Rhino geometry object.
# ---------- draw: Python ----------
"""
Draws COMPAS geometry in Grasshopper.
"""
from ghpythonlib.componentbase import executingcomponent as component

from compas.artists import Artist


class CompasToRhinoGeometry(component):
    def RunScript(self, cg):
        if not cg:
            return None

        return Artist(cg).draw()
# ---------- end draw ----------
assembly = Data(edges)

# ----
# 5) Solve all IK
# Results in 4 configurations
assembly_2 = Data(assembly)
current_part_index_3 = Data(current_part_index_2)
robot_5 = Data(robot_4)  # disabled
pickup_plane = Data()
part = GhPythonScript(assembly=assembly_2, current_part_index=current_part_index_3)  # -> part, geo
# ---------- part: Python ----------
from helpers import traverse
from helpers import draw_parts
from helpers import draw_connections
from helpers import draw_parts_attribute
from helpers import get_assembly_sequence
from compas.artists import Artist


top_course = assembly.attributes["courses"]
sequence = get_assembly_sequence(assembly, top_course)

if current_part_index:
    current_part_index = int(current_part_index)
    part = assembly.find_by_key(sequence[current_part_index])
    print(part.attributes['place_frame'])
    geo = Artist(part.geometry).draw()
# ---------- end part ----------
button = Button()  # disabled
button_2 = Button()  # disabled
plan_pickup = GhPythonScript(robot=robot_4, pick_frame=pick_frame, approach_distance=0.1, update=button)  # -> pick_config, approach_pick_config, pick_geo
# ---------- plan_pickup: Python ----------
"""
Calculate pickup of a part.
"""
from ghpythonlib.componentbase import executingcomponent as component
from scriptcontext import sticky as st

from compas.artists import Artist
from compas.geometry import Frame
from compas.geometry import Transformation
from compas_rhino.conversions import RhinoPlane
from compas_fab.ghpython.components import create_id
from compas_fab.robots import PlanningScene

class PickPart(component):
    def RunScript(self, robot, group, start_configuration, pick_frame, part, goal_frame, approach_distance, update):
        self.Message = ""

        pick_config = None
        approach_pick_config = None
        pick_trajectory = None
        pick_geo = None

        if pick_frame:
            pick_frame = RhinoPlane.from_geometry(pick_frame).to_compas_frame()

        if goal_frame:
            goal_frame = RhinoPlane.from_geometry(goal_frame).to_compas_frame()


        # Adjust pick frame based on the grasp of the current part
        if part:
            if "place_frame" not in part.attributes:
                raise Exception("Part is missing the place_frame attribute")
            part.frame = goal_frame
            part.attributes["place_frame"] = goal_frame
            pick_part = part.copy()
            grasp_transform = Transformation.from_frame_to_frame(part.frame, part.attributes["place_frame"])
            pick_transform = Transformation.from_frame(pick_frame) * grasp_transform
            pick_frame_with_grasp = Frame.from_transformation(pick_transform)
            pick_part.frame = pick_frame.copy()
            pick_frame.transform(grasp_transform)

            pick_geo = [Artist(pick_part.geometry).draw()]

            approach_pick_frame = pick_frame.copy()
            
        if approach_distance > 0:
            approach_pick_frame = pick_frame.copy()
            approach_pick_frame.point.z += approach_distance

        if part:
            
            pick_config = part.attributes.get("pick_config")
            approach_pick_config = part.attributes.get("approach_pick_config")
            print(pick_config)
        
        if (update or not pick_config or not approach_pick_config) and robot and robot.client and robot.client.is_connected:
            scene = PlanningScene(robot)
            scene.remove_collision_mesh("parts")
            print(pick_frame)
            frame_WCF = Frame([0.3, 0.1, 0.5], [1, 0, 0], [0, 1, 0])
            start_configuration = robot.zero_configuration()
            pick_config = robot.inverse_kinematics(frame_WCF, start_configuration, group)
            #approach_pick_config = robot.inverse_kinematics(approach_pick_frame, pick_config, group)

            if part:
                part.attributes["pick_config"] = pick_config
                part.attributes["approach_pick_config"] = approach_pick_config
        
        self.Message = "Found pick up configurations\nusing {:.2f}m approach distance".format(approach_distance)
        return pick_config, approach_pick_config, pick_geo
# ---------- end plan_pickup ----------
plan_place = GhPythonScript(
    robot=robot_2,
    approach_pick_config=plan_pickup.approach_pick_config,
    part=part.part,
    goal_plane=place_frame,
    approach_distance=0.1,
    update=button_2)  # -> place_config, approach_place_config, placed_part_geo
# ---------- plan_place: Python ----------
"""
Calculate placement of a part.
"""
from ghpythonlib.componentbase import executingcomponent as component
from scriptcontext import sticky as st

from compas.artists import Artist
from compas.geometry import Frame
from compas.geometry import Transformation
from compas_rhino.conversions import RhinoPlane
from compas_fab.ghpython.components import create_id
from compas_fab.robots import PlanningScene

class PlacePart(component):
    def RunScript(self, robot, group, appraoch_pick_config, part, goal_frame, approach_distance, update):
        
        self.Message = ""
        
        #if not part:
            #raise Exception("No part selected")

        place_config = part.attributes.get("place_config")
        approach_place_config = part.attributes.get("approach_place_config")
        placed_part_geo = [Artist(part.geometry).draw()]


        if goal_frame:
            goal_frame = RhinoPlane.from_geometry(goal_frame).to_compas_frame()

#update or not place_config or not approach_place_config) and 

        if (robot and robot.client and robot.client.is_connected):
            print('here')
            scene = PlanningScene(robot)
            scene.remove_collision_mesh("parts")

            place_frame = goal_frame.copy()
            approach_place_frame = place_frame.copy()
            if approach_distance > 0:
                approach_place_frame.point.z += approach_distance

            place_config = robot.inverse_kinematics(place_frame, approach_pick_config, group)
            approach_place_config = robot.inverse_kinematics(approach_place_frame, place_config, group)

            part.attributes["place_config"] = place_config
            print(part.attributes["place_config"])
            part.attributes["approach_place_config"] = approach_place_config

        self.Message = "Found place configurations\nusing {:.2f}m approach distance".format(approach_distance)
        return place_config, approach_place_config, placed_part_geo
# ---------- end plan_place ----------
approach_pickup_config = Data(plan_pickup.approach_pick_config)
approach_place_config = Data(plan_place.approach_place_config)
pickup_config = Data(plan_pickup.pick_config)
place_config = Data(plan_place.place_config)

# ----
# 6) Plan trajectories
assembly_3 = Data(assembly)
robot_6 = Data(robot_4)
current_part_index_4 = Data(current_part_index_2)
part_2 = GhPythonScript(assembly=assembly_3, current_part_index=current_part_index_4)  # -> part, geo
# ---------- part_2: Python ----------
from helpers import traverse
from helpers import draw_parts
from helpers import draw_connections
from helpers import draw_parts_attribute
from helpers import get_assembly_sequence
from compas.artists import Artist


top_course = assembly.attributes["courses"]
sequence = get_assembly_sequence(assembly, top_course)

if current_part_index:
    current_part_index = int(current_part_index)
    part = assembly.find_by_key(sequence[current_part_index])
    geo = Artist(part.geometry).draw()
# ---------- end part_2 ----------
button_3 = Button()  # disabled
plan_trajectories = GhPythonScript(robot=robot_2, assembly=assembly_3, part=part_2.part, pick_frames=pick_frame, place_frames=place_frame, compute=button_3)  # -> pick_trajectory, pick_trajectory_frames, place_trajectory, place_trajectory_frames, move_trajectory, move_trajectory_frames; inputs compute: Boolean
# ---------- plan_trajectories: Python ----------
"""
Calculate pickup trajectory of a part.
"""
import math
from ghpythonlib.componentbase import executingcomponent as component
from scriptcontext import sticky as st

from compas.artists import Artist
from compas.geometry import Frame
from compas.geometry import Transformation
from compas_rhino.conversions import RhinoPlane
from compas_fab.ghpython.components import create_id
from compas_fab.robots import AttachedCollisionMesh
from compas_fab.robots import CollisionMesh
from compas_fab.robots import PlanningScene

from helpers import get_assembly_sequence

class PlanPartPickupTrajectory(component):

    def RunScript(self, robot, group, assembly, part, pick_frames, place_frames, planner_id, compute):

        self.Message = ""

        if not part:
            self.Message = "No part selected"
            return

        approach_pick_config = part.attributes.get("approach_pick_config")
        pick_config = part.attributes.get("pick_config")
        approach_place_config = part.attributes.get("approach_place_config")
        place_config = part.attributes.get("place_config")

        pick_trajectory = None
        place_trajectory = None
        move_trajectory = None

        pick_trajectory_frames = []
        place_trajectory_frames = []
        move_trajectory_frames = []

        for pick_frame in pick_frames:
            pick_trajectory_frames.append(pick_frame)
            
        for place_frame in place_frames:
            place_trajectory_frames.append(place_frame)

        if compute and robot and robot.client and robot.client.is_connected:
            scene = PlanningScene(robot)
            scene.remove_collision_mesh("parts")

            for key in sequence:
                if key == part.key: break
                part_mesh = assembly.find_by_key(key).to_mesh()
                part_cm = CollisionMesh(part_mesh, "parts")
                scene.append_collision_mesh(part_cm)

        # Compute PICK trajectory
        if compute and robot and robot.client and robot.client.is_connected:
            max_step = 0.01
            frames = [
                       robot.forward_kinematics(c, group, options=dict(solver='model'))
                       for c in (approach_pick_config, pick_config)
                     ]

            trajectory = robot.plan_cartesian_motion(frames,
                                                     start_configuration=approach_pick_config,
                                                     group=group,
                                                     options=dict(
                                                         max_step=max_step,
                                                     ))
            if trajectory.fraction < 1:
                raise Exception("Incomplete cartesian trajectory found. Only {:.1f}% of the trajectory could be planned".format(trajectory.fraction * 100))

            # Only assign if fraction is full
            part.attributes["pick_trajectory"] = trajectory

        pick_trajectory = part.attributes.get("pick_trajectory")

        if pick_trajectory:
            for c in pick_trajectory.points:
                frame = robot.forward_kinematics(c, group, options=dict(solver='model'))
                pick_trajectory_frames.append(Artist(frame).draw())

        if not approach_place_config or not place_config:
            self.Message = "No approach & place configs defined"
            return pick_trajectory, pick_trajectory_frames, place_trajectory, place_trajectory_frames, move_trajectory, move_trajectory_frames

        # Compute PLACE trajectory
        if compute and robot and robot.client and robot.client.is_connected:
            max_step = 0.01
            frames = [
                       robot.forward_kinematics(c, group, options=dict(solver='model'))
                       for c in (approach_place_config, place_config)
                     ]

            # TODO: Add brick
            # attached_collision_meshes = []
            trajectory = robot.plan_cartesian_motion(frames,
                                                     start_configuration=approach_place_config,
                                                     group=group,
                                                     options=dict(
                                                         max_step=max_step,
#                                                         attached_collision_meshes=attached_collision_meshes
                                                     ))
            if trajectory.fraction < 1:
                raise Exception("Incomplete cartesian trajectory found. Only {:.1f}% of the trajectory could be planned".format(trajectory.fraction * 100))

            # Only assign if fraction is full
            part.attributes["place_trajectory"] = trajectory

        place_trajectory = part.attributes.get("place_trajectory")

        if place_trajectory:
            for c in place_trajectory.points:
                frame = robot.forward_kinematics(c, group, options=dict(solver='model'))
                place_trajectory_frames.append(Artist(frame).draw())

        # Compute MOVE trajectory
        if compute and robot and robot.client and robot.client.is_connected:
            planner_id = planner_id or 'TRRT'

            # TODO: Add brick
            # attached_collision_meshes = []

            tolerance_above = self._generate_default_tolerances(robot.get_configurable_joints(group))
            tolerance_below = self._generate_default_tolerances(robot.get_configurable_joints(group))
            goal_constraints = robot.constraints_from_configuration(
                configuration=approach_place_config,
                tolerances_above=tolerance_above,
                tolerances_below=tolerance_below,
                group=group
            )

            part.attributes["move_trajectory"] = robot.plan_motion(goal_constraints,
                                                                   start_configuration=approach_pick_config,
                                                                   group=group,
                                                                   options=dict(
                                                                       planner_id=planner_id,
#                                                                       attached_collision_meshes=attached_collision_meshes
                                                                   ))

        move_trajectory = part.attributes.get("move_trajectory")

        if move_trajectory:
            for c in move_trajectory.points:
                frame = robot.forward_kinematics(c, group, options=dict(solver='model'))
                move_trajectory_frames.append(Artist(frame).draw())

        if pick_trajectory and place_trajectory and move_trajectory:
            self.Message = "Found all trajectories ({} points)".format(len(pick_trajectory.points) + len(place_trajectory.points) + len(move_trajectory.points))

        return pick_trajectory, pick_trajectory_frames, place_trajectory, place_trajectory_frames, move_trajectory, move_trajectory_frames

    def _generate_default_tolerances(self, joints):
        DEFAULT_TOLERANCE_METERS = .001
        DEFAULT_TOLERANCE_RADIANS = math.radians(1)

        return [
            DEFAULT_TOLERANCE_METERS if j.is_scalable()
            else DEFAULT_TOLERANCE_RADIANS
            for j in joints
        ]
# ---------- end plan_trajectories ----------
merge_2 = GhPythonScript(
    pick_trajectory=plan_trajectories.pick_trajectory,
    place_trajectory=plan_trajectories.place_trajectory,
    move_trajectory=plan_trajectories.move_trajectory)  # -> trajectory
# ---------- merge_2: Python ----------
if pick_trajectory and move_trajectory and place_trajectory:
    trajectory = pick_trajectory.points + \
                 list(reversed(pick_trajectory.points)) + \
                 move_trajectory.points + \
                 place_trajectory.points + \
                 list(reversed(place_trajectory.points)) + \
                 list(reversed(move_trajectory.points))
# ---------- end merge_2 ----------
move_trajectory = Data(plan_trajectories.move_trajectory)  # disabled
place_trajectory = Data(plan_trajectories.place_trajectory)  # disabled
pick_trajectory = Data(plan_trajectories.pick_trajectory)  # disabled
trajectory = Data(merge_2)

panel = Panel(part.part)
panel_2 = Panel(plan_pickup.pick_config)
panel_3 = Panel(plan_trajectories.pick_trajectory)
panel_4 = Panel(robot_2)

# ----
# Visualization
# Assembly visualization
number_slider = Slider(17, range=0..200)
trajectory_2 = Data(trajectory)
list = ValueList({"Approach pickup config": 0, "Pickup config": 1, "Approach place config": 2, "Place config": 3, "Trajectory": 4}, selected="Trajectory")
robot_7 = Data(robot_4)
approach_pickup_config_2 = Data(approach_pickup_config)
pickup_config_2 = Data(pickup_config)
approach_place_config_2 = Data(approach_place_config)
place_config_2 = Data(place_config)
assembly_4 = Data(assembly)
current_part_index_5 = Data(current_part_index_2)
filter = StreamFilter(
    Gate=list,
    Stream0=approach_pickup_config_2,
    Stream1=pickup_config_2,
    Stream2=approach_place_config_2,
    Stream3=place_config_2,
    Stream4=trajectory_2)
item = ListItem(List=filter, Index=number_slider, Wrap=True)
robot_visualize = RobotVisualize(robot=robot_7, configuration=item)  # -> visual, collision, collision_meshes, attached_meshes, frames, base_frame, ee_frame; inputs show_visual: Boolean, show_collision: Boolean, show_frames: Boolean, show_base_frame: Boolean, show_end_effector_frame: Boolean, show_cm: Boolean, show_acm: Boolean
#   port group: The planning group used for end-effector and base visualization.
#   port configuration: The robot's full configuration.
#   port show_visual: Whether or not to show the robot's visual meshes.
#   port show_collision: Whether or not to show the robot's collision meshes.
#   port show_frames: Whether or not to show the robot's joint frames.
#   port show_base_frame: Whether or not to show the robot's base frame.
#   port show_end_effector_frame: Whether or not to show the robot's end-effector frame.
#   port show_cm: Whether or not to show the collision meshes (if any).
#   port show_acm: Whether or not to show the attached collision meshes (if any).
#   port visual: Rhino meshes of the robot's visual geometry (if any).
#   port collision: Rhino meshes of the robot's collision geometry (if any).
#   port collision_meshes: Rhino meshes of the scene's collision meshes (if any).
#   port attached_meshes: Rhino meshes of the scene's attached collision meshes (if any).
#   port frames: The robot's joint frames as Rhino planes (if any).
#   port base_frame: The robot's base frame as a Rhino plane (if any).
#   port ee_frame: The robot's end-effector frame as a Rhino plane (if any).
# ---------- robot_visualize: Python ----------
"""
Visualizes the robot.

COMPAS FAB v0.27.0
"""
import time

from compas.artists import Artist
from compas.geometry import Frame
from compas.geometry import Transformation
from ghpythonlib.componentbase import executingcomponent as component
from scriptcontext import sticky as st

from compas_fab.ghpython.components import create_id
from compas_fab.robots import PlanningScene


class RobotVisualize(component):
    def RunScript(
        self,
        robot,
        group,
        configuration,
        show_visual,
        show_collision,
        show_frames,
        show_base_frame,
        show_end_effector_frame,
        show_cm,
        show_acm,
    ):

        visual = None
        collision = None
        collision_meshes = None
        attached_meshes = None
        frames = None
        base_frame = None
        ee_frame = None

        if robot:
            show_visual = True if show_visual is None else show_visual
            show_cm = True if show_cm is None else show_cm
            show_acm = True if show_acm is None else show_acm
            configuration = configuration or robot.zero_configuration()

            robot.update(configuration, visual=show_visual, collision=show_collision)
            compas_frames = robot.transformed_frames(configuration, group)

            if show_visual:
                visual = robot.artist.draw_visual()

            if show_collision:
                collision = robot.artist.draw_collision()

            if show_base_frame:
                base_compas_frame = compas_frames[0]
                artist = Artist(base_compas_frame)
                base_frame = artist.draw()

            if show_end_effector_frame:
                ee_compas_frame = robot.forward_kinematics(configuration, group, options=dict(solver="model"))
                artist = Artist(ee_compas_frame)
                ee_frame = artist.draw()

            if show_frames:
                frames = []
                for compas_frame in compas_frames[1:]:
                    artist = Artist(compas_frame)
                    frame = artist.draw()
                    frames.append(frame)

            cached_scene_key = create_id(self, "cached_scene")

            if show_cm or show_acm:
                cached_scene = st.get(cached_scene_key)
                if not cached_scene:
                    cached_scene = {"time": 0}

                # expire cache if the component has not been executed in the last 2 seconds
                # this allows to slide through a list of configurations
                # without triggering refreshes of the scene in the middle of it
                if time.time() - cached_scene["time"] > 2:
                    update_scene = True
                else:
                    update_scene = False

                if update_scene:
                    scene = PlanningScene(robot)
                    scene = robot.client.get_planning_scene()

                if update_scene and show_cm:
                    collision_meshes = []

                    for co in scene.world.collision_objects:
                        header = co.header
                        frame_id = header.frame_id
                        cms = co.to_collision_meshes()

                        for cm in cms:
                            if cm.frame != Frame.worldXY():
                                t = Transformation.from_frame(cm.frame)
                                mesh = cm.mesh.transformed(t)
                            else:
                                mesh = cm.mesh

                            collision_meshes.append(Artist(mesh).draw())

                        cached_scene["cm"] = collision_meshes

                collision_meshes = cached_scene.get("cm", [])

                if update_scene and show_acm:
                    attached_meshes = []

                    for aco in scene.robot_state.attached_collision_objects:
                        for acm in aco.to_attached_collision_meshes():
                            frame_id = aco.object["header"]["frame_id"]
                            frame = robot.forward_kinematics(configuration, options=dict(link=frame_id))
                            t = Transformation.from_frame(frame)

                            # Local CM frame
                            if acm.collision_mesh.frame and acm.collision_mesh.frame != Frame.worldXY():
                                t = t * Transformation.from_frame(acm.collision_mesh.frame)

                            mesh = acm.collision_mesh.mesh.transformed(t)

                            attached_meshes.append(Artist(mesh).draw())

                    cached_scene["acm"] = attached_meshes

                attached_meshes = cached_scene.get("acm", [])

                cached_scene["time"] = time.time()
                st[cached_scene_key] = cached_scene

        return (
            visual,
            collision,
            collision_meshes,
            attached_meshes,
            frames,
            base_frame,
            ee_frame,
        )
# ---------- end robot_visualize ----------
assembly_5 = GhPythonScript(assembly=assembly_4, current_part_index=current_part_index_5)  # -> current_part, place_frame, a; inputs current_part_index: Int32
# ---------- assembly_5: Python ----------
from helpers import traverse
from helpers import draw_parts
from helpers import draw_connections
from helpers import draw_parts_attribute
from helpers import get_assembly_sequence
from compas.artists import Artist


a = []
a = draw_parts(assembly)
a += draw_connections(assembly)
a += draw_parts_attribute(assembly, 'place_frame')

top_course = assembly.attributes["courses"]
sequence = get_assembly_sequence(assembly, top_course)

for i in range(current_part_index):
    part = assembly.find_by_key(sequence[i])
    if (current_part_index-1) == i:
        place_frame = part.attributes['place_frame']
        current_part = part

    a += [Artist(part.geometry).draw()]
# ---------- end assembly_5 ----------

# ----
# Assembly loading/saving
panel_5 = Panel("assembly-data.json")
assembly_6 = Data(assembly)
formatted = BooleanToggle(False)
save = GhPythonScript(assembly=assembly_6, filename=panel_5, pretty=formatted, save=Button())  # -> out, path
# ---------- save: Python ----------
import os

dirname = os.path.dirname(ghenv.Component.OnPingDocument().FilePath)
if "\\" in filename or "/" in filename:
    raise Exception("Invalid name, don't enter a full path, only a file name. Eg. assembly.json")

path = os.path.join(dirname, filename)

if assembly and save:
    assembly.to_json(path, pretty=pretty)
# ---------- end save ----------
load = GhPythonScript(filename=panel_5, load=Button())  # -> assembly
# ---------- load: Python ----------
import os
from scriptcontext import sticky

from compas.datastructures import Assembly

dirname = os.path.dirname(ghenv.Component.OnPingDocument().FilePath)
if "\\" in filename or "/" in filename:
    raise Exception("Invalid name, don't enter a full path, only a file name. Eg. assembly.json")

path = os.path.join(dirname, filename)
key = "assembly_key_{}".format(path)

if load:
    sticky[key] = Assembly.from_json(path)

assembly = sticky.get(key)
# ---------- end load ----------
assembly_7 = Data(load)

# ----
# Robot control
robot_8 = Data(robot_4)  # disabled
speed = Slider(300, range=50..1000)  # disabled
trajectory_3 = Data(trajectory)  # disabled
pick_trajectory_2 = Data(pick_trajectory)  # disabled
place_trajectory_2 = Data(place_trajectory)  # disabled
move_trajectory_2 = Data(move_trajectory)  # disabled
panel_6 = Panel("io_signal_name")  # disabled
assembly_8 = Data(assembly)  # disabled
current_part_index_6 = Data(current_part_index_2)  # disabled
approach_pickup_config_3 = Data(approach_pickup_config)  # disabled
pickup_config_3 = Data(pickup_config)  # disabled
approach_place_config_3 = Data(approach_place_config)  # disabled
place_config_3 = Data(place_config)  # disabled
ros_2 = GhPythonScript(robot=robot_8)  # -> ros; disabled
# ---------- ros_2: Python ----------
if robot and robot.client:
    ros = robot.client
# ---------- end ros_2 ----------
part_3 = GhPythonScript(assembly=assembly_8, current_part_index=current_part_index_6)  # -> part, geo; disabled; same code as part_2
abb = GhPythonScript(ros_client=ros_2)  # -> abb; disabled
# ---------- abb: Python ----------
import compas_rrc as rrc

if ros_client and ros_client.is_connected:
    abb = rrc.AbbClient(ros_client)
# ---------- end abb ----------
go = Button()  # disabled
go_2 = Button()  # disabled
go_3 = Button()  # disabled
go_4 = Button()  # disabled
current = GhPythonScript(robot=robot_8, abb=abb, go=go)  # -> config, frame; disabled
# ---------- current: Python ----------
import Grasshopper
import System
import Rhino
import scriptcontext as sc

from ghpythonlib.componentbase import executingcomponent as component

from compas_fab.robots import to_radians
from compas_fab.ghpython.components import create_id

import compas_rrc as rrc

class MyComponent(component):
    
    def RunScript(self, robot, abb, go):
        key = create_id(self, 'last_config')
        frame = None

        if robot and abb and abb.ros.is_connected and go:
            joints, _ = abb.send_and_wait(rrc.GetJoints(), timeout=5)
            config = robot.zero_configuration()
            config.joint_values = to_radians(joints)
            
            sc.sticky[key] = config
            print(config)
        config = sc.sticky.get(key)

        if robot and config:
            frame = robot.forward_kinematics(config, options=dict(solver='model'))

        return (config, frame)
# ---------- end current ----------
send_trajectory = GhPythonScript(robot=robot_8, abb=abb, speed=speed, trajectory=trajectory_3, go=go_2)  # inputs trajectory: list; disabled
# ---------- send_trajectory: Python ----------
import compas_rrc as rrc
from compas_fab.robots import to_degrees

if robot and abb and abb.ros.is_connected and go:
    abb.send(rrc.PrintText("Sending {} points. Press play to move".format(len(trajectory))))
    abb.send(rrc.Stop())

    for i in range(len(trajectory)):
        c = trajectory[i]
        joints = to_degrees(c.joint_values)
        speed = speed or 500
        if i < len(trajectory) - 1:
            zone = rrc.Zone.Z10
        else:
            zone = rrc.Zone.FINE
            
        abb.send(rrc.MoveToJoints(joints, ext_axes=[], speed=speed, zone=zone))
# ---------- end send_trajectory ----------
send_pick_n_place = GhPythonScript(
    robot=robot_8,
    abb=abb,
    speed=speed,
    pick_trajectory=pick_trajectory_2,
    place_trajectory=place_trajectory_2,
    move_trajectory=move_trajectory_2,
    io_signal=panel_6,
    go=go_3)  # disabled
# ---------- send_pick_n_place: Python ----------
import compas_rrc as rrc
from compas_fab.robots import to_degrees

def send_trajectory(abb, robot, speed, points, last_point_fine=True):
    for i in range(len(points)):
        c = points[i]
        joints = to_degrees(c.joint_values)
        if i < len(points) - 1:
            zone = rrc.Zone.Z10
        else:
            zone = rrc.Zone.FINE if last_point_fine else rrc.Zone.Z10

        abb.send(rrc.MoveToJoints(joints, ext_axes=[], speed=speed, zone=zone))
    
if robot and abb and abb.ros.is_connected and go:
    total_points = len(pick_trajectory.points) * 2 + len(move_trajectory.points) * 2 + len(place_trajectory.points) * 2

    abb.send(rrc.PrintText("Sending {} PnP points. Press play to move".format(total_points)))
    abb.send(rrc.Stop())

    speed = speed or 500
    send_trajectory(abb, robot, speed, pick_trajectory.points)
    abb.send(rrc.SetDigital(io_signal, 1))
    abb.send(rrc.WaitTime(1))
    send_trajectory(abb, robot, speed, list(reversed(pick_trajectory.points)), last_point_fine=False)
    send_trajectory(abb, robot, speed, move_trajectory.points, last_point_fine=False)
    send_trajectory(abb, robot, speed, place_trajectory.points)
    abb.send(rrc.SetDigital(io_signal, 0))
    abb.send(rrc.WaitTime(1))
    send_trajectory(abb, robot, speed, list(reversed(place_trajectory.points)), last_point_fine=False)
    send_trajectory(abb, robot, speed, list(reversed(move_trajectory.points)))
# ---------- end send_pick_n_place ----------
plan_and_move = GhPythonScript(
    robot=robot_8,
    abb=abb,
    speed=speed,
    assembly=assembly_8,
    part=part_3.part,
    target_config=approach_pickup_config_3,
    go=go_4)  # disabled
# ---------- plan_and_move: Python ----------
import compas_rrc as rrc
from compas_fab.robots import CollisionMesh
from compas_fab.robots import PlanningScene
from compas_fab.robots import to_degrees
from compas_fab.robots import to_radians

from helpers import get_assembly_sequence

if robot and abb and abb.ros.is_connected and go:
    joints, _ = abb.send_and_wait(rrc.GetJoints(), timeout=5)
    current_config = robot.zero_configuration()
    current_config.joint_values = to_radians(joints)
    print current_config

    top_course = assembly.attributes["courses"]
    sequence = get_assembly_sequence(assembly, top_course)

    scene = PlanningScene(robot)
    scene.remove_collision_mesh("parts")

    for key in sequence:
        if key == part.key: break
        part_mesh = assembly.find_by_key(key).to_mesh()
        part_cm = CollisionMesh(part_mesh, "parts")
        scene.append_collision_mesh(part_cm)


    goal_constraints = robot.constraints_from_configuration(
        configuration=target_config,
        tolerances_above=[0.1] * 6,
        tolerances_below=[0.1] * 6,
    )
    trajectory = robot.plan_motion(goal_constraints,
                                   start_configuration=current_config)
    
    abb.send(rrc.PrintText("Sending {} points. Press play to move".format(len(trajectory.points))))
    abb.send(rrc.Stop())

    for i in range(len(trajectory.points)):
        c = trajectory.points[i]
        joints = to_degrees(c.joint_values)
        speed = speed or 500
        if i < len(trajectory.points) - 1:
            zone = rrc.Zone.Z10
        else:
            zone = rrc.Zone.FINE
            
        abb.send(rrc.MoveToJoints(joints, ext_axes=[], speed=speed, zone=zone))
# ---------- end plan_and_move ----------
draw_2 = Draw(cg=current.frame)  # -> rg; disabled; same code as draw
current_config = Data(current.config)  # disabled
current_frame = Data(current.frame)  # disabled

panel_7 = Panel(item)
mesh_3 = Mesh(robot_visualize.collision)
mesh_4 = Mesh(robot_visualize.visual)
