# Grasshopper definition gh_UR_file.ghx (Grasshopper 1.0.7)

info = Info()  # -> info
#   port info: Environment info.
# ---------- info: Python ----------
"""
Displays information about the active COMPAS environment.
"""
import compas_bootstrapper
from ghpythonlib.componentbase import executingcomponent as component

import compas


class CompasInfo(component):
    def RunScript(self):
        self.Message = "COMPAS v{}".format(compas.__version__)
        info = "COMPAS Version: {}\nEnvironment: {}"
        return info.format(compas.__version__, compas_bootstrapper.ENVIRONMENT_NAME)
# ---------- end info ----------
panel = Panel(info)

# ----
# IP Address
panel_2 = Panel("192.168.0.10")

# ----
# Pick and place routine: Compas Example
# Set TCP/Get TCP
button = Button()
get_tcp_offset = GhPythonScript(ip=panel_2, get_tcp=button)  # -> tcp
# ---------- get_tcp_offset: Python ----------
import os
import math
from scriptcontext import sticky as st

tcp = 'tcp_{}'.format(str(ghenv.Component.InstanceGuid))
package_path = ghdoc.Path

from compas.rpc import Proxy

if tcp not in st:
    st[tcp]= None

if get_tcp:   
    canvas = ghenv.Component.OnPingDocument()
    path = os.path.abspath(os.path.join(package_path,"../../../cdf_unity/src/cdf_unity/robot"))
    rtde = Proxy('fabrication', path=path)                         
    st[tcp] = rtde.get_tcp_offset(ip=ip)    

tcp = st[tcp]
# ---------- end get_tcp_offset ----------
set_tcp_offset = GhPythonScript(ip=panel_2, set_tcp=Button())
# ---------- set_tcp_offset: Python ----------
import os
import math
from scriptcontext import sticky as st

tcp = 'tcp_{}'.format(str(ghenv.Component.InstanceGuid))
package_path = ghdoc.Path

from compas.rpc import Proxy

if tcp not in st:
    st[tcp]= None

if set_tcp:   
    canvas = ghenv.Component.OnPingDocument()
    path = os.path.abspath(os.path.join(package_path,"../../../cdf_unity/src/cdf_unity/robot"))
    rtde = Proxy('fabrication', path=path)  
    pose = [0.61/1000,0.0,80.06/1000,0.0,3.1415,0.0]
    st[tcp] = rtde.set_tcp_offset(pose, ip=ip)    

tcp = st[tcp]
# ---------- end set_tcp_offset ----------
panel_3 = Panel(get_tcp_offset)

panel_4 = Panel("Unload libraries")
bang = Button()
unload = PythonScript(bang=bang)
# ---------- unload: Python ----------
from compas_rhino.utilities.misc import get_tolerance
from compas_rhino.utilities.misc import unload_modules

unload_modules("compas")
unload_modules("assembly_information_model")
unload_modules("cdf_unity")
unload_modules("compas_eve")
# ---------- end unload ----------

# ----
# Load Robot Attach Custom Tool
# 1. Load robot from ROS
load_robot = BooleanToggle(True)
robot = ROSRobot(load=load_robot)  # -> robot; inputs load: Boolean
#   port ros_client: The ROS client.
#   port load: If True, loads the robot from ROS. Defaults to False.
# ---------- robot: Python ----------
"""
Load robot directly from ROS.

COMPAS FAB v0.27.0
"""
from compas_ghpython.artists import RobotModelArtist
from ghpythonlib.componentbase import executingcomponent as component
from scriptcontext import sticky as st

from compas_fab.ghpython.components import create_id


class ROSRobot(component):
    def RunScript(self, ros_client, load):
        key = create_id(self, 'robot')

        if ros_client and ros_client.is_connected and load:
            # Load URDF from ROS
            st[key] = ros_client.load_robot(load_geometry=True, precision='12f')
            st[key].artist = RobotModelArtist(st[key].model)

        robot = st.get(key, None)
        if robot:  # client sometimes need to be restarted, without needing to reload geometry
            robot.client = ros_client
        return robot
# ---------- end robot ----------
robot_2 = Data(robot)

# ----
# Localization
button_2 = Button()
get_tcp_frame = GhPythonScript(get_origin=button_2, get_x=Button(), get_y=Button(), ip=panel_2)  # -> frame, origin, x_pt, y_pt
# ---------- get_tcp_frame: Python ----------
import os
from scriptcontext import sticky as st
#sticky is a persistent dictionary which can save values and also be acessed by other GH components
#we use it here with a custom key to store values we read from the robot
from compas.rpc import Proxy
package_path = ghdoc.Path
path = os.path.abspath(os.path.join(package_path,"../../../cdf_unity/src/cdf_unity/robot"))


origin_key = 'origin_{}'.format(str(ghenv.Component.InstanceGuid))
x_key = 'x_{}'.format(str(ghenv.Component.InstanceGuid))
y_key = 'y_{}'.format(str(ghenv.Component.InstanceGuid))

if origin_key not in st:
    st[origin_key] = None

if x_key not in st:
    st[x_key] = None

if y_key not in st:
    st[y_key] = None

if get_origin:
    canvas = ghenv.Component.OnPingDocument()
    rtde = Proxy('fabrication', path=path)
    frame = rtde.get_tcp_frame(ip=ip)
    st[origin_key] = frame.point

if get_x:
    canvas = ghenv.Component.OnPingDocument()
    rtde = Proxy('fabrication', path=path)
    frame = rtde.get_tcp_frame(ip=ip)
    st[x_key] = frame.point

if get_y:
    canvas = ghenv.Component.OnPingDocument()
    rtde = Proxy('fabrication', path=path)
    frame = rtde.get_tcp_frame(ip=ip)
    st[y_key] = frame.point


origin = st[origin_key]
x_pt = st[x_key]
y_pt = st[y_key]
# ---------- end get_tcp_frame ----------

# ----
# Robot
robot_3 = Data(robot_2)

# ----
# Attach tool
value_list = ValueList({"parallel_gripper_ethz": 0, "parallel_gripper_ethz_with_mtip": 1}, selected="parallel_gripper_ethz")
show = BooleanToggle(True)
py = PythonScript()  # -> DATA
# ---------- py: Python ----------
import os

#package_path = os.path.dirname(mobile_fabrication_control.__file__)
#DATA = os.path.abspath(os.path.join(package_path,"../../data"))

package_path = ghdoc.Path
# package_path = os.path.dirname(ur_fabrication_control.__file__)
#DATA = os.path.abspath(os.path.join(package_path,"../../data"))

# .stl files not stored in am_hackathon repo. but in mobile_fabrication_control
DATA = os.path.abspath(os.path.join(package_path,"../../../cdf_unity/data"))

print(package_path)
print(DATA)
# ---------- end py ----------
tool = PythonScript(data_path=py, tool=value_list, show=show)  # -> tool, M, cm, ee_plane
# ---------- tool: Python ----------
import os, math
from compas.geometry import Frame, Rotation
from compas.datastructures import Mesh
from compas_ghpython.artists import MeshArtist
from compas_fab.robots import Tool
from compas_ghpython.utilities import draw_frame

tolerance = 0

if tool == 0:
    filename = 'parallel_gripper_ethz_2.stl'
    cm_filename = 'parallel_gripper_ethz_2_cm_OPEN.stl'
#    ee_frame = Frame([0,0,0.087], [0, 1, 0], [-1, 0, 0])
    ee_frame = Frame([0,0,0.087], [-0.814788,-0.579758,0], [-0.579758,0.814788,0])

elif tool == 1:
    filename = 'parallel_gripper_ethz_with_mtip_2.stl'
    cm_filename = 'parallel_gripper_ethz_with_mtip_2_cm.stl'
#    ee_frame = Frame([0,0,0.105], [0, 1, 0], [-1, 0, 0])
    ee_frame = Frame([0,0,0.103], [-0.814788,-0.579758,0], [-0.579758,0.814788,0])

    
data_path = os.path.join(data_path, "tool_geometry")
fullfilename = os.path.join(data_path, filename)
cm_fullfilename = os.path.join(data_path, cm_filename)
print fullfilename

ee_mesh = Mesh.from_stl(fullfilename)
cm_mesh = Mesh.from_stl(cm_fullfilename)

if show:
    artist = MeshArtist(ee_mesh)
    artist_cm = MeshArtist(cm_mesh)
    M = artist.draw()
    cm = artist_cm.draw()
    ee_plane = draw_frame(ee_frame)

#tool = Tool(ee_mesh, ee_frame)

print(ee_frame.quaternion.xyzw)
ee_framek = Frame([0.0110607,0.00809854,0.41498], [0,1,0], [1,0,0])
print(ee_framek.quaternion.xyzw)
# ---------- end tool ----------
panel_5 = Panel("Attach a custom tool")
mesh = Mesh(tool.M)
plane = Plane(tool.ee_plane)

# ----
# Stick Holder
mesh_2 = Mesh([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])
table = GhPythonScript(robot=robot_3, meshes=mesh_2)  # inputs meshes: list of Mesh; disabled
# ---------- table: Python ----------
from compas_fab.robots import PlanningScene
from compas_fab.robots import CollisionMesh
from compas_rhino.conversions import RhinoMesh

if robot:
    scene = PlanningScene(robot)
    for mesh in meshes:
        mesh = RhinoMesh.from_geometry(mesh).to_compas()
        cm = CollisionMesh(mesh, "stick holder")
        scene.append_collision_mesh(cm)
# ---------- end table ----------

# ----
# Measure a plane
panel_6 = Panel(get_tcp_frame.y_pt)
panel_7 = Panel(get_tcp_frame.x_pt)
panel_8 = Panel(get_tcp_frame.origin)
draw = Draw(cg=get_tcp_frame.y_pt)  # -> rg
#   port cg: The COMPAS geometry or datastructure to be drawn.
#   port rg: The Rhino geometry object.
# ---------- draw: Python ----------
"""
Draws COMPAS geometry in Grasshopper.
"""
from ghpythonlib.componentbase import executingcomponent as component

from compas.artists import Artist


class CompasToRhinoGeometry(component):
    def RunScript(self, cg):
        if not cg:
            return None

        return Artist(cg).draw()
# ---------- end draw ----------
draw_2 = Draw(cg=get_tcp_frame.x_pt)  # -> rg; same code as draw
draw_3 = Draw(cg=get_tcp_frame.origin)  # -> rg; same code as draw
ghpython_script = GhPythonScript(origin=draw_3, x_axis_pt=draw_2, y_axis_pt=draw)  # -> out, base_plane; inputs origin: Point3d, x_axis_pt: Point3d, y_axis_pt: Point3d
# ---------- ghpython_script: Python ----------
import Rhino.Geometry as rg

if origin is not None and x_axis_pt is not None and y_axis_pt is not None:
    origin = origin
    x_axis = x_axis_pt
    xy_plane_pt = y_axis_pt
    
    base_plane = rg.Plane(origin, x_axis, xy_plane_pt)
# ---------- end ghpython_script ----------
panel_9 = Panel(ghpython_script.base_plane)

# ----
# Table Mesh
mesh_3 = Mesh(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)
table_2 = GhPythonScript(robot=robot_3, mesh=mesh_3)  # inputs mesh: Mesh
# ---------- table_2: Python ----------
from compas_fab.robots import PlanningScene
from compas_fab.robots import CollisionMesh
from compas_rhino.conversions import RhinoMesh

if robot:
    scene = PlanningScene(robot)
    mesh = RhinoMesh.from_geometry(mesh).to_compas()
    cm = CollisionMesh(mesh, "table")
    scene.add_collision_mesh(cm)
# ---------- end table_2 ----------

mesh_4 = Mesh(tool.cm)

# ----
# 2. Attach tool and Additional Collision Meshes
attached_tool = AttachedTool(robot=robot_3, visual_mesh=mesh, collision_mesh=mesh_4, tcf_plane=plane)  # -> robot; inputs visual_mesh: Mesh, collision_mesh: Mesh
#   port visual_mesh: A visual mesh for the tool.
#   port collision_mesh: A collision mesh for the tool.
#   port tcf_plane: The frame of the tool in tool0 frame.
#   port group: The planning group to which the tool should be attached.
# ---------- attached_tool: Python ----------
"""
Attach a tool to the robot.

COMPAS FAB v0.27.0
"""
from ghpythonlib.componentbase import executingcomponent as component
from compas_rhino.conversions import RhinoMesh
from compas_rhino.conversions import plane_to_compas_frame

from compas.geometry import Frame
from compas_fab.robots import Tool


class AttachToolComponent(component):
    def RunScript(self, robot, visual_mesh, collision_mesh, tcf_plane, group):
        if robot and robot.client and robot.client.is_connected and visual_mesh:
            if not collision_mesh:
                collision_mesh = visual_mesh

            c_visual_mesh = RhinoMesh.from_geometry(visual_mesh).to_compas()
            c_collision_mesh = RhinoMesh.from_geometry(collision_mesh).to_compas()

            if not tcf_plane:
                frame = Frame.worldXY()
            else:
                frame = plane_to_compas_frame(tcf_plane)
            tool = Tool(c_visual_mesh, frame, c_collision_mesh)

            robot.attach_tool(tool, group)

        return robot
# ---------- end attached_tool ----------
robot_4 = Data(attached_tool)

# ----
# Model Plane: Are you are Measuring a QR?
value_list_2 = ValueList({"QR Code 0": 0, "QR Code 1": 1, "QR Code 2": 2, "QR Code 3": 3, "QR Code 4": 4}, selected="QR Code 0")
plane_2 = Plane()
ghpython_script_2 = GhPythonScript(selected_QR_index=value_list_2, model_planes=plane_2)  # -> out, selected_plane; inputs model_planes: list of Plane
# ---------- ghpython_script_2: Python ----------
import Rhino.Geometry as rg

if selected_QR_index == 0:
    selected_plane = model_planes[selected_QR_index]

elif selected_QR_index == 1:
    selected_plane = model_planes[selected_QR_index]

elif selected_QR_index == 2:
    selected_plane = model_planes[selected_QR_index]

elif selected_QR_index == 3:
    selected_plane = model_planes[selected_QR_index]

elif selected_QR_index == 4:
    selected_plane = model_planes[selected_QR_index]
# ---------- end ghpython_script_2 ----------

# ----
# Model Plane: Are you Measuring a Base Markers?
point = Point([Point(-0.225, -0.225, 0.001), Point(-0.075, -0.225, 0.001), Point(0.075, -0.225, 0.001), Point(0.225, -0.225, 0.001), Point(-0.225, -0.075, 0.001), Point(0.225, -0.075, 0.001), Point(-0.225, 0.075, 0.0005), Point(0.225, 0.075, 0.001), Point(-0.225, 0.225, 0.001), Point(-0.075, 0.225, 0.001), Point(0.075, 0.225, 0.001), Point(0.225, 0.225, 0.001)])
value_list_3 = ValueList({"Marker 0": 0, "Marker 1": 1, "Marker 2": 2, "Marker 3": 3, "Marker 4": 4, "Marker 5": 5, "Marker 6": 6, "Marker 7": 7, "Marker 8": 8, "Marker 9": 9, "Marker 10": 10, "Marker 11": 11}, selected="Marker 5")
xy_plane = XYPlane(Origin=point)
ghpython_script_3 = GhPythonScript(selected_QR_index=value_list_3, model_planes=xy_plane)  # -> out, selected_plane; inputs model_planes: list of Plane
# ---------- ghpython_script_3: Python ----------
import Rhino.Geometry as rg

if selected_QR_index == 0:
    selected_plane = model_planes[selected_QR_index]

elif selected_QR_index == 1:
    selected_plane = model_planes[selected_QR_index]

elif selected_QR_index == 2:
    selected_plane = model_planes[selected_QR_index]

elif selected_QR_index == 3:
    selected_plane = model_planes[selected_QR_index]

elif selected_QR_index == 4:
    selected_plane = model_planes[selected_QR_index]

elif selected_QR_index == 5:
    selected_plane = model_planes[selected_QR_index]

elif selected_QR_index == 6:
    selected_plane = model_planes[selected_QR_index]

elif selected_QR_index == 7:
    selected_plane = model_planes[selected_QR_index]

elif selected_QR_index == 8:
    selected_plane = model_planes[selected_QR_index]

elif selected_QR_index == 9:
    selected_plane = model_planes[selected_QR_index]

elif selected_QR_index == 10:
    selected_plane = model_planes[selected_QR_index]

elif selected_QR_index == 11:
    selected_plane = model_planes[selected_QR_index]
# ---------- end ghpython_script_3 ----------

# ----
# Measured Planes
# Measured_plane_0 Internalized
plane_3 = Plane(Plane(origin=(-0.8167820407, 0.3777454694, -0.7626233109), x=(0.6498067614, 0.7600816773, -0.005197762801), y=(-0.760085977, 0.6498207651, 0.001510261909)))

# ----
# Measured Plane
plane_4 = Plane(ghpython_script.base_plane)

# ----
# #5: 9/3/2023
plane_5 = Plane(Plane(origin=(-0.9168751208, -0.4094788098, -0.7623235467), x=(0.9983079436, -0.05673933171, -0.01272391376), y=(0.05669678585, 0.9983846606, -0.003680214818)))

# ----
# Transform component
ghpython_script_4 = GhPythonScript(measured_plane=plane_5, model_plane=ghpython_script_3.selected_plane)  # -> out, RCFtoWCF, WCFtoRCF; inputs measured_plane: Plane, model_plane: Plane
# ---------- ghpython_script_4: Python ----------
from compas.geometry import Transformation
from compas.geometry import Frame
from compas_rhino.conversions import plane_to_compas_frame
from compas_rhino.conversions import xform_to_rhino
from Rhino.Geometry import Transform

#Convert to compas frames
measured_frame = plane_to_compas_frame(measured_plane)
model_frame = plane_to_compas_frame(model_plane)

#Transform from model frame to measured frame
t_WCFtoRCF = Transformation.from_frame_to_frame(model_frame, measured_frame)
t_RCFtoWCF = t_WCFtoRCF.inverse()

#Convert to rhino
RCFtoWCF = xform_to_rhino(t_RCFtoWCF)
WCFtoRCF = xform_to_rhino(t_WCFtoRCF)
# ---------- end ghpython_script_4 ----------

# ----
# Unbuilt Geometry
transform = Transform(Transform=ghpython_script_4.WCFtoRCF)

# ----
# Transform Design from:
# WCF to RCF space
# Design Transformed
# Place Plane
transform_2 = Transform(Transform=ghpython_script_4.WCFtoRCF)

# ----
# Built Geometry
transform_3 = Transform(Transform=ghpython_script_4.WCFtoRCF)

# ----
# Built Geometry:
# Collision Meshes
transform_4 = Transform(Transform=ghpython_script_4.WCFtoRCF)

# ----
# Base & Feet
transform_5 = Transform(Transform=ghpython_script_4.WCFtoRCF)

# ----
# fix pick and place plane
panel_11 = Panel("")

# ----
# Left
point_2 = Point(Point(0.2595000186, -0.3095, 0.03))

number_slider = Slider(0.05, range=0..0.1)

# ----
# Pick Station Location
# back
point_3 = Point(Point(0.5330000186, 0.035, 0.03))

# ----
# Pick_Plane
number_slider_2 = Slider(270, range=0..270)
construct_plane = ConstructPlane(Origin=point_3, XAxis=Vector(1, 0, 0), YAxis=Vector(0, 1, 0))
negative = Negative(Value=number_slider_2)
rotate = Rotate(Geometry=construct_plane, Angle=degrees(negative), Plane=construct_plane)  # -> Geometry, Transform

neg = Negative(Value=number_slider)
cluster = Cluster(geometry=plane, plane=plane, amplitude=neg)
relay = Relay()

# ----
# Place Plane
plane_6 = Plane(transform_2)

# ----
# Get Current Config
button_3 = Button()
get_config = GhPythonScript(ip=panel_2)  # -> config, a
# ---------- get_config: Python ----------
import os
from scriptcontext import sticky as st
#sticky is a persistent dictionary which can save values and also be acessed by other GH components
#we use it here with a custom key to store values we read from the robot
from compas.rpc import Proxy
package_path = ghdoc.Path

config_key = 'config_{}'.format(str(ghenv.Component.InstanceGuid))
new_key = 'new_key_{}'.format(str(ghenv.Component.InstanceGuid))
if config_key not in st:
    st[config_key] = None

if send:
    canvas = ghenv.Component.OnPingDocument()
    path = os.path.abspath(os.path.join(package_path,"../../../cdf_unity/src/cdf_unity/robot"))
    print (path)
    rtde = Proxy('fabrication', path=path)
    
    st[config_key] = rtde.get_config(ip=ip)
    st[new_key] = rtde.get_config(ip=ip)
#    a = rtde.get_config(ip=ip)
config = st[config_key]
# ---------- end get_config ----------

# ----
# New Stick CM
orient = Orient(Geometry=relay, Source=PlaneXY(0, 0, 0), Target=cluster)  # -> Geometry, Transform
mesh_5 = Mesh(orient.Geometry)

# ---- group: EDIT PICK AND PLACE LOCATION
cluster_2 = Cluster(geometry=rotate.Geometry, plane=rotate.Geometry, amplitude=number_slider)

# ----
# Robot
data_dam = DataDam(DataDataA=robot_4, BufferDelay=10000000, BufferMode=0)
# Solve IK & Plan Pick Trajectory
robot_5 = Data(data_dam)

# ---- group: EDIT PICK AND PLACE LOCATION
cluster_3 = Cluster(geometry=plane_6, plane=plane_6, amplitude=number_slider)

# ----
# Stick Holder Mesh
mesh_6 = Mesh([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])

# ----
# Table Mesh
mesh_7 = Mesh(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)

plan_pickup = GhPythonScript(
    robot=robot_5,
    pick_plane=cluster_2,
    approach_distance=Slider(0.5, range=0..1),
    table_mesh=mesh_7,
    update=Button(),
    compute=Toggle(True))  # -> pick_config, pick_trajectory, pick_trajectory_frames, approach_pick_config; inputs pick_plane: Plane, table_mesh: Mesh
# ---------- plan_pickup: Python ----------
"""
Calculate pickup of a part.
"""
from ghpythonlib.componentbase import executingcomponent as component
from scriptcontext import sticky as st

from compas.artists import Artist
from compas.geometry import Frame
from compas.geometry import Transformation
from compas.geometry import scale_vector, add_vectors
from compas_rhino.conversions import RhinoPlane
from compas_fab.robots import CollisionMesh
from compas_rhino.conversions import RhinoMesh

from compas_fab.ghpython.components import create_id
from compas_rhino.conversions import plane_to_compas_frame
from compas_fab.robots import PlanningScene

class PickPart(component):
    def RunScript(self, robot, group, start_configuration, pick_plane, approach_distance, table_mesh, update, compute):
        self.Message = ""

        pick_config = None
        approach_pick_config = None
        pick_trajectory = None
        pick_trajectory_frames = []
        pick_frame = plane_to_compas_frame(pick_plane)

        if not start_configuration or not pick_plane:
            self.Message = "No approach or current configs defined"
            return pick_config, pick_trajectory, pick_trajectory_frames, approach_pick_config

        approach_pick_frame = pick_frame.copy()
        
        if approach_distance > 0:
                frame_normal = approach_pick_frame.normal
                frame_normal_scaled = scale_vector(frame_normal, approach_distance)
                new_frame_origin = add_vectors(approach_pick_frame.point, frame_normal_scaled)
                approach_pick_frame = Frame(new_frame_origin, approach_pick_frame.xaxis, approach_pick_frame.yaxis)

        if (update or not pick_config or not approach_pick_config) and robot and robot.client and robot.client.is_connected:
            scene = PlanningScene(robot)
            mesh = RhinoMesh.from_geometry(table_mesh).to_compas()
            cm = CollisionMesh(mesh, "table")
            scene.add_collision_mesh(cm)
    #            scene.remove_collision_mesh("sticks")
            
            pick_config = robot.inverse_kinematics(pick_frame, start_configuration, group)
            approach_pick_config = robot.inverse_kinematics(approach_pick_frame, pick_config, group)
        
        self.Message = "Found pick up configurations\nusing {:.2f}m approach distance".format(approach_distance)



        # Compute PICK trajectory
        if compute and robot and robot.client and robot.client.is_connected:
            max_step = 0.2
            frames = [
                       robot.forward_kinematics(c, group, options=dict(solver='model'))
                       for c in (approach_pick_config, pick_config)
                     ]

            trajectory = robot.plan_cartesian_motion(frames,
                                                     start_configuration=approach_pick_config,
                                                     group=group,
                                                     options=dict(
                                                         max_step=max_step,
                                                     ))
            if trajectory.fraction < 1:
                raise Exception("Incomplete cartesian trajectory found. Only {:.1f}% of the trajectory could be planned".format(trajectory.fraction * 100))

            # Only assign if trajectory is greater then 1
            pick_trajectory = trajectory

        if pick_trajectory:
            for c in pick_trajectory.points:
                frame = robot.forward_kinematics(c, group, options=dict(solver='model'))
                pick_trajectory_frames.append(Artist(frame).draw())
        
        if pick_trajectory:
            self.Message = "Found all trajectories ({} points)".format(len(pick_trajectory.points))

        return pick_config, pick_trajectory, pick_trajectory_frames, approach_pick_config
# ---------- end plan_pickup ----------

# ----
# Planning Robotic Movement
planner_id = ValueList({"TRRT": 'TRRT', "RRT": 'RRT', "RRT*": 'RRT*', "Lazy RRT": 'Lazy RRT'}, selected="TRRT")

# ----
# Solve IK Solutions & Plan: Exit, Place, Move to Pick, Move, and Place Trajectories
number_slider_3 = Slider(0.1, range=0..1)
plan_trajectories = GhPythonScript(
    robot=robot_5,
    approach_pick_config=plan_pickup.approach_pick_config,
    place_plane=cluster_3,
    sticks_cm=transform_4,
    new_stick_cm=mesh_5,
    table_cm=mesh_7,
    planner_id=planner_id,
    approach_distance=number_slider_3,
    update_place_frame=Button(),
    compute=Toggle(True))  # -> exit_trajectory, exit_trajectory_frames, exit_safe_config, move_to_pick_trajectory, move_to_pick_trajectory_frames, place_config, approach_place_config, place_trajectory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; inputs sticks_cm: list of Mesh, new_stick_cm: Mesh, table_cm: Mesh, compute: Boolean
# ---------- plan_trajectories: Python ----------
"""
Calculate pickup trajectory of a part.
"""
import math
from ghpythonlib.componentbase import executingcomponent as component
from scriptcontext import sticky as st

from compas.artists import Artist
from compas.geometry import Frame
from compas.geometry import Transformation
from compas_rhino.conversions import RhinoPlane
from compas_rhino.conversions import RhinoMesh
from compas.geometry import scale_vector, add_vectors
from compas_fab.ghpython.components import create_id
from compas_fab.robots import AttachedCollisionMesh
from compas_rhino.conversions import plane_to_compas_frame
from compas_fab.robots import CollisionMesh
from compas_fab.robots import PlanningScene


class PlanPartPickupTrajectory(component):
    def RunScript(self, robot, group, current_config, approach_pick_config, place_plane, sticks_cm, new_stick_cm, table_cm, planner_id, approach_distance, update_place_frame, compute):
        self.Message = ""
        
        exit_trajectory = None
        move_to_pick_trajectory = None
        place_trajectory = None
        move_trajectory = None


        exit_trajectory_frames = []
        move_to_pick_trajectory_frames = []
        place_trajectory_frames = []
        move_trajectory_frames = []
        attached_collision_meshes = []

        place_config = None
        approach_place_config = None
        exit_safe_config = None

        place_frame = plane_to_compas_frame(place_plane)

        if not approach_pick_config or not current_config:
            self.Message = "No approach or current configs defined"
            return exit_trajectory, exit_trajectory_frames, exit_safe_config, move_to_pick_trajectory, move_to_pick_trajectory_frames, place_config, approach_place_config, place_trajectory, place_trajectory_frames, move_trajectory, move_trajectory_frames

        # Clean scene
        if compute and robot and robot.client and robot.client.is_connected:
            scene = PlanningScene(robot)
            scene.remove_collision_mesh("sticks")
            #Remove attached collision mesh?
            scene.remove_collision_mesh("attachedstick")
            scene.reset()

            #Add Stick Collision Meshes Again
            for mesh in sticks_cm:
                stick_cm = CollisionMesh(mesh, "sticks")
                scene.append_collision_mesh(stick_cm)
            
            #Add Table Collision Mesh Again
            table_compas_mesh = RhinoMesh.from_geometry(table_cm).to_compas()
            table_cm = CollisionMesh(table_compas_mesh, "table")
            scene.add_collision_mesh(table_cm)
            
    #            #Add Stick Holder Collision Meshes Again
    #            for mesh_holder in holder_cm:
    #                mesh_holder = RhinoMesh.from_geometry(mesh_holder).to_compas()
    #                holder_cm = CollisionMesh(mesh_holder, "stickholder")
    #                scene.append_collision_mesh(holder_cm)



        if not approach_pick_config or not place_plane:
            self.Message = "No approach config or place plane defined"
            return exit_trajectory, exit_trajectory_frames, exit_safe_config, move_to_pick_trajectory, move_to_pick_trajectory_frames, place_config, approach_place_config, place_trajectory, place_trajectory_frames, move_trajectory, move_trajectory_frames


        # Compute Exit safe configuration
        current_robot_frame = robot.forward_kinematics(current_config, group, options=dict(solver='model'))
        exit_safe_frame = self._offset_approach_frame(current_robot_frame, approach_distance)
        exit_safe_config = robot.inverse_kinematics(exit_safe_frame, current_config, group)


        #Compute Exit Trajectory
        if compute and robot and robot.client and robot.client.is_connected:
            
            max_step = 0.1
            frames = [
                       robot.forward_kinematics(c, group, options=dict(solver='model'))
                       for c in (current_config, exit_safe_config)
                     ]
            
            trajectory = robot.plan_cartesian_motion(frames,
                                                     start_configuration=current_config,
                                                     group=group,
                                                     options=dict(
                                                         max_step=max_step,
                                                         attached_collision_meshes = attached_collision_meshes
                                                     ))
            if trajectory.fraction < 1:
                raise Exception("Incomplete cartesian trajectory found for exit trajectory. Only {:.1f}% of the trajectory could be planned".format(trajectory.fraction * 100))

            # Only assign if fraction is full
            exit_trajectory = trajectory

        if exit_trajectory:
            for c in exit_trajectory.points:
                frame = robot.forward_kinematics(c, group, options=dict(solver='model'))
                exit_trajectory_frames.append(Artist(frame).draw())


        #Compute Move to Approach Pick config
        if compute and robot and robot.client and robot.client.is_connected:
            planner_id = planner_id or 'TRRT'

            tolerance_above = self._generate_default_tolerances(robot.get_configurable_joints(group))
            tolerance_below = self._generate_default_tolerances(robot.get_configurable_joints(group))
            goal_constraints = robot.constraints_from_configuration(
                configuration=approach_pick_config,
                tolerances_above=tolerance_above,
                tolerances_below=tolerance_below,
                group=group
            )

            move_to_pick_trajectory = robot.plan_motion(goal_constraints,
                                                                   start_configuration=exit_safe_config,
                                                                   group=group,
                                                                   options=dict(
                                                                       planner_id=planner_id,
                                                                       attached_collision_meshes=attached_collision_meshes
                                                                   ))

        move_to_pick_trajectory = move_to_pick_trajectory

        if move_to_pick_trajectory:
            for c in move_to_pick_trajectory.points:
                frame = robot.forward_kinematics(c, group, options=dict(solver='model'))
                move_to_pick_trajectory_frames.append(Artist(frame).draw())



        #Compute place config and approach place config
        if (update_place_frame or not place_config or not approach_place_config) and robot and robot.client and robot.client.is_connected:
            scene = PlanningScene(robot)
            scene.remove_collision_mesh("sticks")

            approach_place_frame = self._offset_approach_frame(place_frame, approach_distance)
            
            #DOUBLE CHECK: If it fails
            approach_place_config = robot.inverse_kinematics(approach_place_frame, approach_pick_config, group)
            place_config = robot.inverse_kinematics(place_frame, approach_place_config, group)

        self.Message = "Found place configurations\nusing {:.2f}m approach distance".format(approach_distance)


        # Compute PLACE trajectory
        if compute and robot and robot.client and robot.client.is_connected:
            
            # Add New Stick CM on robot
            new_stick_compas_mesh = RhinoMesh.from_geometry(new_stick_cm).to_compas()
            cm = CollisionMesh(new_stick_compas_mesh, "attachedstick")
            ee_link_name = 'tool'
            acm = AttachedCollisionMesh(cm, ee_link_name) 
            attached_collision_meshes.append(acm)
            scene.attach_collision_mesh_to_robot_end_effector(cm)
            
            max_step = 0.10
            frames = [
                       robot.forward_kinematics(c, group, options=dict(solver='model'))
                       for c in (approach_place_config, place_config)
                     ]
            
            trajectory = robot.plan_cartesian_motion(frames,
                                                     start_configuration=approach_place_config,
                                                     group=group,
                                                     options=dict(
                                                         max_step=max_step,
                                                         attached_collision_meshes = attached_collision_meshes
                                                     ))
            if trajectory.fraction < 1:
                raise Exception("Incomplete cartesian trajectory found for place trajectory. Only {:.1f}% of the trajectory could be planned".format(trajectory.fraction * 100))

            # Only assign if fraction is full
            place_trajectory = trajectory

        if place_trajectory:
            for c in place_trajectory.points:
                frame = robot.forward_kinematics(c, group, options=dict(solver='model'))
                place_trajectory_frames.append(Artist(frame).draw())

        # Compute MOVE trajectory
        if compute and robot and robot.client and robot.client.is_connected:
            planner_id = planner_id or 'TRRT'

            # Add New Stick CM on robot
            new_stick_compas_mesh = RhinoMesh.from_geometry(new_stick_cm).to_compas()
            cm = CollisionMesh(new_stick_compas_mesh, "attachedstick")
            ee_link_name = 'tool'
            acm = AttachedCollisionMesh(cm, ee_link_name) 
            attached_collision_meshes.append(acm)
            scene.attach_collision_mesh_to_robot_end_effector(cm)

            tolerance_above = self._generate_default_tolerances(robot.get_configurable_joints(group))
            tolerance_below = self._generate_default_tolerances(robot.get_configurable_joints(group))
            goal_constraints = robot.constraints_from_configuration(
                configuration=approach_place_config,
                tolerances_above=tolerance_above,
                tolerances_below=tolerance_below,
                group=group
            )

            move_trajectory = robot.plan_motion(goal_constraints,
                                                                   start_configuration=approach_pick_config,
                                                                   group=group,
                                                                   options=dict(
                                                                       planner_id=planner_id,
                                                                       attached_collision_meshes=attached_collision_meshes
                                                                   ))

        move_trajectory = move_trajectory

        if move_trajectory:
            for c in move_trajectory.points:
                frame = robot.forward_kinematics(c, group, options=dict(solver='model'))
                move_trajectory_frames.append(Artist(frame).draw())


        if exit_trajectory and move_to_pick_trajectory and place_trajectory and move_trajectory:
            self.Message = "Found all trajectories ({} points)".format(len(exit_trajectory.points) + len(move_to_pick_trajectory.points) + len(place_trajectory.points) + len(move_trajectory.points))

        return exit_trajectory, exit_trajectory_frames, exit_safe_config, move_to_pick_trajectory, move_to_pick_trajectory_frames, place_config, approach_place_config, place_trajectory, place_trajectory_frames, move_trajectory, move_trajectory_frames

    def _generate_default_tolerances(self, joints):
        DEFAULT_TOLERANCE_METERS = .001
        DEFAULT_TOLERANCE_RADIANS = math.radians(1)

        return [
            DEFAULT_TOLERANCE_METERS if j.is_scalable()
            else DEFAULT_TOLERANCE_RADIANS
            for j in joints
        ]
        
    def _offset_approach_frame(self, frame, approach_distance):
        
        frame = frame.copy()
        offset_frame = frame.copy()
            
        if approach_distance > 0:
            frame_normal = offset_frame.normal
            frame_normal_scaled = scale_vector(frame_normal, approach_distance)
            new_frame_origin = add_vectors(offset_frame.point, frame_normal_scaled)
            offset_frame = Frame(new_frame_origin, offset_frame.xaxis, offset_frame.yaxis)
        
        return offset_frame
# ---------- end plan_trajectories ----------

# ----
# Internalize Trajectory and Config Data without Issues
# Feed the configs here:
# (configs = trajectory.points)
ghpython_script_5 = GhPythonScript(configs=["Grasshopper.Kernel.Types.GH_ObjectWrapper", "Grasshopper.Kernel.Types.GH_ObjectWrapper", "Grasshopper.Kernel.Types.GH_ObjectWrapper", "Grasshopper.Kernel.Types.GH_ObjectWrapper", "Grasshopper.Kernel.Types.GH_ObjectWrapper", "Grasshopper.Kernel.Types.GH_ObjectWrapper", "Grasshopper.Kernel.Types.GH_ObjectWrapper", "Grasshopper.Kernel.Types.GH_ObjectWrapper", "Grasshopper.Kernel.Types.GH_ObjectWrapper", "Grasshopper.Kernel.Types.GH_ObjectWrapper", "Grasshopper.Kernel.Types.GH_ObjectWrapper", "Grasshopper.Kernel.Types.GH_ObjectWrapper", "Grasshopper.Kernel.Types.GH_ObjectWrapper", "Grasshopper.Kernel.Types.GH_ObjectWrapper", "Grasshopper.Kernel.Types.GH_ObjectWrapper", "Grasshopper.Kernel.Types.GH_ObjectWrapper", "Grasshopper.Kernel.Types.GH_ObjectWrapper", "Grasshopper.Kernel.Types.GH_ObjectWrapper", "Grasshopper.Kernel.Types.GH_ObjectWrapper", "Grasshopper.Kernel.Types.GH_ObjectWrapper", "Grasshopper.Kernel.Types.GH_ObjectWrapper", "Grasshopper.Kernel.Types.GH_ObjectWrapper", "Grasshopper.Kernel.Types.GH_ObjectWrapper", "Grasshopper.Kernel.Types.GH_ObjectWrapper", "Grasshopper.Kernel.Types.GH_ObjectWrapper", "Grasshopper.Kernel.Types.GH_ObjectWrapper", "Grasshopper.Kernel.Types.GH_ObjectWrapper", "Grasshopper.Kernel.Types.GH_ObjectWrapper", "Grasshopper.Kernel.Types.GH_ObjectWrapper", "Grasshopper.Kernel.Types.GH_ObjectWrapper", "Grasshopper.Kernel.Types.GH_ObjectWrapper", "Grasshopper.Kernel.Types.GH_ObjectWrapper", "Grasshopper.Kernel.Types.GH_ObjectWrapper", "Grasshopper.Kernel.Types.GH_ObjectWrapper", "Grasshopper.Kernel.Types.GH_ObjectWrapper", "Grasshopper.Kernel.Types.GH_ObjectWrapper", "Grasshopper.Kernel.Types.GH_ObjectWrapper", "Grasshopper.Kernel.Types.GH_ObjectWrapper"])  # -> configs_data; inputs configs: list
# ---------- ghpython_script_5: Python ----------
import json

configs_data =[]

for c in configs:
    data = c.to_data()
    d = json.dumps(data)
    configs_data.append(d)
# ---------- end ghpython_script_5 ----------

# ----
# place and approach place configs
merge = Merge(Data1=plan_trajectories.approach_place_config, Data2=plan_trajectories.place_config)

# ----
# Read Configs as degrees
# Current, pick, and approach configs
merge_2 = Merge(Data2=plan_pickup.pick_config, Data3=plan_pickup.approach_pick_config)

ghpython_script_6 = GhPythonScript(x=merge)  # -> out, config_degrees; inputs x: list
# ---------- ghpython_script_6: Python ----------
import math
from ghpythonlib import treehelpers


config_degrees = []

for i in x:
    temp = []
    i = i.joint_values
    print(i)
    for j in i:
        degrees = math.degrees(j)
        temp.append(degrees)
    config_degrees.append(temp)

config_degrees = treehelpers.list_to_tree(config_degrees)
# ---------- end ghpython_script_6 ----------
panel_12 = Panel(ghpython_script_6.config_degrees)

# ----
# Full Trajectory
merge_3 = GhPythonScript(
    exit_trajectory=plan_trajectories.exit_trajectory,
    move_to_pick_trajectory=plan_trajectories.move_to_pick_trajectory,
    pick_trajectory=plan_pickup.pick_trajectory,
    place_trajectory=plan_trajectories.place_trajectory,
    move_trajectory=plan_trajectories.move_trajectory)  # -> trajectory
# ---------- merge_3: Python ----------
if pick_trajectory and move_trajectory and place_trajectory:
    trajectory = exit_trajectory.points + \
                 move_to_pick_trajectory.points + \
                 pick_trajectory.points + \
                 list(reversed(pick_trajectory.points)) + \
                 move_trajectory.points + \
                 place_trajectory.points
# ---------- end merge_3 ----------
trajectory = Data(merge_3)

# ----
# Pick Trajectory
merge_4 = GhPythonScript(pick_trajectory=plan_pickup.pick_trajectory)  # -> trajectory
# ---------- merge_4: Python ----------
if pick_trajectory:
    trajectory = pick_trajectory.points
# ---------- end merge_4 ----------
trajectory_2 = Data(merge_4)

# ----
# Internalize this:
data = Data(ghpython_script_5)

ghpython_script_7 = GhPythonScript(c=data)  # -> configs; inputs c: list
# ---------- ghpython_script_7: Python ----------
import json
import compas_fab.robots

configs =[]

for i in c:
    data = json.loads(i)
    conf = compas_fab.robots.JointTrajectoryPoint.from_data(data)
    configs.append(conf)
# ---------- end ghpython_script_7 ----------

# ----
# approach_pick_config
approach_pickup_config = Data(plan_pickup.approach_pick_config)

# ----
# exit_safe_config
trajectory_3 = Data(plan_trajectories.exit_safe_config)

# ----
# place_config
trajectory_4 = Data(plan_trajectories.place_config)

# ----
# approach_place_config
trajectory_5 = Data(plan_trajectories.approach_place_config)

# ----
# current_config
data_2 = Data(get_config.config)

# ----
# pick_config
pickup_config = Data(plan_pickup.pick_config)

# ----
# Visualization
panel_13 = Panel("")

# ----
# Pick and Place Routine
# Trajectory Compiling
merge_5 = GhPythonScript(
    exit_trajectory=plan_trajectories.exit_trajectory,
    move_to_pick_trajectory=plan_trajectories.move_to_pick_trajectory,
    pick_trajectory=plan_pickup.pick_trajectory,
    move_trajectory=plan_trajectories.move_trajectory,
    place_trajectory=plan_trajectories.place_trajectory)  # -> exit_trajectory_points, move_to_pick_trajectory_points, pick_trajectory_points, move_trajectory_points, place_trajectory_points, complete_trajectory
# ---------- merge_5: Python ----------
if exit_trajectory and move_to_pick_trajectory and pick_trajectory and move_trajectory and place_trajectory:
    complete_trajectory = exit_trajectory.points + \
                 move_to_pick_trajectory.points + \
                 pick_trajectory.points + \
                 list(reversed(pick_trajectory.points)) + \
                 move_trajectory.points + \
                 place_trajectory.points

    exit_trajectory_points = exit_trajectory.points
    
    move_to_pick_trajectory_points = move_to_pick_trajectory.points
    
    pick_trajectory_points = pick_trajectory.points
    
    move_trajectory_points = move_trajectory.points
    
    place_trajectory_points = place_trajectory.points
# ---------- end merge_5 ----------

# ----
# Additional Robotic Control
# Toggle freedrive to move robot
boolean_toggle = BooleanToggle(False)
toggle_freedrive = GhPythonScript(ip=panel_2, start_teach_mode=boolean_toggle, stop_teach_mode=Toggle(True))  # -> a
# ---------- toggle_freedrive: Python ----------
import os
import math

from compas.rpc import Proxy
package_path = ghdoc.Path
path = os.path.abspath(os.path.join(package_path,"../../../cdf_unity/src/cdf_unity/robot"))

if start_teach_mode:   
    canvas = ghenv.Component.OnPingDocument()
#    path = os.path.abspath(os.path.dirname(canvas.FilePath))
    rtde = Proxy('fabrication', path=path)                         # stay in teach moded(freedrive) as long as this is True
    a = rtde.start_teach_mode(ip=ip)            # send message to robot
    ghenv.Component.Message = "Freedrive on"    # display message on GH component

if stop_teach_mode:   
    canvas = ghenv.Component.OnPingDocument()
    print (path)
    rtde = Proxy('fabrication', path=path)                          # stop teach mode if stop button pressed
    a = rtde.stop_teach_mode(ip=ip)             # send message to robot   
    ghenv.Component.Message = "Freedrive off"   # display message on GH component
# ---------- end toggle_freedrive ----------

# ----
# Place Config
place_config = Data(trajectory_4)

# ----
# Current_config
robot_6 = Data(get_config.config)

# ----
# Send single target using UR RTDE
# Internalized
# exit_trajectory
# Internalized
# Internalized
# Internalized
# move_to_pick_trajectory
# Internalized
# Internalized
# pick_trajectory
# Internalized
# Internalized
# move_trajectory
# place_trajectory
# Internalized
# Internalized
button_4 = Button()
move_to_target = GhPythonScript(speed=Slider(0.3, range=0..2), accel=Slider(0.1, range=0..3.14), send=button_4, ip=panel_2)  # -> a
# ---------- move_to_target: Python ----------
import os
import math
from compas.rpc import Proxy

package_path = ghdoc.Path

if send:
    if not frame:
        ghenv.Component.Message = "No frame to move to!"
    else:
        canvas = ghenv.Component.OnPingDocument()
        path = os.path.abspath(os.path.join(package_path,"../../../cdf_unity/src/cdf_unity/robot"))
        rtde = Proxy('fabrication', path=path)
        radius = 0.1
        a = rtde.move_to_target(frame, speed, accel, radius, ip=ip)
        ghenv.Component.Message = "Sent frame"
# ---------- end move_to_target ----------

# ----
# Approach Place Config
approach_place_config = Data(trajectory_5)

# ----
# Exit Safe Config
approach_pickup_config_2 = Data(trajectory_3)

# ----
# Complete Trajectory
trajectory_6 = Data(trajectory)

# ----
# Send to a config using UR RTDE
number_slider_4 = Slider(0.1, range=0..3.14)
move_to_config = GhPythonScript(speed=Slider(0.24, range=0..2), accel=number_slider_4, send=Button(), ip=panel_2)  # -> a
# ---------- move_to_config: Python ----------
import os
import math

from compas.rpc import Proxy
package_path = ghdoc.Path

if send:
    if not config:
        ghenv.Component.Message = "No config to move to!"
    else:
        canvas = ghenv.Component.OnPingDocument()
        path = os.path.abspath(os.path.join(package_path,"../../../cdf_unity/src/cdf_unity/robot"))
        rtde = Proxy('fabrication', path=path)
        nowait = True
        a = rtde.move_to_joints(config, speed, accel, nowait, ip=ip)
        ghenv.Component.Message = "Sent config"
# ---------- end move_to_config ----------

# ----
# Pick Config
pickup_config_2 = Data(pickup_config)

# ----
# Approach Pick Config
approach_pickup_config_3 = Data(plan_pickup.approach_pick_config)

# ----
# Complete_Trajectory
trajectory_7 = Data(merge_5.complete_trajectory)

# ----
# Get current config and EE Frame
button_5 = Button()
get_config_2 = GhPythonScript(robot=robot_5, send=button_5, ip=panel_2)  # -> config, frame, a
# ---------- get_config_2: Python ----------
import os
from scriptcontext import sticky as st
#sticky is a persistent dictionary which can save values and also be acessed by other GH components
#we use it here with a custom key to store values we read from the robot
from compas.rpc import Proxy
package_path = ghdoc.Path

config_key = 'config_{}'.format(str(ghenv.Component.InstanceGuid))
new_key = 'new_key_{}'.format(str(ghenv.Component.InstanceGuid))
frame_key = 'frame_{}'.format(str(ghenv.Component.InstanceGuid))

if config_key not in st:
    st[config_key] = None

if send:
    canvas = ghenv.Component.OnPingDocument()
    path = os.path.abspath(os.path.join(package_path,"../../../cdf_unity/src/cdf_unity/robot"))
    print (path)
    rtde = Proxy('fabrication', path=path)
    
    st[config_key] = rtde.get_config(ip=ip)
    st[new_key] = rtde.get_config(ip=ip)
    st[frame_key] = robot.forward_kinematics(st[config_key], group, options=dict(solver='model'))
#    a = rtde.get_config(ip=ip)
config = st[config_key]
frame = st[frame_key]
# ---------- end get_config_2 ----------
draw_4 = Draw(cg=get_config_2.frame)  # -> rg; same code as draw

# ----
# Ping Robot
ping = Button()
py_2 = PythonScript(ip=panel_2, ping=ping)  # -> out, trigger
# ---------- py_2: Python ----------
from scriptcontext import sticky as st
from ur_fabrication_control.direct_control.utilities import is_available

guid = str(ghenv.Component.InstanceGuid)
txt_key = "txt_" + guid
if txt_key not in st:
    st[txt_key] = ""

if ping:
    
    available = is_available(ip)
    
    if available:
        st[txt_key] = "%s is up!" % ip
        trigger = True
    else:
        st[txt_key] = "%s is down!" % ip
        trigger = False

print(st[txt_key])
# ---------- end py_2 ----------
panel_14 = Panel(py_2.out)

panel_15 = Panel(get_config_2.config)

# ----
# exit_trajectory
data_3 = Data(merge_5.exit_trajectory_points)

# ----
# Exit Trajectory
trajectory_8 = Data(data_3)

# ----
# move_to_pick_trajectory
data_4 = Data(merge_5.move_to_pick_trajectory_points)

# ----
# Move to Pick Trajectory
trajectory_9 = Data(data_4)

# ----
# pick_trajectory
data_5 = Data(merge_5.pick_trajectory_points)

# ----
# Pick Trajectory
trajectory_10 = Data(data_5)

# ----
# move_trajectory
data_6 = Data(merge_5.move_trajectory_points)

# ----
# Move Trajectory
trajectory_11 = Data(data_6)

# ----
# place_trajectory
data_7 = Data(merge_5.place_trajectory_points)

# ----
# Place Trajectory
# Sending to UR
trajectory_12 = Data(data_7)

# ----
# All trajectories and configs
trajectories_and_configs = ValueList({"Current config": 0, "Exit Safe config": 1, "Approach pick config": 2, "Pick config": 3, "Approach Place config": 4, "Place Config": 5, "Full Trajectory": 6, "Exit Trajectory": 7, "Move to Pick Trajectory": 8, "Pick Trajectory": 9, "Move Trajectory": 10, "Place Trajectory": 11}, selected="Move Trajectory")
stream_filter = StreamFilter(
    Gate=trajectories_and_configs,
    Stream0=robot_6,
    Stream1=approach_pickup_config_2,
    Stream2=approach_pickup_config_3,
    Stream3=pickup_config_2,
    Stream4=approach_place_config,
    Stream5=place_config,
    Stream6=trajectory_6,
    Stream7=trajectory_8,
    Stream8=trajectory_9,
    Stream9=trajectory_10,
    Stream10=trajectory_11,
    Stream11=trajectory_12)
list_item = ListItem(List=stream_filter, Index=Slider(0, range=0..200), Wrap=True)

# ----
# Send a Pick and Place Routine
number_slider_5 = Slider(0.1, range=0..3.14)
pick_and_place = GhPythonScript(
    exit_trajectory=data_3,
    move_to_pick_trajectory=data_4,
    pick_trajectory=data_5,
    move_trajectory=data_6,
    place_trajectory=data_7,
    exit_safe_config=plan_trajectories.exit_safe_config,
    approach_pick_config=plan_pickup.approach_pick_config,
    pick_config=plan_pickup.pick_config,
    place_config=plan_trajectories.place_config,
    speed=Slider(0.24, range=0..2),
    accel=number_slider_5,
    radius=Slider(0.001, range=0..3.14),
    send=Button(),
    ip=panel_2)  # -> a; inputs exit_trajectory: list, move_to_pick_trajectory: list, pick_trajectory: list, move_trajectory: list, place_trajectory: list
# ---------- pick_and_place: Python ----------
import os
import math
import time
import Grasshopper.Kernel as gh
from compas.rpc import Proxy
from compas.geometry import Translation, Vector, Transformation, Frame

vaccum_io = 0
package_path = ghdoc.Path

if send:
    if not pick_trajectory: #if no frames provided, then display message
        ghenv.Component.Message = "No pick trajectory to move to!"
    
    if not move_trajectory: #if no frames provided, then display message
        ghenv.Component.Message = "No move trajectory to move to!"
    
    if not place_trajectory: #if no frames provided, then display message
        ghenv.Component.Message = "No place trajectory to move to!"
    
    else:
        canvas = ghenv.Component.OnPingDocument()
        path = os.path.abspath(os.path.join(package_path,"../../../cdf_unity/src/cdf_unity/robot"))
        rtde = Proxy('fabrication', path=path)   
        rtde.pick_and_place_sticks_trajectories(exit_trajectory, move_to_pick_trajectory, pick_trajectory, move_trajectory, place_trajectory, speed, accel, radius, ip, vaccum_io) 
#        rtde.pick_and_place_sticks_configs_trajectories(exit_safe_config, move_to_pick_trajectory, approach_pick_config, pick_config, move_trajectory, place_config, speed, accel, radius, ip, vaccum_io)
        ghenv.Component.Message = "Sent frames" #display message on component
# ---------- end pick_and_place ----------

# ----
# Pick & Place Trajectory
merge_6 = Merge(
    Data1=plan_trajectories.exit_trajectory_frames,
    Data2=plan_trajectories.move_to_pick_trajectory_frames,
    Data3=plan_pickup.pick_trajectory_frames,
    Data4=plan_trajectories.move_trajectory_frames,
    Data5=plan_trajectories.place_trajectory_frames)
transform_6 = Transform(Geometry=merge_6, Transform=ghpython_script_4.RCFtoWCF)

# ----
# Sticks Along place
merge_7 = Merge(
    Data1=plan_pickup.pick_trajectory_frames,
    Data2=plan_trajectories.move_trajectory_frames,
    Data3=plan_trajectories.place_trajectory_frames)
transform_7 = Transform(Geometry=merge_7, Transform=ghpython_script_4.RCFtoWCF)
cluster_4 = Cluster(geometry=transform_7, plane=transform_7, amplitude=neg)
orient_2 = Orient(Source=PlaneXY(0, 0, 0), Target=cluster_4)  # -> Geometry, Transform

# ----
# Pick Plane
transform_8 = Transform(Geometry=cluster_3, Transform=ghpython_script_4.RCFtoWCF)

# ----
# Stick Holder Back
transform_9 = Transform(Transform=ghpython_script_4.RCFtoWCF)

# ----
# Stick Holder Side
transform_10 = Transform(Transform=ghpython_script_4.RCFtoWCF)

# ----
# robot space
boolean_toggle_2 = BooleanToggle(True)
robot_visualize = RobotVisualize(
    robot=robot_4,
    configuration=list_item,
    show_collision=boolean_toggle_2,
    show_base_frame=Toggle(True),
    show_end_effector_frame=Toggle(True),
    show_cm=Toggle(True),
    show_acm=Toggle(False))  # -> visual, collision, collision_meshes, attached_meshes, frames, base_frame, ee_frame; inputs show_visual: Boolean, show_collision: Boolean, show_frames: Boolean, show_base_frame: Boolean, show_end_effector_frame: Boolean, show_cm: Boolean, show_acm: Boolean
#   port group: The planning group used for end-effector and base visualization.
#   port configuration: The robot's full configuration.
#   port show_visual: Whether or not to show the robot's visual meshes.
#   port show_collision: Whether or not to show the robot's collision meshes.
#   port show_frames: Whether or not to show the robot's joint frames.
#   port show_base_frame: Whether or not to show the robot's base frame.
#   port show_end_effector_frame: Whether or not to show the robot's end-effector frame.
#   port show_cm: Whether or not to show the collision meshes (if any).
#   port show_acm: Whether or not to show the attached collision meshes (if any).
#   port visual: Rhino meshes of the robot's visual geometry (if any).
#   port collision: Rhino meshes of the robot's collision geometry (if any).
#   port collision_meshes: Rhino meshes of the scene's collision meshes (if any).
#   port attached_meshes: Rhino meshes of the scene's attached collision meshes (if any).
#   port frames: The robot's joint frames as Rhino planes (if any).
#   port base_frame: The robot's base frame as a Rhino plane (if any).
#   port ee_frame: The robot's end-effector frame as a Rhino plane (if any).
# ---------- robot_visualize: Python ----------
"""
Visualizes the robot.

COMPAS FAB v0.27.0
"""
import time

from compas.artists import Artist
from compas.geometry import Frame
from compas.geometry import Transformation
from ghpythonlib.componentbase import executingcomponent as component
from scriptcontext import sticky as st

from compas_fab.ghpython.components import create_id
from compas_fab.robots import PlanningScene


class RobotVisualize(component):
    def RunScript(
        self,
        robot,
        group,
        configuration,
        show_visual,
        show_collision,
        show_frames,
        show_base_frame,
        show_end_effector_frame,
        show_cm,
        show_acm,
    ):

        visual = None
        collision = None
        collision_meshes = None
        attached_meshes = None
        frames = None
        base_frame = None
        ee_frame = None

        if robot:
            show_visual = True if show_visual is None else show_visual
            show_cm = True if show_cm is None else show_cm
            show_acm = True if show_acm is None else show_acm
            configuration = configuration or robot.zero_configuration()

            robot.update(configuration, visual=show_visual, collision=show_collision)
            compas_frames = robot.transformed_frames(configuration, group)

            if show_visual:
                visual = robot.artist.draw_visual()

            if show_collision:
                collision = robot.artist.draw_collision()

            if show_base_frame:
                base_compas_frame = compas_frames[0]
                artist = Artist(base_compas_frame)
                base_frame = artist.draw()

            if show_end_effector_frame:
                ee_compas_frame = robot.forward_kinematics(configuration, group, options=dict(solver="model"))
                artist = Artist(ee_compas_frame)
                ee_frame = artist.draw()

            if show_frames:
                frames = []
                for compas_frame in compas_frames[1:]:
                    artist = Artist(compas_frame)
                    frame = artist.draw()
                    frames.append(frame)

            cached_scene_key = create_id(self, "cached_scene")

            if show_cm or show_acm:
                cached_scene = st.get(cached_scene_key)
                if not cached_scene:
                    cached_scene = {"time": 0}

                # expire cache if the component has not been executed in the last 2 seconds
                # this allows to slide through a list of configurations
                # without triggering refreshes of the scene in the middle of it
                if time.time() - cached_scene["time"] > 2:
                    update_scene = True
                else:
                    update_scene = False

                if update_scene:
                    scene = PlanningScene(robot)
                    scene = robot.client.get_planning_scene()

                if update_scene and show_cm:
                    collision_meshes = []

                    for co in scene.world.collision_objects:
                        header = co.header
                        frame_id = header.frame_id
                        cms = co.to_collision_meshes()

                        for cm in cms:
                            if cm.frame != Frame.worldXY():
                                t = Transformation.from_frame(cm.frame)
                                mesh = cm.mesh.transformed(t)
                            else:
                                mesh = cm.mesh

                            collision_meshes.append(Artist(mesh).draw())

                        cached_scene["cm"] = collision_meshes

                collision_meshes = cached_scene.get("cm", [])

                if update_scene and show_acm:
                    attached_meshes = []

                    for aco in scene.robot_state.attached_collision_objects:
                        for acm in aco.to_attached_collision_meshes():
                            frame_id = aco.object["header"]["frame_id"]
                            frame = robot.forward_kinematics(configuration, options=dict(link=frame_id))
                            t = Transformation.from_frame(frame)

                            # Local CM frame
                            if acm.collision_mesh.frame and acm.collision_mesh.frame != Frame.worldXY():
                                t = t * Transformation.from_frame(acm.collision_mesh.frame)

                            mesh = acm.collision_mesh.mesh.transformed(t)

                            attached_meshes.append(Artist(mesh).draw())

                    cached_scene["acm"] = attached_meshes

                attached_meshes = cached_scene.get("acm", [])

                cached_scene["time"] = time.time()
                st[cached_scene_key] = cached_scene

        return (
            visual,
            collision,
            collision_meshes,
            attached_meshes,
            frames,
            base_frame,
            ee_frame,
        )
# ---------- end robot_visualize ----------
mesh_8 = Mesh(robot_visualize.collision_meshes)
plane_7 = Plane(robot_visualize.ee_frame)

mesh_9 = Mesh(robot_visualize.visual)
plane_8 = Plane(robot_visualize.base_frame)

mesh_10 = Mesh(robot_visualize.collision)

# ----
# Transform Robot from:
# RCF to WCF space
# Attached Meshes
transform_11 = Transform(Geometry=mesh_8, Transform=ghpython_script_4.RCFtoWCF)

# ----
# Robot Visual Mesh
transform_12 = Transform(Geometry=robot_visualize.visual, Transform=ghpython_script_4.RCFtoWCF)

# ----
# Robot Base Plane
transform_13 = Transform(Geometry=plane_8, Transform=ghpython_script_4.RCFtoWCF)

# ----
# EE - Frame
transform_14 = Transform(Geometry=plane_7, Transform=ghpython_script_4.RCFtoWCF)

# ----
# Robot cm
transform_15 = Transform(Geometry=mesh_10, Transform=ghpython_script_4.RCFtoWCF)

# ==== cluster Cluster
plane = ClusterInput()
amplitude = ClusterInput()
deconstruct_plane = DeconstructPlane(Plane=plane)  # -> Origin, XAxis, YAxis, ZAxis
amplitude_2 = Amplitude(Vector=unitize(deconstruct_plane.XAxis), Amplitude=amplitude)
geometry = ClusterInput()
move = Move(Geometry=geometry, Motion=amplitude_2)  # -> Geometry, Transform
geometry_2 = ClusterOutput(move.Geometry)
