# Grasshopper definition test_pubsub.gh (Grasshopper 1.0.7)

background_task = BackgroundTask(start=Button())  # -> last_message
#   port start: Start the background worker.
#   port last_message: The result of the long-running task.
# ---------- background_task: Python ----------
"""
Background Task component.

Executes a long-running task in the background, while keeping Grasshopper reactive.

COMPAS EVE v0.2.1
"""
import time
from compas_eve import Message
from compas_eve import Publisher
from compas_eve import Subscriber
from compas_eve import Topic
from compas_eve.mqtt import MqttTransport
        
from compas_eve.ghpython import BackgroundWorker
from ghpythonlib.componentbase import executingcomponent as component
from compas_ghpython.timer import update_component

def do_work(worker):
    tx = MqttTransport("broker.hivemq.com")

    worker.last_message = None
    worker.message_count = 0
    worker.set_internal_state_to_working()

    def handle_message(msg):
        worker.last_message = msg
        worker.message_count += 1
        worker.display_message("Received message #{} ".format(worker.message_count))
        update_component(ghenv, 10)

    topic = Topic("/test_send", Message)
    
    subcriber = Subscriber(topic, callback=handle_message, transport=tx)
    subcriber.subscribe()
    worker.display_message("Subscribed")


class BackgroundTaskComponent(component):
    def RunScript(self, start):
        self.worker = BackgroundWorker.instance_by_component(ghenv, do_work, force_new=start)

        if not self.worker.is_working() and not self.worker.is_done() and start:
            self.worker.start_work()

        print("Is worker working? {}".format(self.worker.is_working()))
        print("Is worker done? {}".format(self.worker.is_done()))

        if self.worker.is_done():
            print("Completed")

        if hasattr(self.worker, "last_message"):
            return (self.worker.last_message, )
        else:
            return (None, )
# ---------- end background_task ----------
knob = ControlKnob(Decimals=2, Limit=True, Maximum=10, Minimum=0, Range=1, Value=8.67)
panel = Panel(background_task)
data = Data(flatten(Toggle(True)))
what_type_is_your_message = ValueList({"String": 0, "Integer Number": 1, "Floating Point Number": 2, "Boolean Value": 3, "Dictionary": 4, "List": 5}, selected="Floating Point Number")
topic_to_publish = Panel("/test_send")
mqtt_publisher = MQTTPublisher(host="broker.hivemq.com", topic_name=topic_to_publish, msg=data, msg_type=what_type_is_your_message)  # -> topic, is_advertised; inputs msg_type: Int32
# ---------- mqtt_publisher: Python ----------
#Publisher Imports
import ast
import time

import json
from ghpythonlib.componentbase import executingcomponent as component
from scriptcontext import sticky as st

from threading import Event

from compas_eve import Message
from compas_eve import Publisher
from compas_eve import Subscriber
from compas_eve import Topic
from compas_eve import set_default_transport
from compas_eve.mqtt import MqttTransport

from compas_ghpython import create_id

class MQTTTopicPublish(component):
    
    def RunScript(self, host, topic_name, msg, msg_type):
        # Check for required inputs
        if not host:
            raise ValueError('Please specify host')
        if not topic_name:
            raise ValueError('Please specify the name of the topic')
        
        # Create a unique key for storing the topic in sticky
        key = create_id(self, 'mqtt_topic'+ topic_name)
        topic = st.get(key, None)
        
        # Initialize MQTT transport with the specified host
        if host:
            tx = MqttTransport(host)
            # Create the topic if it doesn't exist
            if not topic:
                topic = Topic(topic_name, Message)
                time.sleep(0.2)
                st[key] = topic
                
        self.is_advertised = topic
        
        # If msg is None, check if the topic is advertised
        if msg is None:
            if self.is_advertised:
                self.Message = 'Topic advertised'
                
        else:
        # Handle different message types
            message = self.convert_msg(msg, msg_type)
            
            # Encode the message and publish it
            message_encoded = Message(result=message)
            Publisher(topic, transport=tx).publish(message_encoded)
            self.Message = 'Message published'
            
        return topic, self.is_advertised
        
    def convert_msg(self, msg, msg_type):
        # Convert the message based on its type
        if msg_type == 0 or msg_type == 1 or msg_type == 2 or msg_type == 5:    # string, int, float, list
            return str(msg)
        elif msg_type == 3:  # bool
            return "True" if bool(msg) else "False"
        elif msg_type == 4:  # dict
            return ast.literal_eval(msg)
        else:
            print("other")
            return str(msg)
# ---------- end mqtt_publisher ----------
trigger = Trigger(Interval=50, TimerInterval=50, Target=mqtt_publisher)  # disabled
