# Grasshopper definition UR3-pick-and-place-control_origin_la.ghx (Grasshopper 1.0.7)

pt = Point(<point referenced from the Rhino model>)
# Define assembly containing parts and frames
# 
# Connectivity is automatically detected and determines sequence
pt_2 = Point(<point referenced from the Rhino model>)
# 1) Define target plane
# Define a target frame or a list of target frames
# 
# Make sure you  X/Y coordinates make sense for the robot
pt_3 = Point(<point referenced from the Rhino model>)
pl_3pt = Plane3Pt(PointA=pt_3, PointB=pt, PointC=pt_2)
pln = Plane(pl_3pt)

# ----
# Define one pick-up plane in any way you like,
# for example, reference a point from Rhino and assign a plane to it.
# 
# Make sure the plane is oriented in a way that makes sense
# for the robot to reach it. You can check this by observing the
# results of the IK solution for this pickup-plane.
# Use inverse kinematics of the robot to find
# feasible configurations to reach all planes of the current selected routine.
# 
# Additionally solve for one pick trajectory, as it will remain constant throughout the routine.
# 
# In this case, we code the solution for a more compact visualization.
height_of_brick = Slider(0.02, range=0.001..0.0999)

# ----
# NOT ACTUALLY NEEDED JUST HERE TO MAKE IT EASIER TO DEFINE NEW PLANES
# 2) Define assembly
zsize = Slider(0.02, range=0..0.0999)
xgap = Slider(0.0019, range=0..0.005)
zgap = Slider(0, range=0..0.01)
xsize = Slider(0.08, range=0.001..0.25)
ysize = Slider(0.016, range=0.001..0.15)
current_part_index = Slider(1, range=0..400)
wall_options = GhPythonScript(xsize=xsize, ysize=ysize, zsize=zsize, xgap=xgap, zgap=zgap)  # -> options
# ---------- wall_options: Python ----------
import collections

options = collections.namedtuple('Options', [
    'xsize',
    'ysize',
    'zsize',
    'xgap',
    'zgap',
])

options.xsize = xsize
options.ysize = ysize
options.zsize = zsize
options.xgap = xgap
options.zgap = zgap
# ---------- end wall_options ----------
crv = Curve(<curve referenced from the Rhino model>)
crv_2 = Curve(<curve referenced from the Rhino model>)
merge = Merge(Data1=crv, Data2=crv_2)
loft = Loft(Curves=merge, Options={Adjust=False, Closed=False, LoftEnds=0, LoftSimp=0, LoftType=0, Rebuild=10, Refit=0.01})
wall = GhPythonScript(surface=loft, options=wall_options)  # -> assembly, parts_geo; inputs surface: Surface
# ---------- wall: Python ----------
import math
import os
import sys

import compas
from compas.geometry import Box
from compas.geometry import Frame
from compas.geometry import Vector
from compas.geometry import Polyhedron
from compas.geometry import Transformation
from compas.datastructures import Assembly
from compas.datastructures import Part

from compas.utilities import linspace
from compas_rhino.conversions import surface_to_compas
from compas_rhino.conversions import mesh_to_rhino

canvas = ghenv.Component.OnPingDocument()
folder = os.path.dirname(canvas.FilePath)
if folder not in sys.path:
    sys.path.append(folder)

# Default
if not options:
    xsize = 0.0215
    ysize = 0.01025
    zsize = 0.0065
    xgap = 0.0009
    zgap = 0.0002
else:
    xsize = options.xsize
    ysize = options.ysize
    zsize = options.zsize
    xgap = options.xgap
    zgap = options.zgap

surface = surface_to_compas(surface)

parts_geo = []

wall_vertical_curve = surface.v_isocurve(0)
wall_height = wall_vertical_curve.length()
courses = int(math.ceil((wall_height / (zsize + zgap))))

assembly = Assembly()
half_brick = Box.from_diagonal([(-xsize / 4, -ysize / 2, 0), (xsize / 4, ysize / 2, -zsize)])
full_brick = Box.from_diagonal([(-xsize / 2, -ysize / 2, 0), (xsize / 2, ysize / 2, -zsize)])

for ri, row in enumerate(linspace(0, 1, courses)):
    _, u = wall_vertical_curve.rhino_curve.NormalizedLengthParameter(row)
    
    row_curve = surface.u_isocurve(u)
    row_length = row_curve.length()

    c = (row_length / (xsize + xgap))
    col_count = int(math.ceil(c))
    linspaced_vector = list(linspace(0, 1, col_count))
    half_brick_offset = linspaced_vector[1] / 2
    
    for ci, l in enumerate(linspaced_vector):
        if ri % 2:
            l += half_brick_offset

        if ci == 0 and ri % 2 == 0:
            l += half_brick_offset / 2
        if ci == col_count - 1 and ri % 2 == 0:
            l -= half_brick_offset / 2

        fits, col = row_curve.rhino_curve.NormalizedLengthParameter(l)
        if not fits: break

        point = row_curve.point_at(col)
        xaxis = row_curve.tangent_at(col)
        frame = Frame(point, xaxis, xaxis.cross(Vector.Zaxis()))

        if ri % 2 == 0 and ci in (0, col_count - 1):
            brick = half_brick.copy()
        else:
            brick = full_brick.copy()
            
        brick_shape = Polyhedron(*brick.to_vertices_and_faces(triangulated=True))
        T = Transformation.from_frame(frame)
        brick_shape.transform(T)
        
        part = Part(
            shape=brick_shape,
            frame=frame,
            course=ri,
            n=ci,
            xsize=brick.xsize,
            ysize=brick.ysize,
            zsize=brick.zsize,
        )
        assembly.add_part(part)

# Assembly attributes
assembly.attributes['courses'] = ri

print (part.attributes['shape'])
 
parts_geo_compas = [part.attributes['shape'].to_mesh() for part in assembly.parts()]
parts_geo = [mesh_to_rhino(mesh) for mesh in parts_geo_compas]
#
#if save:
#    compas.json_dump({'assembly': assembly}, os.path.join(folder, 'session.json'), pretty=True)
# ---------- end wall ----------
edges = GhPythonScript(assembly=wall.assembly)  # -> assembly
# ---------- edges: Python ----------
import math
import os

import compas
from compas.geometry import Box
from compas.geometry import Plane
from compas.geometry import Frame
from compas.geometry import Vector
from compas.geometry import Translation
from compas.geometry import Polygon
from compas.geometry import Projection
from compas.datastructures import Mesh
from separation_axis_theorem import separating_axis_theorem

canvas = ghenv.Component.OnPingDocument()
folder = os.path.dirname(canvas.FilePath)

projection = Projection.from_plane(Plane.worldXY())

for part in assembly.parts():
    # Store XY projection
    projected_mesh = Mesh.from_shape(part.attributes['shape'].to_mesh().transformed(projection))
    part.attributes['projection'] = Polygon(projected_mesh.face_coordinates(0))

    # Calculate place frame
    part.attributes['place_frame'] = part.frame.transformed(Translation.from_vector([0, 0, part.attributes['zsize']]))

# Connect assembly graph
last_course_parts = None
for c in range(assembly.attributes['courses'] + 1):
    course_parts = list(assembly.graph.nodes_where_predicate(lambda key, attr: attr['part'].attributes['course'] == c))

    if last_course_parts:
        for key in course_parts:
            part1 = assembly.find_by_key(key)
            polygon1 = part1.attributes['projection']

            for p2_key in last_course_parts:
                part2 = assembly.find_by_key(p2_key)
                polygon2 = part2.attributes['projection']
                are_connected = separating_axis_theorem(polygon1.points, polygon2.points)
                if are_connected:
                    assembly.add_connection(part2, part1)

    last_course_parts = course_parts
#
#if save:
#    compas.json_dump({'assembly': assembly}, os.path.join(folder, 'session.json'), pretty=True)
# ---------- end edges ----------
frames = GhPythonScript(assembly=edges, current_part_index=current_part_index)  # -> current_part, place_frame, place_plane, a; inputs current_part_index: Int32
# ---------- frames: Python ----------
from helpers import traverse
from helpers import draw_parts
from helpers import draw_connections
from helpers import draw_parts_attribute
from helpers import get_assembly_sequence

from compas_rhino.conversions import frame_to_rhino_plane


a = []
a += draw_parts_attribute(assembly, 'place_frame')

top_course = assembly.attributes["courses"]
sequence = get_assembly_sequence(assembly, top_course)

for i in range(current_part_index):
    part = assembly.find_by_key(sequence[i])
    if (current_part_index-1) == i:
        place_frame = part.attributes['place_frame']
        place_plane = frame_to_rhino_plane(place_frame)
        current_part = part
# ---------- end frames ----------
viz = GhPythonScript(assembly=edges)  # -> out, a
# ---------- viz: Python ----------
import compas_ghpython

def draw_connections(assembly):
    lines = []

    for u, v in assembly.connections():
        u = assembly.find_by_key(u)
        v = assembly.find_by_key(v)
        lines.append(
            {
                "start": list(u.frame.point),
                "end": list(v.frame.point),
            }
        )
    return compas_ghpython.draw_lines(lines)

a = []
a += draw_connections(assembly)
# ---------- end viz ----------
target_plane = Data(frames.place_frame)
current_part_index_2 = Data(current_part_index)
assembly = Data(edges)

# ----
# Combine Inverse kinematic solutions to calculate the move and place trajectories
number_slider = Slider(-0.004, range=-0.007..0.01)
number_slider_2 = Slider(19, range=0..20)
addition = Addition(A=height_of_brick, B=0.017)
plane = Plane(frames.a)
vakkum_gripper = Mesh(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)
Z = UnitZ(Factor=number_slider)
list_item = ListItem(List=plane, Index=number_slider_2, Wrap=True)
move = Move(Geometry=list_item, Motion=Z)  # -> Geometry, Transform
rad = Radians(Degrees=Slider(180, range=-180..180))
meshes = GhPythonScript(assembly=edges, index=number_slider_2)  # -> meshes; inputs index: Int32
# ---------- meshes: Python ----------
parts_geo_compas = [part.attributes['shape'].to_mesh() for part in assembly.parts()][:index]
print parts_geo_compas
meshes = [mesh for mesh in parts_geo_compas]
# ---------- end meshes ----------
mesh = Mesh(flatten(wall.parts_geo))
current_plane = Plane(frames.place_plane)

# ----
# Toggle freedrive to move robot
boolean_toggle = BooleanToggle(False)
toggle_freedrive = GhPythonScript(ip="169.254.204.200", start_teach_mode=boolean_toggle, stop_teach_mode=Toggle(True))  # -> a
# ---------- toggle_freedrive: Python ----------
import os
import math

from compas.rpc import Proxy
package_path = ghdoc.Path
path = os.path.abspath(os.path.join(package_path,"../../../docs/Tutorial 7 - ROS/robot"))

if start_teach_mode:   
    canvas = ghenv.Component.OnPingDocument()
#    path = os.path.abspath(os.path.dirname(canvas.FilePath))
    rtde = Proxy('fabrication', path=path)                         # stay in teach moded(freedrive) as long as this is True
    a = rtde.start_teach_mode(ip=ip)            # send message to robot
    ghenv.Component.Message = "Freedrive on"    # display message on GH component

if stop_teach_mode:   
    canvas = ghenv.Component.OnPingDocument()
    print (path)
    rtde = Proxy('fabrication', path=path)                          # stop teach mode if stop button pressed
    a = rtde.stop_teach_mode(ip=ip)             # send message to robot   
    ghenv.Component.Message = "Freedrive off"   # display message on GH component
# ---------- end toggle_freedrive ----------

# ----
# Ping Robot
ping = Button()
py = PythonScript(ip="169.254.204.200", ping=ping)  # -> out, trigger
# ---------- py: Python ----------
from scriptcontext import sticky as st
from ur_fabrication_control.direct_control.utilities import is_available

guid = str(ghenv.Component.InstanceGuid)
txt_key = "txt_" + guid
if txt_key not in st:
    st[txt_key] = ""

if ping:
    
    available = is_available(ip)
    
    if available:
        st[txt_key] = "%s is up!" % ip
        trigger = True
    else:
        st[txt_key] = "%s is down!" % ip
        trigger = False

print(st[txt_key])
# ---------- end py ----------
panel = Panel(py.out)

# ----
# Stop
stop = Button()
stop_2 = PythonScript(ip="169.254.204.200", stop=stop)
# ---------- stop_2: Python ----------
from scriptcontext import sticky as st
from ur_fabrication_control.direct_control.common import send_stop


if stop:
    send_stop(ip, ur_port)
# ---------- end stop_2 ----------

# ----
# Assembly loading/saving
panel_2 = Panel("assembly-data.json")  # disabled
assembly_2 = Data(assembly)  # disabled
formatted = BooleanToggle(False)  # disabled
button = Button()  # disabled
save = GhPythonScript(assembly=assembly_2, filename=panel_2, pretty=formatted, save=button)  # -> out, path; disabled
# ---------- save: Python ----------
import os

dirname = os.path.dirname(ghenv.Component.OnPingDocument().FilePath)
if "\\" in filename or "/" in filename:
    raise Exception("Invalid name, don't enter a full path, only a file name. Eg. assembly.json")

path = os.path.join(dirname, filename)

if assembly and save:
    assembly.to_json(path, pretty=pretty)
# ---------- end save ----------
button_2 = Button()  # disabled
load = GhPythonScript(filename=panel_2, load=button_2)  # -> assembly; disabled
# ---------- load: Python ----------
import os
from scriptcontext import sticky

from compas.datastructures import Assembly

dirname = os.path.dirname(ghenv.Component.OnPingDocument().FilePath)
if "\\" in filename or "/" in filename:
    raise Exception("Invalid name, don't enter a full path, only a file name. Eg. assembly.json")

path = os.path.join(dirname, filename)
key = "assembly_key_{}".format(path)

if load:
    sticky[key] = Assembly.from_json(path)

assembly = sticky.get(key)
# ---------- end load ----------
assembly_3 = Data(load)  # disabled

# ----
# 1) Load robot from ROS
# Load the robot from ROS.
# 
# Make sure ROS/MoveIt is running before you start (ie. "Compose up").
# Define the tool and other static meshes
# 
# A tool is composed by a mesh and a frame. If you define only a visual mesh, it will be used for both visual and collision purposes. If the mesh is heavy, make sure you define a simplifed mesh for collision.
# 
# Static collision meshes such as robot's table are also added here.
connect = BooleanToggle(True)
load_robot = BooleanToggle(True)

ros = COMPASFABROSConnect(connect=connect)  # -> ros_client, is_connected; inputs port: Int32, connect: Boolean
#   port ip: The ip address ROS. Defaults to 127.0.0.1.
#   port port: The port of ROS. Defaults to 9090.
#   port connect: If True, connects to ROS. If False, disconnects from ROS. Defaults to False.
#   port ros_client: The ROS client.
#   port is_connected: True if connection established.
# ---------- ros: Python ----------
"""
Connect or disconnect to ROS.

COMPAS FAB v1.0.2
"""

from ghpythonlib.componentbase import executingcomponent as component
from scriptcontext import sticky as st

from compas_fab.backends import RosClient
from compas_fab.ghpython.components import create_id


class ROSConnect(component):
    def RunScript(self, ip, port, connect):
        ros_client = None

        ip = ip or "127.0.0.1"
        port = port or 9090

        key = create_id(self, "ros_client")
        ros_client = st.get(key, None)

        if ros_client:
            st[key].close()
        if connect:
            st[key] = RosClient(ip, port)
            st[key].run(5)

        ros_client = st.get(key, None)
        is_connected = ros_client.is_connected if ros_client else False
        return (ros_client, is_connected)
# ---------- end ros ----------
robot = COMPASFABROSRobot(ros_client=ros.ros_client, load=load_robot)  # -> robot; inputs load: Boolean
#   port ros_client: The ROS client.
#   port load: If True, loads the robot from ROS. Defaults to False.
# ---------- robot: Python ----------
"""
Load robot directly from ROS.

COMPAS FAB v1.0.2
"""

from compas.scene import SceneObject
from ghpythonlib.componentbase import executingcomponent as component
from scriptcontext import sticky as st

from compas_fab.ghpython.components import create_id


class ROSRobot(component):
    def RunScript(self, ros_client, load):
        key = create_id(self, "robot")

        if ros_client and ros_client.is_connected and load:
            # Load URDF from ROS
            st[key] = ros_client.load_robot(load_geometry=True, precision=12)
            st[key].scene_object = SceneObject(st[key].model)

        robot = st.get(key, None)
        if robot:  # client sometimes need to be restarted, without needing to reload geometry
            robot.client = ros_client
        return robot
# ---------- end robot ----------

robot_2 = Data(robot)

# ----
# Get current config and EE Frame
button_3 = Button()
get_config = GhPythonScript(robot=robot_2, send=button_3, ip="169.254.204.200")  # -> config, frame, a
# ---------- get_config: Python ----------
import os
from scriptcontext import sticky as st
#sticky is a persistent dictionary which can save values and also be acessed by other GH components
#we use it here with a custom key to store values we read from the robot
from compas.rpc import Proxy
package_path = ghdoc.Path

config_key = 'config_{}'.format(str(ghenv.Component.InstanceGuid))
new_key = 'new_key_{}'.format(str(ghenv.Component.InstanceGuid))
frame_key = 'frame_{}'.format(str(ghenv.Component.InstanceGuid))

if config_key not in st:
    st[config_key] = None

if send:
    canvas = ghenv.Component.OnPingDocument()
    path = os.path.abspath(os.path.join(package_path,"../../../docs/Tutorial 7 - ROS/robot"))
    print (path)
    rtde = Proxy('fabrication', path=path)
    
    st[config_key] = rtde.get_config(ip=ip)
    st[new_key] = rtde.get_config(ip=ip)
    st[frame_key] = robot.forward_kinematics(st[config_key], group, options=dict(solver='model'))
#    a = rtde.get_config(ip=ip)
config = st[config_key]
frame = st[frame_key]

print config.joint_values
# ---------- end get_config ----------
draw = Draw(cg=get_config.frame)  # -> rg
#   port cg: The COMPAS geometry or datastructure to be drawn.
#   port rg: The Rhino geometry object.
# ---------- draw: Python ----------
"""
Draws COMPAS geometry in Grasshopper.
"""
from ghpythonlib.componentbase import executingcomponent as component

from compas_rhino.conversions import frame_to_rhino_plane


class CompasToRhinoGeometry(component):
    def RunScript(self, cg):
        if not cg:
            return None

        return frame_to_rhino_plane(cg)
# ---------- end draw ----------

# ----
# Additional Robotic Control
panel_3 = Panel(get_config.config)

# ----
# 3) Attach tool and robot table
robot_3 = Data(robot_2)
point = Point(Point(0.105, 0, 0))
mesh_2 = Mesh(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)
yz = YZPlane(Origin=point)
paralell_gripper = Mesh(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)
table = GhPythonScript(robot=robot_3, mesh=mesh_2)  # inputs mesh: Mesh
# ---------- table: Python ----------
from compas_fab.robots import PlanningScene
from compas_fab.robots import CollisionMesh
from compas_rhino.conversions import mesh_to_compas

if robot:
    scene = PlanningScene(robot)
    mesh = mesh_to_compas(mesh)
    cm = CollisionMesh(mesh, "table")
    scene.add_collision_mesh(cm)
# ---------- end table ----------

tool = COMPASFABAttachedTool(robot=robot_2, visual_mesh=vakkum_gripper, tcf_plane=yz)  # -> robot; inputs visual_mesh: Mesh, collision_mesh: Mesh
#   port visual_mesh: A visual mesh for the tool.
#   port collision_mesh: A collision mesh for the tool.
#   port tcf_plane: The frame of the tool in tool0 frame.
#   port group: The planning group to which the tool should be attached.
#   port connected_to: The link to which the tool should be connected to.
# ---------- tool: Python ----------
"""
Attach a tool to the robot.

COMPAS FAB v1.0.2
"""

from compas.geometry import Frame
from compas_rhino.conversions import mesh_to_compas
from compas_rhino.conversions import plane_to_compas_frame
from ghpythonlib.componentbase import executingcomponent as component

from compas_fab.robots import Tool


class AttachToolComponent(component):
    def RunScript(self, robot, visual_mesh, collision_mesh, tcf_plane, group, connected_to):
        if robot and robot.client and robot.client.is_connected and visual_mesh:
            if not collision_mesh:
                collision_mesh = visual_mesh

            c_visual_mesh = mesh_to_compas(visual_mesh)
            c_collision_mesh = mesh_to_compas(collision_mesh)

            if not tcf_plane:
                frame = Frame.worldXY()
            else:
                frame = plane_to_compas_frame(tcf_plane)
            tool = Tool(c_visual_mesh, frame, c_collision_mesh, connected_to=connected_to)

            robot.attach_tool(tool, group)

        return robot
# ---------- end tool ----------

robot_4 = Data(tool)

# ----
# 4) Define pick-up plane
right_pick_up = Point(Point(0.1374078207, 0.3215194768, 0.05724740677))
left_pick_up = Point(Point(-0.2675593273, -0.2707114514, 0.02))
pdecon = Deconstruct(Point=left_pick_up)  # -> XComponent, YComponent, ZComponent
pt_4 = ConstructPoint(XCoordinate=pdecon.XComponent, YCoordinate=pdecon.YComponent, ZCoordinate=addition)
xy = XYPlane(Origin=pt_4)
pflip = FlipPlane(Plane=xy, ReverseX=False, ReverseY=False, SwapAxes=True)

xy_2 = XYPlane(Origin=pflip)
rotate = Rotate(Geometry=pflip, Angle=rad, Plane=xy_2)  # -> Geometry, Transform

pickup_plane = Data(rotate.Geometry)

python = GhPythonScript(plane=pickup_plane)  # -> out, frame
# ---------- python: Python ----------
from compas_rhino.conversions import plane_to_compas_frame

frame = plane_to_compas_frame(plane)
# ---------- end python ----------

# ----
# Send single target using UR RTDE
number_slider_3 = Slider(0.06, range=0..2)
move_to_target = GhPythonScript(frame=python.frame, speed=number_slider_3, accel=Slider(0.1, range=0..3.14), send=Button(), ip="169.254.204.200")  # -> a
# ---------- move_to_target: Python ----------
import os
import math
from compas.rpc import Proxy

package_path = ghdoc.Path

if send:
    if not frame:
        ghenv.Component.Message = "No frame to move to!"
    else:
        canvas = ghenv.Component.OnPingDocument()
        path = os.path.abspath(os.path.join(package_path,"../../../docs/Tutorial 7 - ROS/robot"))
        rtde = Proxy('fabrication', path=path)
        radius = 0.01
        a = rtde.move_to_target(frame, speed, accel, radius, ip=ip)
        ghenv.Component.Message = "Sent frame"
# ---------- end move_to_target ----------

# ----
# 5) Solve all IK
# Results in 4 configurations
robot_5 = Data(robot_4)
pickup_plane_2 = Data(pickup_plane)
plan_pickup = GhPythonScript(
    robot=robot_5,
    pick_plane=pickup_plane_2,
    approach_distance=Slider(0.1, range=0..1),
    flip_offset_plane=Toggle(True),
    update=Button())  # -> pick_config, approach_pick_config, pick_trajectory, pick_trajectory_planes; inputs flip_offset_plane: Boolean
# ---------- plan_pickup: Python ----------
"""
Calculate pickup of a part.
"""
from ghpythonlib.componentbase import executingcomponent as component
from scriptcontext import sticky as st

from compas.geometry import Frame
from compas.geometry import Transformation
from compas_rhino.conversions import plane_to_compas_frame, frame_to_rhino_plane
from compas_fab.ghpython.components import create_id
from compas_fab.robots import PlanningScene
from compas.geometry import scale_vector, add_vectors
from compas_fab.robots.robot import Configuration
import math

def normalize_joint_values_to_pi(config):
    for i,v in enumerate(config.joint_values):
        if v>math.pi:
            v-=2*math.pi
        if v<-math.pi:
            v+=2*math.pi
        config.joint_values[i]=v
    return config
    

class PickPart(component):
    def RunScript(self, robot, group, start_configuration, pick_plane, approach_distance, flip_offset_plane, update):
        self.Message = ""

        pick_config = None
        approach_pick_config = None
        pick_trajectory = None
        pick_trajectory_frames = []

        if pick_plane:
            pick_frame = plane_to_compas_frame(pick_plane)

        if approach_distance > 0:
            approach_pick_frame = self._offset_approach_frame(pick_frame, approach_distance, flip_offset_plane)

        
        if (update or not pick_config or not approach_pick_config) and robot and robot.client and robot.client.is_connected:
            scene = PlanningScene(robot)
            scene.remove_collision_mesh("parts")
            
            try:
                pick_config = robot.inverse_kinematics(pick_frame, start_configuration, group)
            except:
                raise Exception("Could not solve IK solution for pick config")
            try:
                approach_pick_config = robot.inverse_kinematics(approach_pick_frame, pick_config, group)
            except:
                raise Exception("Could not solve IK solution for approach pick config")

        approach_pick_config = Configuration((1.091, -1.882, -1.559, -1.271, 1.571, 1.091), (0, 0, 0, 0, 0, 0), ('shoulder_pan_joint', 'shoulder_lift_joint', 'elbow_joint', 'wrist_1_joint', 'wrist_2_joint', 'wrist_3_joint'))
        
        # Compute PICK trajectory
        if approach_pick_config and pick_config:
            max_step = 0.01
            frames = [
                       robot.forward_kinematics(c, group, options=dict(solver='model'))
                       for c in (approach_pick_config, pick_config)
                     ]

            trajectory = robot.plan_cartesian_motion(frames,
                                                     start_configuration=approach_pick_config,
                                                     group=group,
                                                     options=dict(
                                                         max_step=max_step,
                                                     ))
            if trajectory.fraction < 0.11:
                raise Exception("Incomplete cartesian trajectory found. Only {:.1f}% of the trajectory could be planned".format(trajectory.fraction * 100))

            # Only assign if fraction is full
            pick_trajectory = trajectory

            #if place trajectory calculate frames
            if pick_trajectory:
                for c in pick_trajectory.points:
                    frame = robot.forward_kinematics(c, group, options=dict(solver='model'))
                    pick_trajectory_frames.append(frame_to_rhino_plane(frame))

        self.Message = "Found pick up configurations\nusing {:.2f}m approach distance".format(approach_distance)
        
        pick_config = normalize_joint_values_to_pi(pick_config)
        approach_pick_config = normalize_joint_values_to_pi(approach_pick_config)
        
        return pick_config, approach_pick_config, pick_trajectory, pick_trajectory_frames
    
    def _offset_approach_frame(self, frame, approach_distance, flip_offset_plane):
        
        frame = frame.copy()
        offset_frame = frame.copy()
            
        if approach_distance > 0:
            frame_normal = offset_frame.normal
            frame_normal_scaled = scale_vector(-frame_normal, approach_distance)
            if(flip_offset_plane):
                frame_normal_scaled = scale_vector(-frame_normal, approach_distance)
            new_frame_origin = add_vectors(offset_frame.point, frame_normal_scaled)
            offset_frame = Frame(new_frame_origin, offset_frame.xaxis, offset_frame.yaxis)
        
        return offset_frame
# ---------- end plan_pickup ----------

config = GhPythonScript(c=plan_pickup.pick_config)  # -> pick_config
# ---------- config: Python ----------
from compas_fab.robots.robot import Configuration
import math

print c
pick_config = Configuration((1.091, -2.078, -1.786, -0.848, 1.571, 1.091), (0, 0, 0, 0, 0, 0), ('shoulder_pan_joint', 'shoulder_lift_joint', 'elbow_joint', 'wrist_1_joint', 'wrist_2_joint', 'wrist_3_joint'))
# ---------- end config ----------
config_2 = GhPythonScript(t=plan_pickup.pick_trajectory)  # -> pick_trajectory
# ---------- config_2: Python ----------
from compas_fab.robots.robot import Configuration
from compas_fab.robots import JointTrajectoryPoint
from compas_fab.robots import Duration
from compas_fab.robots import JointTrajectory

if t:
    t_points = []
    for p in t.points:
        t_points.append(p)
    print t_points

pick_trajectory = [JointTrajectoryPoint((0.840, 4.877, 1.669, 4.450, 4.712, -0.731), (0, 0, 0, 0, 0, 0), (0.000, 0.000, 0.000, 0.000, 0.000, 0.000), (0.000, 0.000, 0.000, 0.000, 0.000, 0.000), (0.000, 0.000, 0.000, 0.000, 0.000, 0.000), Duration(0, 0)), JointTrajectoryPoint((0.840, 4.877, 1.669, 4.450, 4.712, -0.731), (0, 0, 0, 0, 0, 0), (0.000, 0.000, 0.000, 0.000, 0.000, 0.000), (0.000, 0.000, 0.000, 0.000, 0.000, 0.000), (0.000, 0.000, 0.000, 0.000, 0.000, 0.000), Duration(0, 0)), JointTrajectoryPoint((0.840, 4.887, 1.701, 4.407, 4.712, -0.731), (0, 0, 0, 0, 0, 0), (-0.000, 0.258, 0.713, -0.971, 0.000, -0.000), (0.000, 0.045, -2.901, 2.855, 0.000, 0.000), (0.000, 0.000, 0.000, 0.000, 0.000, 0.000), Duration(0, 40938477)), JointTrajectoryPoint((0.840, 4.899, 1.731, 4.365, 4.712, -0.731), (0, 0, 0, 0, 0, 0), (-0.000, 0.295, 0.674, -0.969, -0.000, -0.000), (0.000, 1.634, 1.119, -2.753, -0.000, -0.000), (0.000, 0.000, 0.000, 0.000, 0.000, 0.000), Duration(0, 87611004)), JointTrajectoryPoint((0.840, 4.913, 1.760, 4.323, 4.712, -0.731), (0, 0, 0, 0, 0, 0), (-0.000, 0.369, 0.714, -1.083, -0.000, -0.000), (-0.000, 1.923, 0.813, -2.735, 0.000, 0.000), (0.000, 0.000, 0.000, 0.000, 0.000, 0.000), Duration(0, 128891175)), JointTrajectoryPoint((0.840, 4.928, 1.788, 4.280, 4.712, -0.731), (0, 0, 0, 0, 0, 0), (-0.000, 0.427, 0.710, -1.137, 0.000, -0.000), (0.000, 1.091, -1.091, -0.000, -0.000, 0.000), (0.000, 0.000, 0.000, 0.000, 0.000, 0.000), Duration(0, 166351999)), JointTrajectoryPoint((0.840, 4.945, 1.813, 4.237, 4.712, -0.731), (0, 0, 0, 0, 0, 0), (-0.000, 0.440, 0.633, -1.073, -0.000, -0.000), (0.000, -0.357, -2.851, 3.207, -0.000, -0.000), (0.000, 0.000, 0.000, 0.000, 0.000, 0.000), Duration(0, 203900597)), JointTrajectoryPoint((0.840, 4.963, 1.838, 4.194, 4.712, -0.731), (0, 0, 0, 0, 0, 0), (-0.000, 0.468, 0.577, -1.046, -0.000, -0.000), (-0.000, 1.726, 0.090, -1.816, 0.000, 0.000), (0.000, 0.000, 0.000, 0.000, 0.000, 0.000), Duration(0, 246309985)), JointTrajectoryPoint((0.840, 4.983, 1.861, 4.152, 4.712, -0.731), (0, 0, 0, 0, 0, 0), (-0.000, 0.492, 0.529, -1.022, 0.000, -0.000), (0.000, -0.545, -2.379, 2.924, -0.000, 0.000), (0.000, 0.000, 0.000, 0.000, 0.000, 0.000), Duration(0, 285865905)), JointTrajectoryPoint((0.840, 5.005, 1.882, 4.109, 4.712, -0.731), (0, 0, 0, 0, 0, 0), (-0.000, 0.460, 0.429, -0.889, -0.000, -0.000), (0.000, -0.856, -2.056, 2.912, -0.000, -0.000), (0.000, 0.000, 0.000, 0.000, 0.000, 0.000), Duration(0, 330532869)), JointTrajectoryPoint((0.840, 5.028, 1.902, 4.066, 4.712, -0.731), (0, 0, 0, 0, 0, 0), (-0.000, 0.399, 0.324, -0.723, -0.000, -0.000), (-0.000, -1.335, -1.845, 3.181, 0.000, 0.000), (0.000, 0.000, 0.000, 0.000, 0.000, 0.000), Duration(0, 382905789)), JointTrajectoryPoint((0.840, 5.052, 1.920, 4.023, 4.712, -0.731), (0, 0, 0, 0, 0, 0), (-0.000, 0.258, 0.184, -0.442, 0.000, -0.000), (0.000, -1.726, -1.427, 3.153, -0.000, 0.000), (0.000, 0.000, 0.000, 0.000, 0.000, 0.000), Duration(0, 451235270)), JointTrajectoryPoint((0.840, 5.078, 1.937, 3.980, 4.712, -0.731), (0, 0, 0, 0, 0, 0), (0.000, 0.000, 0.000, 0.000, 0.000, 0.000), (0.000, -1.882, -1.211, 3.093, -0.000, 0.000), (0.000, 0.000, 0.000, 0.000, 0.000, 0.000), Duration(0, 617437164))]
# ---------- end config_2 ----------
config_3 = GhPythonScript(c=plan_pickup.approach_pick_config)  # -> approach_pick_config
# ---------- config_3: Python ----------
from compas_fab.robots.robot import Configuration

print c
approach_pick_config = Configuration((1.091, -1.882, -1.559, -1.271, 1.571, 1.091), (0, 0, 0, 0, 0, 0), ('shoulder_pan_joint', 'shoulder_lift_joint', 'elbow_joint', 'wrist_1_joint', 'wrist_2_joint', 'wrist_3_joint'))
# ---------- end config_3 ----------
pick_trajectory = Data(plan_pickup.pick_trajectory)

approach_pickup_config = Data(config_3)
plan_place = GhPythonScript(
    robot=robot_5,
    approach_pick_config=approach_pickup_config,
    place_plane=move.Geometry,
    approach_distance=Slider(0.1, range=0..1),
    flip_offset_plane=Toggle(False),
    update=Button())  # -> place_config, approach_place_config, place_plane; inputs flip_offset_plane: Boolean
# ---------- plan_place: Python ----------
"""
Calculate placement of a part.
"""
from ghpythonlib.componentbase import executingcomponent as component
from scriptcontext import sticky as st

from compas.geometry import Frame
from compas.geometry import Transformation, Rotation, Translation
from compas_rhino.conversions import plane_to_compas_frame, frame_to_rhino_plane
from compas_fab.ghpython.components import create_id
from compas_fab.robots import PlanningScene
from compas.geometry import scale_vector, add_vectors
import math

def normalize_joint_values_to_pi(config):
    for i,v in enumerate(config.joint_values):
        if v>math.pi:
            v-=2*math.pi
        if v<-math.pi:
            v+=2*math.pi
        config.joint_values[i]=v
    return config

class PlacePart(component):
    def RunScript(self, robot, group, approach_pick_config, place_plane, approach_distance, flip_offset_plane, update):
        self.Message = ""
        if not place_plane:
            raise Exception("No place plane defined")

        place_config = None
        approach_place_config = None
        
        if (update or not place_config or not approach_place_config) and robot and robot.client and robot.client.is_connected:
            scene = PlanningScene(robot)
            scene.remove_collision_mesh("parts")

            place_frame = plane_to_compas_frame(place_plane)
            
            if flip_offset_plane:
                R = Rotation.from_axis_and_angle(place_frame.zaxis, math.radians(180), place_frame.point)
            else:
                R = Rotation.from_axis_and_angle(place_frame.zaxis, math.radians(0), place_frame.point)
            
            place_frame_transformed = place_frame.transformed(R)
            place_plane = frame_to_rhino_plane(place_frame_transformed)
            
            approach_place_frame = place_frame_transformed.copy()
            
            if approach_distance > 0:
                approach_place_frame = self._offset_approach_frame(place_frame_transformed, approach_distance, flip_offset_plane)

            try:
                place_config = robot.inverse_kinematics(place_frame_transformed, approach_pick_config, group)
            except:
                raise Exception("Could solve IK solution for place config")
            try:
                approach_place_config = robot.inverse_kinematics(approach_place_frame, place_config, group)
            except:
                raise Exception("Could not solve IK solution for approach place config")

        self.Message = "Found place configurations\nusing {:.2f}m approach distance".format(approach_distance)
        
        place_config = normalize_joint_values_to_pi(place_config)
        approach_place_config = normalize_joint_values_to_pi(approach_place_config)
        
        return place_config, approach_place_config, place_plane
    
    def _offset_approach_frame(self, frame, approach_distance, flip_offset_plane):
        
        frame = frame.copy()
            
        if approach_distance > 0:
            T = Translation.from_vector(frame.zaxis*-approach_distance)
        else:
            T = Translation()
            
       
        offset_frame = frame.transformed(T)
        
        return offset_frame
# ---------- end plan_place ----------
approach_place_config = Data(plan_place.approach_place_config)
place_config = Data(plan_place.place_config)
pickup_config = Data(config)

# ----
# 6) Plan trajectories
toggle = BooleanToggle(True)
robot_6 = Data(robot_4)
plan_free_motion = GhPythonScript(
    robot=robot_6,
    approach_pick_config=approach_pickup_config,
    approach_place_config=plan_place.approach_place_config,
    place_config=plan_place.place_config,
    meshes=meshes,
    compute=toggle)  # -> place_trajectory, place_trajectory_planes, move_trajectory, move_trajectory_planes; inputs meshes: list, compute: Boolean
# ---------- plan_free_motion: Python ----------
"""
Calculate pickup trajectory of a part.
"""
import math
from ghpythonlib.componentbase import executingcomponent as component
from scriptcontext import sticky as st

from compas.geometry import Frame
from compas.geometry import Transformation
from compas_rhino.conversions import plane_to_compas_frame, frame_to_rhino_plane
from compas_fab.ghpython.components import create_id
from compas_fab.robots import AttachedCollisionMesh
from compas_fab.robots import CollisionMesh
from compas_fab.robots import PlanningScene

from helpers import get_assembly_sequence

class PlanPartPickupTrajectory(component):
    def RunScript(self, robot, group, approach_pick_config, approach_place_config, place_config, meshes, planner_id, compute):
        self.Message = ""

        
        place_trajectory = None
        move_trajectory = None

        pick_trajectory_frames = []
        place_trajectory_frames = []
        move_trajectory_frames = []

        # Clean scene
        if compute and robot and robot.client and robot.client.is_connected:
            scene = PlanningScene(robot)
            scene.remove_collision_mesh("parts")

            for i, mesh in enumerate(meshes):
                cm = CollisionMesh(mesh, "parts")
                scene.append_collision_mesh(cm, "parts")

        if not approach_place_config or not place_config or not approach_pick_config:
            self.Message = "No approach & place configs defined"
            return place_trajectory, place_trajectory_frames, move_trajectory, move_trajectory_frames

        # Compute PLACE trajectory
        if compute and robot and robot.client and robot.client.is_connected:
            max_step = 0.01
            frames = [
                       robot.forward_kinematics(c, group, options=dict(solver='model'))
                       for c in (approach_place_config, place_config)
                     ]

            # TODO: Add brick
            # attached_collision_meshes = []
            trajectory = robot.plan_cartesian_motion(frames,
                                                     start_configuration=approach_place_config,
                                                     group=group,
                                                     options=dict(
                                                         max_step=max_step,
    #                                                         attached_collision_meshes=attached_collision_meshes
                                                     ))
            if trajectory.fraction < 0.01:
                raise Exception("Incomplete cartesian trajectory found. Only {:.1f}% of the trajectory could be planned".format(trajectory.fraction * 100))

            # Only assign if fraction is full
            place_trajectory = trajectory

        if place_trajectory:
            for c in place_trajectory.points:
                frame = robot.forward_kinematics(c, group, options=dict(solver='model'))
                place_trajectory_frames.append(frame_to_rhino_plane(frame))

        # Compute MOVE trajectory
        if compute and robot and robot.client and robot.client.is_connected:
            planner_id = planner_id or 'TRRT'

            # TODO: Add brick
            # attached_collision_meshes = []

            tolerance_above = self._generate_default_tolerances(robot.get_configurable_joints(group))
            tolerance_below = self._generate_default_tolerances(robot.get_configurable_joints(group))
            goal_constraints = robot.constraints_from_configuration(
                configuration=approach_place_config,
                tolerances_above=tolerance_above,
                tolerances_below=tolerance_below,
                group=group
            )

            trajectory = robot.plan_motion(goal_constraints,
                                               start_configuration=approach_pick_config,
                                               group=group,
                                               options=dict(
                                               planner_id=planner_id,
    #                                               attached_collision_meshes=attached_collision_meshes
                                               ))

            move_trajectory = trajectory
            print move_trajectory

        if move_trajectory:
            for c in move_trajectory.points:
                print c
                frame = robot.forward_kinematics(c, group, options=dict(solver='model'))
                move_trajectory_frames.append(frame_to_rhino_plane(frame))

        if place_trajectory and move_trajectory:
            self.Message = "Found move and place trajectories ({} points)".format(len(place_trajectory.points) + len(move_trajectory.points))
            return place_trajectory, place_trajectory_frames, move_trajectory, move_trajectory_frames


    def _generate_default_tolerances(self, joints):
        DEFAULT_TOLERANCE_METERS = .001
        DEFAULT_TOLERANCE_RADIANS = math.radians(1)

        return [
            DEFAULT_TOLERANCE_METERS if j.is_scalable()
            else DEFAULT_TOLERANCE_RADIANS
            for j in joints
        ]
# ---------- end plan_free_motion ----------
move_trajectory = Data(plan_free_motion.move_trajectory)
place_trajectory = Data(plan_free_motion.place_trajectory)
merge_2 = GhPythonScript(pick_trajectory=pick_trajectory, place_trajectory=place_trajectory, move_trajectory=move_trajectory)  # -> full_trajectory; inputs pick_trajectory: list
# ---------- merge_2: Python ----------
if pick_trajectory and place_trajectory and not move_trajectory:
    #pick_trajectory = pick_trajectory.points
    for item in pick_trajectory:
        print (item)
    place_trajectory = place_trajectory.points

if pick_trajectory and move_trajectory and place_trajectory:
    full_trajectory = pick_trajectory + \
                 list(reversed(pick_trajectory)) + \
                 move_trajectory.points + \
                 place_trajectory.points + \
                 list(reversed(place_trajectory.points)) + \
                 list(reversed(move_trajectory.points))
    place_trajectory = place_trajectory.points
# ---------- end merge_2 ----------
full_trajectory = Data(merge_2)

pln_2 = Plane(plan_free_motion.move_trajectory_planes)
pln_3 = Plane(plan_free_motion.place_trajectory_planes)
pln_4 = Plane(plan_place.place_plane)

# ----
# Robot control
robot_7 = Data(robot_4)  # disabled
speed = Slider(300, range=50..1000)  # disabled
pick_trajectory_2 = Data()  # disabled
move_trajectory_2 = Data(move_trajectory)  # disabled
approach_pickup_config_2 = Data(approach_pickup_config)  # disabled
pickup_config_2 = Data(pickup_config)  # disabled
approach_place_config_2 = Data(approach_place_config)  # disabled
place_config_2 = Data(place_config)  # disabled
trajectory = Data(full_trajectory)  # disabled
place_trajectory_2 = Data(place_trajectory)  # disabled
panel_4 = Panel("io_signal_name")  # disabled
assembly_4 = Data(assembly)  # disabled
current_part_index_3 = Data(current_part_index_2)  # disabled
ros_2 = GhPythonScript(robot=robot_7)  # -> ros; disabled
# ---------- ros_2: Python ----------
if robot and robot.client:
    ros = robot.client
# ---------- end ros_2 ----------
part = GhPythonScript(assembly=assembly_4, current_part_index=current_part_index_3)  # -> part, geo; disabled
# ---------- part: Python ----------
from helpers import traverse
from helpers import draw_parts
from helpers import draw_connections
from helpers import draw_parts_attribute
from helpers import get_assembly_sequence
from compas.artists import Artist


top_course = assembly.attributes["courses"]
sequence = get_assembly_sequence(assembly, top_course)

if current_part_index:
    current_part_index = int(current_part_index)
    part = assembly.find_by_key(sequence[current_part_index])
    geo = Artist(part.geometry).draw()
# ---------- end part ----------
abb = GhPythonScript(ros_client=ros_2)  # -> abb; disabled
# ---------- abb: Python ----------
import compas_rrc as rrc

if ros_client and ros_client.is_connected:
    abb = rrc.AbbClient(ros_client)
# ---------- end abb ----------
go = Button()  # disabled
go_2 = Button()  # disabled
go_3 = Button()  # disabled
go_4 = Button()  # disabled
current = GhPythonScript(robot=robot_7, abb=abb, go=go)  # -> config, frame; disabled
# ---------- current: Python ----------
import Grasshopper
import System
import Rhino
import scriptcontext as sc

from ghpythonlib.componentbase import executingcomponent as component

from compas_fab.robots import to_radians
from compas_fab.ghpython.components import create_id

import compas_rrc as rrc

class MyComponent(component):
    
    def RunScript(self, robot, abb, go):
        key = create_id(self, 'last_config')
        frame = None

        if robot and abb and abb.ros.is_connected and go:
            joints, _ = abb.send_and_wait(rrc.GetJoints(), timeout=5)
            config = robot.zero_configuration()
            config.joint_values = to_radians(joints)
            
            sc.sticky[key] = config
            print(config)
        config = sc.sticky.get(key)

        if robot and config:
            frame = robot.forward_kinematics(config, options=dict(solver='model'))

        return (config, frame)
# ---------- end current ----------
send_trajectory = GhPythonScript(robot=robot_7, abb=abb, speed=speed, trajectory=trajectory, go=go_2)  # inputs trajectory: list; disabled
# ---------- send_trajectory: Python ----------
import compas_rrc as rrc
from compas_fab.robots import to_degrees

if robot and abb and abb.ros.is_connected and go:
    abb.send(rrc.PrintText("Sending {} points. Press play to move".format(len(trajectory))))
    abb.send(rrc.Stop())

    for i in range(len(trajectory)):
        c = trajectory[i]
        joints = to_degrees(c.joint_values)
        speed = speed or 500
        if i < len(trajectory) - 1:
            zone = rrc.Zone.Z10
        else:
            zone = rrc.Zone.FINE
            
        abb.send(rrc.MoveToJoints(joints, ext_axes=[], speed=speed, zone=zone))
# ---------- end send_trajectory ----------
send_pick_n_place = GhPythonScript(
    robot=robot_7,
    abb=abb,
    speed=speed,
    pick_trajectory=pick_trajectory_2,
    place_trajectory=place_trajectory_2,
    move_trajectory=move_trajectory_2,
    io_signal=panel_4,
    go=go_3)  # disabled
# ---------- send_pick_n_place: Python ----------
import compas_rrc as rrc
from compas_fab.robots import to_degrees

def send_trajectory(abb, robot, speed, points, last_point_fine=True):
    for i in range(len(points)):
        c = points[i]
        joints = to_degrees(c.joint_values)
        if i < len(points) - 1:
            zone = rrc.Zone.Z10
        else:
            zone = rrc.Zone.FINE if last_point_fine else rrc.Zone.Z10

        abb.send(rrc.MoveToJoints(joints, ext_axes=[], speed=speed, zone=zone))
    
if robot and abb and abb.ros.is_connected and go:
    total_points = len(pick_trajectory.points) * 2 + len(move_trajectory.points) * 2 + len(place_trajectory.points) * 2

    abb.send(rrc.PrintText("Sending {} PnP points. Press play to move".format(total_points)))
    abb.send(rrc.Stop())

    speed = speed or 500
    send_trajectory(abb, robot, speed, pick_trajectory.points)
    abb.send(rrc.SetDigital(io_signal, 1))
    abb.send(rrc.WaitTime(1))
    send_trajectory(abb, robot, speed, list(reversed(pick_trajectory.points)), last_point_fine=False)
    send_trajectory(abb, robot, speed, move_trajectory.points, last_point_fine=False)
    send_trajectory(abb, robot, speed, place_trajectory.points)
    abb.send(rrc.SetDigital(io_signal, 0))
    abb.send(rrc.WaitTime(1))
    send_trajectory(abb, robot, speed, list(reversed(place_trajectory.points)), last_point_fine=False)
    send_trajectory(abb, robot, speed, list(reversed(move_trajectory.points)))
# ---------- end send_pick_n_place ----------
plan_and_move = GhPythonScript(
    robot=robot_7,
    abb=abb,
    speed=speed,
    assembly=assembly_4,
    part=part.part,
    target_config=approach_pickup_config_2,
    go=go_4)  # disabled
# ---------- plan_and_move: Python ----------
import compas_rrc as rrc
from compas_fab.robots import CollisionMesh
from compas_fab.robots import PlanningScene
from compas_fab.robots import to_degrees
from compas_fab.robots import to_radians

from helpers import get_assembly_sequence

if robot and abb and abb.ros.is_connected and go:
    joints, _ = abb.send_and_wait(rrc.GetJoints(), timeout=5)
    current_config = robot.zero_configuration()
    current_config.joint_values = to_radians(joints)
    print current_config

    top_course = assembly.attributes["courses"]
    sequence = get_assembly_sequence(assembly, top_course)

    scene = PlanningScene(robot)
    scene.remove_collision_mesh("parts")

    for key in sequence:
        if key == part.key: break
        part_mesh = assembly.find_by_key(key).to_mesh()
        part_cm = CollisionMesh(part_mesh, "parts")
        scene.append_collision_mesh(part_cm)


    goal_constraints = robot.constraints_from_configuration(
        configuration=target_config,
        tolerances_above=[0.1] * 6,
        tolerances_below=[0.1] * 6,
    )
    trajectory = robot.plan_motion(goal_constraints,
                                   start_configuration=current_config)
    
    abb.send(rrc.PrintText("Sending {} points. Press play to move".format(len(trajectory.points))))
    abb.send(rrc.Stop())

    for i in range(len(trajectory.points)):
        c = trajectory.points[i]
        joints = to_degrees(c.joint_values)
        speed = speed or 500
        if i < len(trajectory.points) - 1:
            zone = rrc.Zone.Z10
        else:
            zone = rrc.Zone.FINE
            
        abb.send(rrc.MoveToJoints(joints, ext_axes=[], speed=speed, zone=zone))
# ---------- end plan_and_move ----------
draw_2 = Draw(cg=current.frame)  # -> rg; disabled
#   port cg: The COMPAS geometry or datastructure to be drawn.
#   port rg: The Rhino geometry object.
# ---------- draw_2: Python ----------
"""
Draws COMPAS geometry in Grasshopper.
"""
from ghpythonlib.componentbase import executingcomponent as component

from compas.artists import Artist


class CompasToRhinoGeometry(component):
    def RunScript(self, cg):
        if not cg:
            return None

        return Artist(cg).draw()
# ---------- end draw_2 ----------
current_config = Data(current.config)  # disabled
current_frame = Data(current.frame)  # disabled

# ----
# Visualization
list = ValueList({"1. Approach pickup config": 0, "2. Pickup config": 1, "3. Approach place config": 2, "4. Place config": 3, "5. Trajectory": 4, "6. Place Trajectory": 5, "7. Pick Trajectory": 6, "8. Current config": 7}, selected="4. Place config")
pickup_config_3 = Data(pickup_config)
approach_place_config_3 = Data(approach_place_config)
place_config_3 = Data(place_config)
current_config_2 = Data(get_config.config)

# ----
# Sending to UR
# Pick and Place Routine
# Trajectory Compiling
merge_3 = GhPythonScript(
    approach_pick_config=approach_pickup_config,
    pick_trajectory=pick_trajectory,
    approach_place_config=approach_place_config_3,
    place_trajectory=place_trajectory,
    move_trajectory=move_trajectory)  # -> home_config, approach_pick_config, pick_configs, move_configs, place_configs, complete_trajectory
# ---------- merge_3: Python ----------
from compas_fab.robots.robot import Configuration
from compas_fab.robots import JointTrajectoryPoint

move_configs = []
pick_configs = [] 
place_configs = [] 

move_trajectory_points = move_trajectory.points

def trajectory_points_to_configs(trajectory_points):
    configs = [] 
    for trajectory_point in trajectory_points:
        config = Configuration.from_revolute_values(trajectory_point.values())
        configs.append(config)
    return configs

if approach_pick_config and move_trajectory and pick_trajectory and place_trajectory:
    
    home_config = approach_pick_config
    
    move_configs = trajectory_points_to_configs(move_trajectory_points)
    pick_configs = trajectory_points_to_configs(pick_trajectory.points) ###
    place_configs = trajectory_points_to_configs(place_trajectory.points)
    
    
    complete_trajectory = [approach_pick_config] + \
                 pick_configs + \
                 list(reversed(pick_configs)) + \
                 move_configs + \
                 place_configs
# ---------- end merge_3 ----------

approach_pickup_config_3 = Data(merge_3.approach_pick_config)
trajectory_2 = Data(merge_3.complete_trajectory)
place_trajectory_3 = Data(merge_3.place_configs)
pick_trajectory_3 = Data(merge_3.pick_configs)
filter = StreamFilter(
    Gate=list,
    Stream0=approach_pickup_config_3,
    Stream1=pickup_config_3,
    Stream2=approach_place_config_3,
    Stream3=place_config_3,
    Stream4=trajectory_2,
    Stream5=place_trajectory_3,
    Stream6=pick_trajectory_3,
    Stream7=current_config_2)
item = ListItem(List=filter, Index=Slider(0, range=0..200), Wrap=True)

# ----
# Send to a config using UR RTDE
number_slider_4 = Slider(0.1, range=0..3.14)
move_to_config = GhPythonScript(config=item, speed=Slider(0.05, range=0..2), accel=number_slider_4, send=Button(), ip="169.254.204.200")  # -> a
# ---------- move_to_config: Python ----------
import os
import math

from compas.rpc import Proxy
package_path = ghdoc.Path

if send:
    if not config:
        ghenv.Component.Message = "No config to move to!"
    else:
        canvas = ghenv.Component.OnPingDocument()
        path = os.path.abspath(os.path.join(package_path,"../../../docs/Tutorial 7 - ROS/robot"))
        rtde = Proxy('fabrication', path=path)
        nowait = True
        a = rtde.move_to_joints(config, speed, accel, nowait, ip=ip)
        ghenv.Component.Message = "Sent config"
# ---------- end move_to_config ----------

# ----
# Move until contact using UR RTDE
number_slider_5 = Slider(0.02, range=0..2)
move_to_config_2 = GhPythonScript(config=item, speed=number_slider_5, accel=Slider(0.1, range=0..3.14), send=Button(), ip="169.254.204.200")  # -> a
# ---------- move_to_config_2: Python ----------
import os
import math

from compas.rpc import Proxy
package_path = ghdoc.Path

if send:
    if not config:
        ghenv.Component.Message = "No config to move to!"
    else:
        canvas = ghenv.Component.OnPingDocument()
        path = os.path.abspath(os.path.join(package_path,"../../../docs/Tutorial 7 - ROS/robot"))
        rtde = Proxy('fabrication', path=path)
        nowait = True
        a = rtde.move_in_z_until_contact(config, speed, accel, nowait, ip=ip)
        ghenv.Component.Message = "Sent config"
        print a
# ---------- end move_to_config_2 ----------

# ----
# Complete_Trajectory
trajectory_3 = Data(merge_3.complete_trajectory)

# ----
# move_trajectory
data = Data(merge_3.move_configs)

# ----
# place_trajectory
data_2 = Data(merge_3.place_configs)

# ----
# home_trajectory
data_3 = Data(merge_3.home_config)

# ----
# move_to_pick_trajectory
data_4 = Data(merge_3.approach_pick_config)

# ----
# pick_trajectory
data_5 = Data(merge_3.pick_configs)

# ----
# Send a Pick and Place Routine
number_slider_6 = Slider(0.05, range=0..3.14)
pick_and_place = GhPythonScript(
    move_to_pick_trajectory=data_4,
    pick_trajectory=data_5,
    move_trajectory=data,
    place_trajectory=data_2,
    speed=Slider(0.25, range=0..1),
    accel=number_slider_6,
    radius=Slider(0.006, range=0..3.14),
    send=Button(),
    ip="169.254.204.200")  # -> a; inputs move_to_pick_trajectory: list, pick_trajectory: list, move_trajectory: list, place_trajectory: list
# ---------- pick_and_place: Python ----------
import os
import math
import time
from scriptcontext import sticky as st
import Grasshopper.Kernel as gh
from compas.rpc import Proxy
from compas.geometry import Translation, Vector, Transformation, Frame

vaccum_io = 5
package_path = ghdoc.Path
#send_trajectory_key = 'send_trajectory_key' + send_topic_name

#print send
#print st[send_trajectory_key]

#Check if value is true and sticky of the value has been updated
if send:
    if not pick_trajectory: #if no frames provided, then display message
        ghenv.Component.Message = "No pick trajectory to move to!"
    
    if not move_trajectory: #if no frames provided, then display message
        ghenv.Component.Message = "No move trajectory to move to!"
    
    if not place_trajectory: #if no frames provided, then display message
        ghenv.Component.Message = "No place trajectory to move to!"
    
    else:
        
        canvas = ghenv.Component.OnPingDocument()
        path = os.path.abspath(os.path.join(package_path,"../../../docs/Tutorial 7 - ROS/robot"))
        rtde = Proxy('fabrication', path=path)   
        rtde.pick_and_place_blocks_trajectories(move_to_pick_trajectory, pick_trajectory, move_trajectory, place_trajectory, speed, accel, radius, ip, vaccum_io) 
    #        rtde.pick_and_place_sticks_configs_trajectories(exit_safe_config, move_to_pick_trajectory, approach_pick_config, pick_config, move_trajectory, place_config, speed, accel, radius, ip, vaccum_io)

        ghenv.Component.Message = "Sent frames" #display message on component
#        a = st['send_trajectory_key']

else:
            ghenv.Component.Message = "Send has not been received yet" #display message on component = "Send has not been received yet"
# ---------- end pick_and_place ----------

robot_visualize = COMPASFABRobotVisualize(
    robot=robot_2,
    configuration=item,
    show_visual=Toggle(True),
    show_collision=Toggle(False),
    show_robot_reach=Toggle(False))  # -> visual, collision, collision_meshes, attached_meshes, frames, base_frame, ee_frame, robot_reach; inputs show_visual: Boolean, show_collision: Boolean, show_frames: Boolean, show_base_frame: Boolean, show_end_effector_frame: Boolean, show_cm: Boolean, show_acm: Boolean
#   port group: The planning group used for end-effector and base visualization.
#   port configuration: The robot's full configuration.
#   port show_visual: Whether or not to show the robot's visual meshes.
#   port show_collision: Whether or not to show the robot's collision meshes.
#   port show_frames: Whether or not to show the robot's joint frames.
#   port show_base_frame: Whether or not to show the robot's base frame.
#   port show_end_effector_frame: Whether or not to show the robot's end-effector frame.
#   port show_cm: Whether or not to show the collision meshes (if any).
#   port show_acm: Whether or not to show the attached collision meshes (if any).
#   port visual: Rhino meshes of the robot's visual geometry (if any).
#   port collision: Rhino meshes of the robot's collision geometry (if any).
#   port collision_meshes: Rhino meshes of the scene's collision meshes (if any).
#   port attached_meshes: Rhino meshes of the scene's attached collision meshes (if any).
#   port frames: The robot's joint frames as Rhino planes (if any).
#   port base_frame: The robot's base frame as a Rhino plane (if any).
#   port ee_frame: The robot's end-effector frame as a Rhino plane (if any).
# ---------- robot_visualize: Python ----------
"""
Visualizes the robot.

COMPAS FAB v1.0.2
"""

import time

from compas.geometry import Frame
from compas.geometry import Transformation
from compas.geometry import Sphere
from compas.scene import SceneObject
from compas_ghpython import create_id
from compas_rhino.conversions import frame_to_rhino_plane, sphere_to_rhino
from ghpythonlib.componentbase import executingcomponent as component
from scriptcontext import sticky as st

from compas_fab.backends import BackendFeatureNotSupportedError
from compas_fab.robots import PlanningScene


class RobotVisualize(component):
    def RunScript(
        self,
        robot,
        group,
        configuration,
        show_visual,
        show_collision,
        show_frames,
        show_base_frame,
        show_end_effector_frame,
        show_cm,
        show_acm,
        show_robot_reach,
    ):
        visual = None
        collision = None
        collision_meshes = None
        attached_meshes = None
        frames = None
        base_frame = None
        ee_frame = None
        robot_reach = None

        if robot:
            show_visual = True if show_visual is None else show_visual
            show_cm = True if show_cm is None else show_cm
            show_acm = True if show_acm is None else show_acm
            configuration = configuration or robot.zero_configuration()

            robot.update(configuration, visual=show_visual, collision=show_collision)
            compas_frames = robot.transformed_frames(configuration, group)

            if show_visual:
                visual = robot.scene_object.draw_visual()

            if show_collision:
                collision = robot.scene_object.draw_collision()

            if show_base_frame:
                base_compas_frame = compas_frames[0]
                base_frame = frame_to_rhino_plane(base_compas_frame)

            if show_end_effector_frame:
                options = dict(solver="model")
                if robot.attached_tool:
                    options["link"] = robot.attached_tool.connected_to

                ee_compas_frame = robot.forward_kinematics(configuration, group, options=options)
                ee_frame = frame_to_rhino_plane(ee_compas_frame)

            if show_frames:
                frames = []
                for compas_frame in compas_frames[1:]:
                    frame = frame_to_rhino_plane(compas_frame)
                    frames.append(frame)

            cached_scene_key = create_id(self, "cached_scene")
            
            if show_robot_reach:
                base_frame = compas_frames[0]
                geo_origin = Frame([base_frame.point.x, base_frame.point.y, base_frame.point.z+0.152], base_frame.xaxis, base_frame.yaxis)
                geo = Sphere.from_point_and_radius(geo_origin.point, 0.5)
                robot_reach = sphere_to_rhino(geo)

            if show_cm or show_acm:
                cached_scene = st.get(cached_scene_key)
                if not cached_scene:
                    cached_scene = {"time": 0}

                # expire cache if the component has not been executed in the last 2 seconds
                # this allows to slide through a list of configurations
                # without triggering refreshes of the scene in the middle of it
                if time.time() - cached_scene["time"] > 2:
                    update_scene = True
                else:
                    update_scene = False

                if update_scene:
                    scene = PlanningScene(robot)
                    try:
                        scene = robot.client.get_planning_scene()
                    except BackendFeatureNotSupportedError:
                        print(
                            "The selected backend does not support collision meshes. If you need collision mesh support, use a different backend."
                        )
                        scene = None
                        show_cm = False
                        show_acm = False

                if update_scene and show_cm:
                    collision_meshes = []

                    for co in scene.world.collision_objects:
                        header = co.header
                        frame_id = header.frame_id
                        cms = co.to_collision_meshes()

                        for cm in cms:
                            if cm.frame != Frame.worldXY():
                                t = Transformation.from_frame(cm.frame)
                                mesh = cm.mesh.transformed(t)
                            else:
                                mesh = cm.mesh

                            collision_meshes.extend(SceneObject(mesh).draw())

                        cached_scene["cm"] = collision_meshes

                collision_meshes = cached_scene.get("cm", [])

                if update_scene and show_acm:
                    attached_meshes = []

                    for aco in scene.robot_state.attached_collision_objects:
                        for acm in aco.to_attached_collision_meshes():
                            frame_id = aco.object["header"]["frame_id"]
                            frame = robot.forward_kinematics(configuration, options=dict(link=frame_id))
                            t = Transformation.from_frame(frame)

                            # Local CM frame
                            if acm.collision_mesh.frame and acm.collision_mesh.frame != Frame.worldXY():
                                t = t * Transformation.from_frame(acm.collision_mesh.frame)

                            mesh = acm.collision_mesh.mesh.transformed(t)

                            attached_meshes.extend(SceneObject(mesh).draw())

                    cached_scene["acm"] = attached_meshes

                attached_meshes = cached_scene.get("acm", [])

                cached_scene["time"] = time.time()
                st[cached_scene_key] = cached_scene

        return (
            visual,
            collision,
            collision_meshes,
            attached_meshes,
            frames,
            base_frame,
            ee_frame,
            robot_reach,
        )
# ---------- end robot_visualize ----------
mesh_3 = Mesh(robot_visualize.collision_meshes)
geo = Geometry(robot_visualize.robot_reach)
mesh_4 = Mesh(robot_visualize.visual)

# ----
# Internalize Trajectory and Config Data without Issues
# Feed the configs here:
# (configs = trajectory.points)
ghpython_script = GhPythonScript(configs=trajectory_3)  # -> configs_data; inputs configs: list
# ---------- ghpython_script: Python ----------
import json

configs_data =[]

for c in configs:
    data = c.to_data()
    d = json.dumps(data)
    configs_data.append(d)
# ---------- end ghpython_script ----------

# ----
# Internalize this:
data_6 = Data(ghpython_script)

ghpython_script_2 = GhPythonScript(c=data_6)  # -> configs; inputs c: list
# ---------- ghpython_script_2: Python ----------
import json
import compas_fab.robots

configs =[]

for i in c:
    data = json.loads(i)
    conf = compas_fab.robots.JointTrajectoryPoint.from_data(data)
    configs.append(conf)
# ---------- end ghpython_script_2 ----------
