# Grasshopper definition caa_robotic_control_example.gh (Grasshopper 1.0.7)

# ----
# Fake Dictionaries
ghpython_script = GhPythonScript()  # -> out, a, b, c, d, e
# ---------- ghpython_script: Python ----------
a = [{ "execute":True, "index":19, "count":0}]
b= [{"execute":True, "index":19, "count":1}]
c= [{ "execute":True, "index":20, "count":0}]
d= [{ "execute":True, "index":20, "count":1}]
e = [{ "execute":False, "index":19, "count":0}]

print "a = " , a
print "b = " , b
print "c = " , c
print "d = " , d
print "e = ", e
# ---------- end ghpython_script ----------
panel = Panel(ghpython_script.out)

panel_2 = Panel(ghpython_script.a)
# MQTT
# Install compas_eve on your working enviroment and Rhino
#  https://github.com/gramaziokohler/compas_eve/tree/main
panel_3 = Panel("broker.hivemq.com")

# ----
# if host != localhost:
# 
# DISABLE your Firewall or Ensure that the required ports for MQTT (typically 1883 or 8883 for secure connections) are open and accessible.
# >> Subscriber | Place
panel_4 = Panel("/caa_get_place_config/")
mqtt_subscriber = MQTTSubscriber(host=panel_3, topic=panel_4, reset=Button())  # -> out, last_message
# ---------- mqtt_subscriber: Python ----------
from __future__ import print_function
import time
import json
import random
import threading
from System.Threading.Tasks import Task
from System.Threading import ManualResetEventSlim

from ghpythonlib.componentbase import executingcomponent as component
from scriptcontext import sticky as st

from compas_eve import Message, Topic, Subscriber
from compas_eve.mqtt import MqttTransport
from compas_fab.ghpython.components import create_id
from compas_ghpython import update_component

import Rhino
import System


class BackgroundWorker(object):
    def __init__(self, ghenv):
        super(BackgroundWorker, self).__init__()
        self.ghenv = ghenv
        self._is_working = False
        self._is_done = False
        self._is_cancelled = False
        self._has_requested_cancellation = False

    def is_working(self):
        return self._is_working

    def is_done(self):
        return self._is_done

    def has_requested_cancellation(self):
        return self._has_requested_cancellation

    def request_cancellation(self):
        self._has_requested_cancellation = True
        self.thread.join(timeout=3)

    def start_work(self):
        self.thread = threading.Thread(target=self.do_work)
        self.thread.start()

    def set_internal_state_to_working(self):
        self._is_working = True
        self._is_done = False
        self._is_cancelled = False

    def set_internal_state_to_done(self, result):
        self._is_working = False
        self._is_done = True
        self._is_cancelled = False
        self.result = result
        update_component(self.ghenv, 1)

    def set_internal_state_to_cancelled(self):
        self._is_working = False
        self._is_done = False
        self._is_cancelled = True
        
    def do_work(self):
        pass

    def display_progress(self, progress):
        self.display_message("Progress {:.1f}%".format(progress * 100))

    def display_message(self, message):
        def ui_callback():
            self.ghenv.Component.Message = message
            self.ghenv.Component.OnDisplayExpired(True)
        Rhino.RhinoApp.InvokeOnUiThread(System.Action(ui_callback))

    @classmethod
    def instance_by_component(cls, ghenv, force_new=False):
        """Get the worker instance assigned to the component.
        
        This will get a persistant instance of a background worker
        for a given component. For debugging purposes, `force_new` can
        be set to `True` to request a new instance to be created.
        """
        key = create_id(ghenv.Component, 'background_worker')
        worker = st.get(key)

        if worker and force_new:
            worker.request_cancellation()
            worker.display_message("Cancelled")
            del st[key]

        if not worker:
            worker = cls(ghenv)
            st[key] = worker
        
        return worker


class SimpleExampleBackgroundWorker(BackgroundWorker):
    def do_work(self):
        # This is only an example of how to write a "do_work" method in a background worker,
        # the code can do whatever, it can be blocking if needed, long/running, anything,
        # the important part is that it calls the methods `set_internal_state_to_*`
        # at the right times
        self.set_internal_state_to_working()

        t = 200
        result = dict()
        for i in range(t):
            if self.has_requested_cancellation():
                self.display_message("Cancelled")
                self.set_internal_state_to_cancelled()
                break

            self.display_progress(i / (t-1))
            time.sleep(.1)

            result['a'] = "Counted up to {}".format(t)

        self.set_internal_state_to_done(result)




class SubscriberBackgroundWorker(BackgroundWorker):
    def do_work(self):
        self.set_internal_state_to_working()
        results = {"messages": []}
        self.messages = results["messages"]
        
        def on_message(message):
            try:
                results["messages"].append(message)
                update_component(self.ghenv, 1)
            except Exception as e:
                self.display_message("Exception: {}".format(e))

        tx = MqttTransport(self.host)
        subscriber = Subscriber(Topic(self.topic, Message), callback=on_message, transport=tx)
        subscriber.subscribe()

        try:
            self.display_message("Starting...")
            while True:
                self.display_message("Received {} messages".format(len(results["messages"])))
                if self.has_requested_cancellation():
                    self.display_message("Cancelled")
                    self.set_internal_state_to_cancelled()
                    break
                
                time.sleep(0.5)
        except Exception as e:
            self.display_message("Exception in threaded worker: " + str(e))
        finally:
            subscriber.unsubscribe()

        self.set_internal_state_to_done(results)

class SubscriberComponent(component):
    def RunScript(self, host, topic, reset):
        self.worker = SubscriberBackgroundWorker.instance_by_component(ghenv, force_new=reset)
        self.worker.host = host
        self.worker.topic = topic

        if not self.worker.is_working() and not self.worker.is_done():
            self.worker.display_message("Starting work..")
            time.sleep(.5)

            self.worker.start_work()

        print("is_working", self.worker.is_working())
        print("is_done", self.worker.is_done())

        last_message = None
        if hasattr(self.worker, "messages") and len(self.worker.messages):
            last_message = self.worker.messages[-1].data
            print (last_message)
            #print("Received {} total messages".format(len(self.worker.messages)))
#            for msg in self.worker.messages:
#                print("Request #{}".format(msg))

        return (last_message, )
# ---------- end mqtt_subscriber ----------
panel_5 = Panel(mqtt_subscriber.out)

# ----
# >> Subscriber | Compute
panel_6 = Panel("/caa_calculate_trajectory/")
mqtt_subscriber_2 = MQTTSubscriber(host=panel_3, topic=panel_6, reset=Button())  # -> out, last_message
# ---------- mqtt_subscriber_2: Python ----------
from __future__ import print_function
import time
import json
import random
import threading
from System.Threading.Tasks import Task
from System.Threading import ManualResetEventSlim

from ghpythonlib.componentbase import executingcomponent as component
from scriptcontext import sticky as st

from compas_eve import Message, Topic, Subscriber
from compas_eve.mqtt import MqttTransport
from compas_fab.ghpython.components import create_id
from compas_ghpython import update_component

import Rhino
import System


class BackgroundWorker(object):
    def __init__(self, ghenv):
        super(BackgroundWorker, self).__init__()
        self.ghenv = ghenv
        self._is_working = False
        self._is_done = False
        self._is_cancelled = False
        self._has_requested_cancellation = False

    def is_working(self):
        return self._is_working

    def is_done(self):
        return self._is_done

    def has_requested_cancellation(self):
        return self._has_requested_cancellation

    def request_cancellation(self):
        self._has_requested_cancellation = True
        self.thread.join(timeout=3)

    def start_work(self):
        self.thread = threading.Thread(target=self.do_work)
        self.thread.start()

    def set_internal_state_to_working(self):
        self._is_working = True
        self._is_done = False
        self._is_cancelled = False

    def set_internal_state_to_done(self, result):
        self._is_working = False
        self._is_done = True
        self._is_cancelled = False
        self.result = result
        update_component(self.ghenv, 1)

    def set_internal_state_to_cancelled(self):
        self._is_working = False
        self._is_done = False
        self._is_cancelled = True
        
    def do_work(self):
        pass

    def display_progress(self, progress):
        self.display_message("Progress {:.1f}%".format(progress * 100))

    def display_message(self, message):
        def ui_callback():
            self.ghenv.Component.Message = message
            self.ghenv.Component.OnDisplayExpired(True)
        Rhino.RhinoApp.InvokeOnUiThread(System.Action(ui_callback))

    @classmethod
    def instance_by_component(cls, ghenv, force_new=False):
        """Get the worker instance assigned to the component.
        
        This will get a persistant instance of a background worker
        for a given component. For debugging purposes, `force_new` can
        be set to `True` to request a new instance to be created.
        """
        key = create_id(ghenv.Component, 'background_worker')
        worker = st.get(key)

        if worker and force_new:
            worker.request_cancellation()
            worker.display_message("Cancelled")
            del st[key]

        if not worker:
            worker = cls(ghenv)
            st[key] = worker
        
        return worker


class SimpleExampleBackgroundWorker(BackgroundWorker):
    def do_work(self):
        # This is only an example of how to write a "do_work" method in a background worker,
        # the code can do whatever, it can be blocking if needed, long/running, anything,
        # the important part is that it calls the methods `set_internal_state_to_*`
        # at the right times
        self.set_internal_state_to_working()

        t = 200
        result = dict()
        for i in range(t):
            if self.has_requested_cancellation():
                self.display_message("Cancelled")
                self.set_internal_state_to_cancelled()
                break

            self.display_progress(i / (t-1))
            time.sleep(.1)

            result['a'] = "Counted up to {}".format(t)

        self.set_internal_state_to_done(result)




class SubscriberBackgroundWorker(BackgroundWorker):
    def do_work(self):
        self.set_internal_state_to_working()
        results = {"messages": []}
        self.messages = results["messages"]
        
        def on_message(message):
            try:
                results["messages"].append(message)
                update_component(self.ghenv, 1)
            except Exception as e:
                self.display_message("Exception: {}".format(e))

        tx = MqttTransport(self.host)
        subscriber = Subscriber(Topic(self.topic, Message), callback=on_message, transport=tx)
        subscriber.subscribe()

        try:
            self.display_message("Starting...")
            while True:
                self.display_message("Received {} messages".format(len(results["messages"])))
                if self.has_requested_cancellation():
                    self.display_message("Cancelled")
                    self.set_internal_state_to_cancelled()
                    break
                
                time.sleep(0.5)
        except Exception as e:
            self.display_message("Exception in threaded worker: " + str(e))
        finally:
            subscriber.unsubscribe()

        self.set_internal_state_to_done(results)

class SubscriberComponent(component):
    def RunScript(self, host, topic, reset):
        self.worker = SubscriberBackgroundWorker.instance_by_component(ghenv, force_new=reset)
        self.worker.host = host
        self.worker.topic = topic

        if not self.worker.is_working() and not self.worker.is_done():
            self.worker.display_message("Starting work..")
            time.sleep(.5)

            self.worker.start_work()

        print("is_working", self.worker.is_working())
        print("is_done", self.worker.is_done())
        
        last_message = None
        if hasattr(self.worker, "messages") and len(self.worker.messages):
            last_message = self.worker.messages[-1].data
            print (last_message)
            #print("Received {} total messages".format(len(self.worker.messages)))
#            for msg in self.worker.messages:
#                print("Request #{}".format(msg))

        return (last_message, )
# ---------- end mqtt_subscriber_2 ----------
panel_7 = Panel(mqtt_subscriber_2.out)

# ----
# >> Subscriber | Execute
panel_8 = Panel("/caa_execute_trajectory/")
mqtt_subscriber_3 = MQTTSubscriber(host=panel_3, topic=panel_8, reset=Button())  # -> out, last_message; same code as mqtt_subscriber
panel_9 = Panel(mqtt_subscriber_3.out)

print_st = Button()
# Sticky Management
add_st = Button()
clear_st = Button()
ghpython_script_2 = GhPythonScript(
    place_topic_name=panel_4,
    calculate_topic_name=panel_6,
    send_topic_name=panel_8,
    add=add_st,
    clear=clear_st,
    print_current_st=print_st)  # -> out, a; inputs add: Boolean
# ---------- ghpython_script_2: Python ----------
from scriptcontext import sticky as st

send_calculate_key = 'send_calculate_key' + calculate_topic_name
planning_failure_key = 'planning_failure_key' + calculate_topic_name
send_trajectory_key = 'send_trajectory_key' + send_topic_name
current_index_key = 'current_index_key' + place_topic_name
#cannot put +topic name because it breaks the list and string
design_data_key = 'design_data_key' + place_topic_name
message_index_key = 'message_index_key' + place_topic_name


if add:
    #### ADD STICKYS NEEDED FOR PLACE TOPIC
    
    #SAFETY
    st[message_index_key] = None
    
    #FIREBASE
    st[current_index_key] = None
    st[design_data_key] = None
    
    #### ADD STICKYS FOR CALCULATE TOPIC
    st[send_calculate_key] = False
    
    #### ADD STICKEYS FOR SEND TOPIC
    st[send_trajectory_key] = False
    
    #### ADD STICKEYS FOR SEND TOPIC
    st[planning_failure_key] = False

elif clear:
    st.clear()

elif print_current_st:
    a = [message_index_key, st[message_index_key], current_index_key, st[current_index_key], design_data_key, st[send_trajectory_key], send_calculate_key, st[send_calculate_key], send_trajectory_key, st[send_trajectory_key]]
    print st
print st
a = [message_index_key, st[message_index_key], current_index_key, st[current_index_key], design_data_key, st[send_trajectory_key], send_calculate_key, st[send_calculate_key], send_trajectory_key, st[send_trajectory_key]]
# ---------- end ghpython_script_2 ----------

# ----
# Send Trajectory
ghpython_script_3 = GhPythonScript(send_trajectory_message=mqtt_subscriber_3.last_message, send_topic_name=panel_8, safety_topic_name=panel_4)  # -> out, send_trajectory
# ---------- ghpython_script_3: Python ----------
from scriptcontext import sticky as st

if not send_trajectory_message:
    ghenv.Component.Message = "No Message has been sent"

else:
    execute = send_trajectory_message['execute']
    index = send_trajectory_message['index']
    count = send_trajectory_message['count']
    
    current_index = st['current_index_key' + safety_topic_name]
    message_index = st['message_index_key' + safety_topic_name]
    
    print type(current_index)
    print type(message_index)
    print type(index)
    print execute
    
    send_trajectory_key = 'send_trajectory_key' + send_topic_name
    
    #Check index against the sticky
    if execute and str(index) == str(message_index) and str(index) == current_index:
        st[send_trajectory_key] = True
        send_trajectory = True
        ghenv.Component.Message = "Message Sent"
    
    elif execute == False:
        ghenv.Component.Message = "You received a false"
    
    elif str(index) != str(message_index):
        ghenv.Component.Message = "Your message index does not match place message index"
    
    else:
        ghenv.Component.Message = "Message Index DOES NOT match Firebase Index"
        raise Exception("Message Index DOES NOT match Firebase Index")
# ---------- end ghpython_script_3 ----------

# ----
# Calculate Trajectory
ghpython_script_4 = GhPythonScript(calculate_trajectory_message=mqtt_subscriber_2.last_message, calculate_topic_name=panel_6, safety_topic_name=panel_4)  # -> out, calculate_trajectory
# ---------- ghpython_script_4: Python ----------
from scriptcontext import sticky as st

if not calculate_trajectory_message:
    ghenv.Component.Message = "No Message has been sent"

else:
    execute = calculate_trajectory_message['execute']
    index = calculate_trajectory_message['index']
    count = calculate_trajectory_message['count']
    
    current_index = st['current_index_key' + safety_topic_name]
    message_index = st['message_index_key'+ safety_topic_name]
    
    send_calculate_key = 'send_calculate_key' + calculate_topic_name
    
    print type(current_index)
    print type(message_index)
    print type(index)
    print execute

    
    #Check index against the sticky
    if execute and str(index) == str(message_index) and str(index) == current_index:
        st[send_calculate_key] = True
        calculate_trajectory = True
        ghenv.Component.Message = "Message Sent"
    
    #Throw error if condition
    elif execute == False:
        ghenv.Component.Message = "You received a false"
    
    #Throw error if condition
    elif str(index) != str(message_index):
        ghenv.Component.Message = "Your message index does not match place message index"
    
    #Throw error if condition
    else:
        ghenv.Component.Message = "Message Index DOES NOT match Firebase Index"
        raise Exception("Your message index DOES NOT match Firebase Index")
# ---------- end ghpython_script_4 ----------

# ----
# MQTT: Message Receive
# Update Design Info & Place Config
ghpython_script_5 = GhPythonScript(get_place_message=mqtt_subscriber.last_message, place_topic_name=panel_4)  # -> out, info_update, count, index, place_config_update
# ---------- ghpython_script_5: Python ----------
from scriptcontext import sticky as st

message_index_key = 'message_index_key' + place_topic_name

if not get_place_message:
    ghenv.Component.Message = "No Message has been sent"

else:
    execute = get_place_message['execute']
    index = get_place_message['index']
    count = get_place_message['count']
    
    if index != st[message_index_key]:
        st[message_index_key] = index
    
    #Check index against the sticky
    if execute:
        info_update = True
        ghenv.Component.Message = "Message Sent"
        
        if count > 0:
            place_config_update = True
            ghenv.Component.Message = "Update Place Frame Message"
    
    elif execute == False:
        ghenv.Component.Message = "You received a false"
# ---------- end ghpython_script_5 ----------

# ----
# Wall as for measurement #5: 9/3/23
colour_swatch = ColourSwatch(SwatchColor=RGBA(94, 94, 94, 27))
geometry = Geometry(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)
custom_preview = CustomPreview(Geometry=geometry, Material=colour_swatch)

panel_10 = Panel(ghpython_script_2.out)
panel_11 = Panel(ghpython_script_2.a)

info = Info()  # -> info
#   port info: Environment info.
# ---------- info: Python ----------
"""
Displays information about the active COMPAS environment.
"""
import compas_bootstrapper
from ghpythonlib.componentbase import executingcomponent as component

import compas


class CompasInfo(component):
    def RunScript(self):
        self.Message = "COMPAS v{}".format(compas.__version__)
        info = "COMPAS Version: {}\nEnvironment: {}"
        return info.format(compas.__version__, compas_bootstrapper.ENVIRONMENT_NAME)
# ---------- end info ----------
panel_12 = Panel(info)

# ----
# Model_Base
geometry_2 = Geometry([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])

# ----
# Detailed_Robot_Table
geometry_3 = Geometry([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])

# ----
# IP Address
panel_13 = Panel("192.168.0.10")

# ----
# Pick and place routine: Compas Example
# Set TCP/Get TCP
button = Button()
get_tcp_offset = GhPythonScript(ip=panel_13, get_tcp=button)  # -> tcp
# ---------- get_tcp_offset: Python ----------
import os
import math
from scriptcontext import sticky as st

tcp = 'tcp_{}'.format(str(ghenv.Component.InstanceGuid))
package_path = ghdoc.Path

from compas.rpc import Proxy

if tcp not in st:
    st[tcp]= None

if get_tcp:   
    canvas = ghenv.Component.OnPingDocument()
    path = os.path.abspath(os.path.join(package_path,"../../../cdf_unity/src/cdf_unity/robot"))
    rtde = Proxy('fabrication', path=path)                         
    st[tcp] = rtde.get_tcp_offset(ip=ip)    

tcp = st[tcp]
# ---------- end get_tcp_offset ----------
set_tcp_offset = GhPythonScript(ip=panel_13, set_tcp=Button())
# ---------- set_tcp_offset: Python ----------
import os
import math
from scriptcontext import sticky as st

tcp = 'tcp_{}'.format(str(ghenv.Component.InstanceGuid))
package_path = ghdoc.Path

from compas.rpc import Proxy

if tcp not in st:
    st[tcp]= None

if set_tcp:   
    canvas = ghenv.Component.OnPingDocument()
    path = os.path.abspath(os.path.join(package_path,"../../../cdf_unity/src/cdf_unity/robot"))
    rtde = Proxy('fabrication', path=path)  
    pose = [0.61/1000,0.0,80.06/1000,0.0,3.1415,0.0]
    st[tcp] = rtde.set_tcp_offset(pose, ip=ip)    

tcp = st[tcp]
# ---------- end set_tcp_offset ----------
panel_14 = Panel(get_tcp_offset)

# ----
# Stick Holder
# BACK
geometry_4 = Geometry([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])

# ----
# LEFT
geometry_5 = Geometry([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])

# ----
# RIGHT
geometry_6 = Geometry([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])

# ----
# non-detailed cm
mesh = Mesh([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])

# ----
# non-detailed cm
mesh_2 = Mesh([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])

# ----
# non-detailed cm
mesh_3 = Mesh([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])

panel_15 = Panel("172.20.10.5")

# ----
# 1. Define local path
panel_16 = Panel("C:\Users\eleni\Documents\GitHub\cdf_unity")
data = Data("X:\mas_t3_working\git_working\cdf_unity")

# ----
# Localization
button_2 = Button()
get_tcp_frame = GhPythonScript(get_origin=button_2, get_x=Button(), get_y=Button(), ip=panel_13)  # -> frame, origin, x_pt, y_pt
# ---------- get_tcp_frame: Python ----------
import os
from scriptcontext import sticky as st
#sticky is a persistent dictionary which can save values and also be acessed by other GH components
#we use it here with a custom key to store values we read from the robot
from compas.rpc import Proxy
package_path = ghdoc.Path
path = os.path.abspath(os.path.join(package_path,"../../../cdf_unity/src/cdf_unity/robot"))


origin_key = 'origin_{}'.format(str(ghenv.Component.InstanceGuid))
x_key = 'x_{}'.format(str(ghenv.Component.InstanceGuid))
y_key = 'y_{}'.format(str(ghenv.Component.InstanceGuid))

if origin_key not in st:
    st[origin_key] = None

if x_key not in st:
    st[x_key] = None

if y_key not in st:
    st[y_key] = None

if get_origin:
    canvas = ghenv.Component.OnPingDocument()
    rtde = Proxy('fabrication', path=path)
    frame = rtde.get_tcp_frame(ip=ip)
    st[origin_key] = frame.point

if get_x:
    canvas = ghenv.Component.OnPingDocument()
    rtde = Proxy('fabrication', path=path)
    frame = rtde.get_tcp_frame(ip=ip)
    st[x_key] = frame.point

if get_y:
    canvas = ghenv.Component.OnPingDocument()
    rtde = Proxy('fabrication', path=path)
    frame = rtde.get_tcp_frame(ip=ip)
    st[y_key] = frame.point


origin = st[origin_key]
x_pt = st[x_key]
y_pt = st[y_key]
# ---------- end get_tcp_frame ----------

# ----
# Model_plane
plane = Plane(PlaneXY(-0.075, -0.075, 0))  # disabled

# ----
# Measured_plane
plane_2 = Plane(Plane(origin=(-0.8167820407, 0.3777454694, -0.7626233109), x=(0.6498067614, 0.7600816773, -0.005197762801), y=(-0.760085977, 0.6498207651, 0.001510261909)))  # disabled

# ----
# Firebase Info Name
# Instantiation Inputs
panel_17 = Panel("node")

length = Slider(0.85, range=0..100)
radius = Slider(0.011, range=0..100)

length_2 = Slider(0.75, range=0..100)
radius_2 = Slider(0.011, range=0..100)

length_3 = Slider(0.65, range=0..100)
radius_3 = Slider(0.011, range=0..100)

# ----
# Attach tool
value_list = ValueList({"parallel_gripper_ethz": 0, "parallel_gripper_ethz_with_mtip": 1}, selected="parallel_gripper_ethz")
show = BooleanToggle(True)
py = PythonScript()  # -> DATA
# ---------- py: Python ----------
import os

#package_path = os.path.dirname(mobile_fabrication_control.__file__)
#DATA = os.path.abspath(os.path.join(package_path,"../../data"))

package_path = ghdoc.Path
# package_path = os.path.dirname(ur_fabrication_control.__file__)
#DATA = os.path.abspath(os.path.join(package_path,"../../data"))

# .stl files not stored in am_hackathon repo. but in mobile_fabrication_control
DATA = os.path.abspath(os.path.join(package_path,"../../../cdf_unity/data"))

print(package_path)
print(DATA)
# ---------- end py ----------
tool = PythonScript(data_path=py, tool=value_list, show=show)  # -> tool, M, cm, ee_plane
# ---------- tool: Python ----------
import os, math
from compas.geometry import Frame, Rotation
from compas.datastructures import Mesh
from compas_ghpython.artists import MeshArtist
from compas_fab.robots import Tool
from compas_ghpython.utilities import draw_frame

tolerance = 0

if tool == 0:
    filename = 'parallel_gripper_ethz_2.stl'
    cm_filename = 'parallel_gripper_ethz_2_cm_OPEN.stl'
#    ee_frame = Frame([0,0,0.087], [0, 1, 0], [-1, 0, 0])
    ee_frame = Frame([0,0,0.087], [-0.814788,-0.579758,0], [-0.579758,0.814788,0])

elif tool == 1:
    filename = 'parallel_gripper_ethz_with_mtip_2.stl'
    cm_filename = 'parallel_gripper_ethz_with_mtip_2_cm.stl'
#    ee_frame = Frame([0,0,0.105], [0, 1, 0], [-1, 0, 0])
    ee_frame = Frame([0,0,0.103], [-0.814788,-0.579758,0], [-0.579758,0.814788,0])

    
data_path = os.path.join(data_path, "tool_geometry")
fullfilename = os.path.join(data_path, filename)
cm_fullfilename = os.path.join(data_path, cm_filename)
print fullfilename

ee_mesh = Mesh.from_stl(fullfilename)
cm_mesh = Mesh.from_stl(cm_fullfilename)

if show:
    artist = MeshArtist(ee_mesh)
    artist_cm = MeshArtist(cm_mesh)
    M = artist.draw()
    cm = artist_cm.draw()
    ee_plane = draw_frame(ee_frame)

#tool = Tool(ee_mesh, ee_frame)

print(ee_frame.quaternion.xyzw)
ee_framek = Frame([0.0110607,0.00809854,0.41498], [0,1,0], [1,0,0])
print(ee_framek.quaternion.xyzw)
# ---------- end tool ----------
panel_18 = Panel("Attach a custom tool")
mesh_4 = Mesh(tool.M)
plane_3 = Plane(tool.ee_plane)

# ----
# 2. Get Design Information
read = GhPythonScript(
    path=data,
    connect=ghpython_script_5.info_update,
    count=ghpython_script_5.count,
    parent_name="Design_T3",
    child_name=panel_17,
    place_topic_name=panel_4)  # -> out, realtime_json_data, current_index; inputs connect: Boolean
# ---------- read: Python ----------
#import os
#from compas.rpc import Proxy
#
#if connect:
#    p = Proxy(package = 'cdf_unity.firebase.realtime_database', path=path +'\src')
#    
#    p.stop_server()
#    p.start_server()
#    
#    stored_json.update({"node": p.get_json_data("Design", "node")})
#    realtime_json_data = [stored_json]
#    current_index = p.get_json_data("Design", "currentstick")

import os
from compas.rpc import Proxy
from scriptcontext import sticky as st

#ADD STICKY FIRST


current_index_key = 'current_index_key' + place_topic_name
design_data_key = 'design_data_key' + place_topic_name

if connect:
    if count > 0:
        current_index = st[current_index_key]
        realtime_json_data = st[design_data_key]
        
    else:
        p = Proxy(package = 'cdf_unity.firebase.realtime_database', path=path +'\src')
        p.stop_server()
        p.start_server()
        
        # retreive current design and current index
        realtime_json_data = [p.get_json_data(parent_name, child_name)]
        current_index = p.get_json_data(parent_name, "currentstick")
        
        #store design and current index in the sticky
        st[current_index_key] = current_index
        st[design_data_key] = realtime_json_data
# ---------- end read ----------
panel_19 = Panel(read.out)
currentstick = Panel(read.current_index)

# ----
# Measure a plane
panel_20 = Panel(get_tcp_frame.y_pt)
panel_21 = Panel(get_tcp_frame.x_pt)
panel_22 = Panel(get_tcp_frame.origin)
draw = Draw(cg=get_tcp_frame.y_pt)  # -> rg
#   port cg: The COMPAS geometry or datastructure to be drawn.
#   port rg: The Rhino geometry object.
# ---------- draw: Python ----------
"""
Draws COMPAS geometry in Grasshopper.
"""
from ghpythonlib.componentbase import executingcomponent as component

from compas.artists import Artist


class CompasToRhinoGeometry(component):
    def RunScript(self, cg):
        if not cg:
            return None

        return Artist(cg).draw()
# ---------- end draw ----------
draw_2 = Draw(cg=get_tcp_frame.x_pt)  # -> rg; same code as draw
draw_3 = Draw(cg=get_tcp_frame.origin)  # -> rg; same code as draw
ghpython_script_6 = GhPythonScript(origin=draw_3, x_axis_pt=draw_2, y_axis_pt=draw)  # -> out, base_plane; inputs origin: Point3d, x_axis_pt: Point3d, y_axis_pt: Point3d
# ---------- ghpython_script_6: Python ----------
import Rhino.Geometry as rg

if origin is not None and x_axis_pt is not None and y_axis_pt is not None:
    origin = origin
    x_axis = x_axis_pt
    xy_plane_pt = y_axis_pt
    
    base_plane = rg.Plane(origin, x_axis, xy_plane_pt)
# ---------- end ghpython_script_6 ----------
panel_23 = Panel(ghpython_script_6.base_plane)

# ----
# stick radius
radius_4 = Slider(0.01, range=0..100)

# ----
# type lengths
panel_24 = Panel("""0
0.60
0.70
0.80""")

# ----
# 1. Get QR Information
boolean_toggle = BooleanToggle(True)
update_keys_built = Trigger(Interval=2, TimerInterval=5, Target=read_2)  # disabled
read_2 = GhPythonScript(path=data, retrieve=boolean_toggle)  # -> out, realtime_json_data_QR, current_index; inputs retrieve: Boolean
# ---------- read_2: Python ----------
import os
from compas.rpc import Proxy

if retrieve:
    p = Proxy(package = 'cdf_unity.firebase.realtime_database', path=path +'\src')
    p.stop_server()
    p.start_server()
    realtime_json_data_QR = [p.get_json_data_QR("QRFrames_T3")]
print realtime_json_data_QR
# ---------- end read_2 ----------
panel_25 = Panel(read_2.out)

mesh_5 = Mesh(tool.cm)

# ----
# Get Information from Real time database
# Design Data
# 3. Instantiate Geometry
data_2 = Data(read.realtime_json_data)

# ----
# Model Plane: Are you Measuring a Base Markers?
point = Point([Point(-0.225, -0.225, 0.001), Point(-0.075, -0.225, 0.001), Point(0.075, -0.225, 0.001), Point(0.225, -0.225, 0.001), Point(-0.225, -0.075, 0.001), Point(0.225, -0.075, 0.001), Point(-0.225, 0.075, 0.0005), Point(0.225, 0.075, 0.001), Point(-0.225, 0.225, 0.001), Point(-0.075, 0.225, 0.001), Point(0.075, 0.225, 0.001), Point(0.225, 0.225, 0.001)])
value_list_2 = ValueList({"Marker 0": 0, "Marker 1": 1, "Marker 2": 2, "Marker 3": 3, "Marker 4": 4, "Marker 5": 5, "Marker 6": 6, "Marker 7": 7, "Marker 8": 8, "Marker 9": 9, "Marker 10": 10, "Marker 11": 11}, selected="Marker 5")
xy_plane = XYPlane(Origin=point)
ghpython_script_7 = GhPythonScript(selected_QR_index=value_list_2, model_planes=xy_plane)  # -> out, selected_plane; inputs model_planes: list of Plane
# ---------- ghpython_script_7: Python ----------
import Rhino.Geometry as rg

if selected_QR_index == 0:
    selected_plane = model_planes[selected_QR_index]

elif selected_QR_index == 1:
    selected_plane = model_planes[selected_QR_index]

elif selected_QR_index == 2:
    selected_plane = model_planes[selected_QR_index]

elif selected_QR_index == 3:
    selected_plane = model_planes[selected_QR_index]

elif selected_QR_index == 4:
    selected_plane = model_planes[selected_QR_index]

elif selected_QR_index == 5:
    selected_plane = model_planes[selected_QR_index]

elif selected_QR_index == 6:
    selected_plane = model_planes[selected_QR_index]

elif selected_QR_index == 7:
    selected_plane = model_planes[selected_QR_index]

elif selected_QR_index == 8:
    selected_plane = model_planes[selected_QR_index]

elif selected_QR_index == 9:
    selected_plane = model_planes[selected_QR_index]

elif selected_QR_index == 10:
    selected_plane = model_planes[selected_QR_index]

elif selected_QR_index == 11:
    selected_plane = model_planes[selected_QR_index]
# ---------- end ghpython_script_7 ----------

# ----
# Measured Planes
# Measured_plane_0 Internalized
plane_4 = Plane(Plane(origin=(-0.8167820407, 0.3777454694, -0.7626233109), x=(0.6498067614, 0.7600816773, -0.005197762801), y=(-0.760085977, 0.6498207651, 0.001510261909)))

# ----
# Measured Plane
plane_5 = Plane(ghpython_script_6.base_plane)

# ----
# #5: 9/3/2023
plane_6 = Plane(Plane(origin=(-0.9168751208, -0.4094788098, -0.7623235467), x=(0.9983079436, -0.05673933171, -0.01272391376), y=(0.05669678585, 0.9983846606, -0.003680214818)))

# ----
# Planning Robotic Movement
panel_27 = Panel("")

# ----
# Left
point_2 = Point(Point(0.2595000186, -0.3095, 0.03))

number_slider = Slider(0.05, range=0..0.1)

# ----
# Pick Station Location
# back
point_3 = Point(Point(0.5330000186, 0.035, 0.03))

# ----
# Pick_Plane
number_slider_2 = Slider(270, range=0..270)
construct_plane = ConstructPlane(Origin=point_3, XAxis=Vector(1, 0, 0), YAxis=Vector(0, 1, 0))
negative = Negative(Value=number_slider_2)
rotate = Rotate(Geometry=construct_plane, Angle=degrees(negative), Plane=construct_plane)  # -> Geometry, Transform

# ----
# GET CURRENT CONFIG PLACE HOLDER
# start config #19
data_3 = Data("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")

robot_name = Panel("AA")

neg = Negative(Value=number_slider)
cluster = Cluster(geometry=plane_3, plane=plane_3, amplitude=neg)

ghpython_script_8 = GhPythonScript(a=ghpython_script_5.info_update, c=data_3)  # -> configs; inputs c: list
# ---------- ghpython_script_8: Python ----------
import json
import compas_fab.robots
from scriptcontext import sticky as st

config_key = 'config_{}'.format(str(ghenv.Component.InstanceGuid))

if a:
    if config_key not in st:
        st[config_key] = None  # Initialize an empty list if it doesn't exist
    for i in c:
        data = json.loads(i)
        conf = compas_fab.robots.JointTrajectoryPoint.from_data(data)
        st[config_key] = conf

# Now you can access the list from the sticky dictionary
configs = st.get(config_key, [])
# ---------- end ghpython_script_8 ----------

# ----
# Get Current Config
button_3 = Button()
get_config = GhPythonScript(send=button_3, ip=panel_13)  # -> config, a
# ---------- get_config: Python ----------
import os
from scriptcontext import sticky as st
#sticky is a persistent dictionary which can save values and also be acessed by other GH components
#we use it here with a custom key to store values we read from the robot
from compas.rpc import Proxy
package_path = ghdoc.Path

config_key = 'config_{}'.format(str(ghenv.Component.InstanceGuid))
new_key = 'new_key_{}'.format(str(ghenv.Component.InstanceGuid))
if config_key not in st:
    st[config_key] = None

if send:
    canvas = ghenv.Component.OnPingDocument()
    path = os.path.abspath(os.path.join(package_path,"../../../cdf_unity/src/cdf_unity/robot"))
    print (path)
    rtde = Proxy('fabrication', path=path)
    
    st[config_key] = rtde.get_config(ip=ip)
    st[new_key] = rtde.get_config(ip=ip)
#    a = rtde.get_config(ip=ip)
config = st[config_key]
# ---------- end get_config ----------

# ---- group: EDIT PICK AND PLACE LOCATION
cluster_2 = Cluster(geometry=rotate.Geometry, plane=rotate.Geometry, amplitude=number_slider)

# ----
# Stick Holder Mesh
mesh_6 = Mesh([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])

# ----
# Table Mesh
mesh_7 = Mesh(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)

planner_id = ValueList({"TRRT": 'TRRT', "RRT": 'RRT', "RRT*": 'RRT*', "Lazy RRT": 'Lazy RRT'}, selected="TRRT")

# ----
# place and approach place configs
merge = Merge()

ghpython_script_9 = GhPythonScript(x=merge)  # -> out, config_degrees; inputs x: list
# ---------- ghpython_script_9: Python ----------
import math
from ghpythonlib import treehelpers


config_degrees = []

for i in x:
    temp = []
    i = i.joint_values
    print(i)
    for j in i:
        degrees = math.degrees(j)
        temp.append(degrees)
    config_degrees.append(temp)

config_degrees = treehelpers.list_to_tree(config_degrees)
# ---------- end ghpython_script_9 ----------
panel_28 = Panel(ghpython_script_9.config_degrees)

# ----
# current_config
data_4 = Data(get_config.config)

# ----
# Visualization
panel_29 = Panel("")

# ----
# Additional Robotic Control
# Toggle freedrive to move robot
boolean_toggle_2 = BooleanToggle(False)
toggle_freedrive = GhPythonScript(ip=panel_13, start_teach_mode=boolean_toggle_2, stop_teach_mode=Toggle(True))  # -> a
# ---------- toggle_freedrive: Python ----------
import os
import math

from compas.rpc import Proxy
package_path = ghdoc.Path
path = os.path.abspath(os.path.join(package_path,"../../../cdf_unity/src/cdf_unity/robot"))

if start_teach_mode:   
    canvas = ghenv.Component.OnPingDocument()
#    path = os.path.abspath(os.path.dirname(canvas.FilePath))
    rtde = Proxy('fabrication', path=path)                         # stay in teach moded(freedrive) as long as this is True
    a = rtde.start_teach_mode(ip=ip)            # send message to robot
    ghenv.Component.Message = "Freedrive on"    # display message on GH component

if stop_teach_mode:   
    canvas = ghenv.Component.OnPingDocument()
    print (path)
    rtde = Proxy('fabrication', path=path)                          # stop teach mode if stop button pressed
    a = rtde.stop_teach_mode(ip=ip)             # send message to robot   
    ghenv.Component.Message = "Freedrive off"   # display message on GH component
# ---------- end toggle_freedrive ----------

# ----
# Current_config
robot = Data(get_config.config)

# ----
# Send single target using UR RTDE
button_4 = Button()
move_to_target = GhPythonScript(speed=Slider(0.3, range=0..2), accel=Slider(0.1, range=0..3.14), send=button_4, ip=panel_13)  # -> a
# ---------- move_to_target: Python ----------
import os
import math
from compas.rpc import Proxy

package_path = ghdoc.Path

if send:
    if not frame:
        ghenv.Component.Message = "No frame to move to!"
    else:
        canvas = ghenv.Component.OnPingDocument()
        path = os.path.abspath(os.path.join(package_path,"../../../cdf_unity/src/cdf_unity/robot"))
        rtde = Proxy('fabrication', path=path)
        radius = 0.1
        a = rtde.move_to_target(frame, speed, accel, radius, ip=ip)
        ghenv.Component.Message = "Sent frame"
# ---------- end move_to_target ----------

# ----
# Send to a config using UR RTDE
number_slider_3 = Slider(0.1, range=0..3.14)
move_to_config = GhPythonScript(speed=Slider(0.24, range=0..2), accel=number_slider_3, send=Button(), ip=panel_13)  # -> a
# ---------- move_to_config: Python ----------
import os
import math

from compas.rpc import Proxy
package_path = ghdoc.Path

if send:
    if not config:
        ghenv.Component.Message = "No config to move to!"
    else:
        canvas = ghenv.Component.OnPingDocument()
        path = os.path.abspath(os.path.join(package_path,"../../../cdf_unity/src/cdf_unity/robot"))
        rtde = Proxy('fabrication', path=path)
        nowait = True
        a = rtde.move_to_joints(config, speed, accel, nowait, ip=ip)
        ghenv.Component.Message = "Sent config"
# ---------- end move_to_config ----------

# ----
# Ping Robot
ping = Button()
py_2 = PythonScript(ip=panel_13, ping=ping)  # -> out, trigger
# ---------- py_2: Python ----------
from scriptcontext import sticky as st
from ur_fabrication_control.direct_control.utilities import is_available

guid = str(ghenv.Component.InstanceGuid)
txt_key = "txt_" + guid
if txt_key not in st:
    st[txt_key] = ""

if ping:
    
    available = is_available(ip)
    
    if available:
        st[txt_key] = "%s is up!" % ip
        trigger = True
    else:
        st[txt_key] = "%s is down!" % ip
        trigger = False

print(st[txt_key])
# ---------- end py_2 ----------
panel_30 = Panel(py_2.out)

# ----
# Define a custom configuration.
number_slider_4 = Slider(0, range=-3.14..3.14)
# Load Robot Attach Custom Tool
number_slider_5 = Slider(0, range=-3.14..3.14)

# ----
# 1. Load robot from ROS
load_robot = BooleanToggle(True)
connect = BooleanToggle(True)

ros = ROSConnect(connect=connect)  # -> ros_client, is_connected; inputs port: Int32, connect: Boolean
#   port ip: The ip address ROS. Defaults to 127.0.0.1.
#   port port: The port of ROS. Defaults to 9090.
#   port connect: If True, connects to ROS. If False, disconnects from ROS. Defaults to False.
#   port ros_client: The ROS client.
#   port is_connected: True if connection established.
# ---------- ros: Python ----------
"""
Connect or disconnect to ROS.

COMPAS FAB v0.27.0
"""
from ghpythonlib.componentbase import executingcomponent as component
from scriptcontext import sticky as st

from compas_fab.backends import RosClient
from compas_fab.ghpython.components import create_id


class ROSConnect(component):
    def RunScript(self, ip, port, connect):
        ros_client = None

        ip = ip or '127.0.0.1'
        port = port or 9090

        key = create_id(self, 'ros_client')
        ros_client = st.get(key, None)

        if ros_client:
            st[key].close()
        if connect:
            st[key] = RosClient(ip, port)
            st[key].run(5)

        ros_client = st.get(key, None)
        is_connected = ros_client.is_connected if ros_client else False
        return (ros_client, is_connected)
# ---------- end ros ----------

robot_2 = ROSRobot(ros_client=ros.ros_client, load=load_robot)  # -> robot; inputs load: Boolean
#   port ros_client: The ROS client.
#   port load: If True, loads the robot from ROS. Defaults to False.
# ---------- robot_2: Python ----------
"""
Load robot directly from ROS.

COMPAS FAB v0.27.0
"""
from compas_ghpython.artists import RobotModelArtist
from ghpythonlib.componentbase import executingcomponent as component
from scriptcontext import sticky as st

from compas_fab.ghpython.components import create_id


class ROSRobot(component):
    def RunScript(self, ros_client, load):
        key = create_id(self, 'robot')

        if ros_client and ros_client.is_connected and load:
            # Load URDF from ROS
            st[key] = ros_client.load_robot(load_geometry=True, precision='12f')
            st[key].artist = RobotModelArtist(st[key].model)

        robot = st.get(key, None)
        if robot:  # client sometimes need to be restarted, without needing to reload geometry
            robot.client = ros_client
        return robot
# ---------- end robot_2 ----------
robot_3 = Data(robot_2)

zero_config = ZeroConfig(robot=robot_2)  # -> config
#   port group: If assigned, it will return the zero configuration for the given group, otherwise a full zero configuration.
#   port config: The zero configuration.
# ---------- zero_config: Python ----------
"""
Get a zero configuration for a robot.

COMPAS FAB v0.28.0
"""
from ghpythonlib.componentbase import executingcomponent as component


class ConfigZero(component):
    def RunScript(self, robot, group):
        if robot:
            return robot.zero_configuration(group)

        return None
# ---------- end zero_config ----------
ghpython_script_10 = GhPythonScript(
    x=zero_config,
    y=number_slider_4,
    z=Slider(0, range=-3.14..3.14),
    u=Slider(0, range=-3.14..3.14),
    v=Slider(0, range=-3.14..3.14),
    w=Slider(0, range=-3.14..3.14),
    s=number_slider_5)  # -> out, a
# ---------- ghpython_script_10: Python ----------
from copy import deepcopy
a = deepcopy(x)
a.joint_values = [y,z,u,v,w,s]
# ---------- end ghpython_script_10 ----------

# ----
# Robot
robot_4 = Data(robot_3)

# ----
# Stick Holder
mesh_8 = Mesh([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])
table = GhPythonScript(robot=robot_4, meshes=mesh_8)  # inputs meshes: list of Mesh; disabled
# ---------- table: Python ----------
from compas_fab.robots import PlanningScene
from compas_fab.robots import CollisionMesh
from compas_rhino.conversions import RhinoMesh

if robot:
    scene = PlanningScene(robot)
    for mesh in meshes:
        mesh = RhinoMesh.from_geometry(mesh).to_compas()
        cm = CollisionMesh(mesh, "stick holder")
        scene.append_collision_mesh(cm)
# ---------- end table ----------

# ----
# Table Mesh
mesh_9 = Mesh(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)
table_2 = GhPythonScript(robot=robot_4, mesh=mesh_9)  # inputs mesh: Mesh
# ---------- table_2: Python ----------
from compas_fab.robots import PlanningScene
from compas_fab.robots import CollisionMesh
from compas_rhino.conversions import RhinoMesh

if robot:
    scene = PlanningScene(robot)
    mesh = RhinoMesh.from_geometry(mesh).to_compas()
    cm = CollisionMesh(mesh, "table")
    scene.add_collision_mesh(cm)
# ---------- end table_2 ----------

# ----
# 2. Attach tool and Additional Collision Meshes
attached_tool = AttachedTool(robot=robot_4, visual_mesh=mesh_4, collision_mesh=mesh_5, tcf_plane=plane_3)  # -> robot; inputs visual_mesh: Mesh, collision_mesh: Mesh
#   port visual_mesh: A visual mesh for the tool.
#   port collision_mesh: A collision mesh for the tool.
#   port tcf_plane: The frame of the tool in tool0 frame.
#   port group: The planning group to which the tool should be attached.
# ---------- attached_tool: Python ----------
"""
Attach a tool to the robot.

COMPAS FAB v0.27.0
"""
from ghpythonlib.componentbase import executingcomponent as component
from compas_rhino.conversions import RhinoMesh
from compas_rhino.conversions import plane_to_compas_frame

from compas.geometry import Frame
from compas_fab.robots import Tool


class AttachToolComponent(component):
    def RunScript(self, robot, visual_mesh, collision_mesh, tcf_plane, group):
        if robot and robot.client and robot.client.is_connected and visual_mesh:
            if not collision_mesh:
                collision_mesh = visual_mesh

            c_visual_mesh = RhinoMesh.from_geometry(visual_mesh).to_compas()
            c_collision_mesh = RhinoMesh.from_geometry(collision_mesh).to_compas()

            if not tcf_plane:
                frame = Frame.worldXY()
            else:
                frame = plane_to_compas_frame(tcf_plane)
            tool = Tool(c_visual_mesh, frame, c_collision_mesh)

            robot.attach_tool(tool, group)

        return robot
# ---------- end attached_tool ----------
robot_5 = Data(attached_tool)

# ----
# Transform component
ghpython_script_11 = GhPythonScript(robot=robot_5, measured_plane=plane_6, model_plane=ghpython_script_7.selected_plane)  # -> out, RCFtoWCF, WCFtoRCF, base_frame; inputs measured_plane: Plane, model_plane: Plane
# ---------- ghpython_script_11: Python ----------
from compas.geometry import Transformation
from compas.geometry import Frame
from compas_rhino.conversions import plane_to_compas_frame
from compas_rhino.conversions import xform_to_rhino
from Rhino.Geometry import Transform
from compas.artists import Artist

#Convert to compas frames
measured_frame = plane_to_compas_frame(measured_plane)
model_frame = plane_to_compas_frame(model_plane)

#Transform from model frame to measured frame
t_WCFtoRCF = Transformation.from_frame_to_frame(model_frame, measured_frame)
t_RCFtoWCF = t_WCFtoRCF.inverse()

#Convert to rhino
RCFtoWCF = xform_to_rhino(t_RCFtoWCF)
WCFtoRCF = xform_to_rhino(t_WCFtoRCF)

if robot:
    configuration = robot.zero_configuration()
    compas_frames = robot.transformed_frames(configuration, group)
    base_compas_frame = compas_frames[0]
    print base_compas_frame
    print t_RCFtoWCF
    base_compas_frame.transform(t_RCFtoWCF)
    artist = Artist(base_compas_frame)
    base_frame = artist.draw()
# ---------- end ghpython_script_11 ----------

# ----
# Base & Feet
transform = Transform(Geometry=geometry_2, Transform=ghpython_script_11.WCFtoRCF)

# ----
# Robot
data_dam = DataDam(DataDataA=robot_5, BufferDelay=10000000, BufferMode=0)
# Solve Pick IK & Plan Pick Trajectory
robot_6 = Data(data_dam)

# ----
# Solve Place IK
boolean_toggle_3 = BooleanToggle(True)
plan_pickup = GhPythonScript(
    robot=robot_6,
    start_configuration=get_config.config,
    pick_plane=cluster_2,
    approach_distance=Slider(0.5, range=0..1),
    table_mesh=mesh_7,
    update=Button(),
    compute=boolean_toggle_3)  # -> pick_config, pick_trajectory, pick_trajectory_frames, approach_pick_config; inputs pick_plane: Plane, table_mesh: Mesh
# ---------- plan_pickup: Python ----------
"""
Calculate pickup of a part.
"""
from ghpythonlib.componentbase import executingcomponent as component
from scriptcontext import sticky as st

from compas.artists import Artist
from compas.geometry import Frame
from compas.geometry import Transformation
from compas.geometry import scale_vector, add_vectors
from compas_rhino.conversions import RhinoPlane
from compas_fab.robots import CollisionMesh
from compas_rhino.conversions import RhinoMesh

from compas_fab.ghpython.components import create_id
from compas_rhino.conversions import plane_to_compas_frame
from compas_fab.robots import PlanningScene

class PickPart(component):
    def RunScript(self, robot, group, start_configuration, pick_plane, approach_distance, table_mesh, update, compute):
        self.Message = ""

        pick_config = None
        approach_pick_config = None
        pick_trajectory = None
        pick_trajectory_frames = []
        pick_frame = plane_to_compas_frame(pick_plane)

        if not start_configuration or not pick_plane:
            self.Message = "No approach or current configs defined"
            return pick_config, pick_trajectory, pick_trajectory_frames, approach_pick_config

        approach_pick_frame = pick_frame.copy()
        
        if approach_distance > 0:
                frame_normal = approach_pick_frame.normal
                frame_normal_scaled = scale_vector(frame_normal, approach_distance)
                new_frame_origin = add_vectors(approach_pick_frame.point, frame_normal_scaled)
                approach_pick_frame = Frame(new_frame_origin, approach_pick_frame.xaxis, approach_pick_frame.yaxis)

        if (update or not pick_config or not approach_pick_config) and robot and robot.client and robot.client.is_connected:
            scene = PlanningScene(robot)
            mesh = RhinoMesh.from_geometry(table_mesh).to_compas()
            cm = CollisionMesh(mesh, "table")
            scene.add_collision_mesh(cm)
    #            scene.remove_collision_mesh("sticks")
            
            pick_config = robot.inverse_kinematics(pick_frame, start_configuration, group)
            approach_pick_config = robot.inverse_kinematics(approach_pick_frame, pick_config, group)
        
        self.Message = "Found pick up configurations\nusing {:.2f}m approach distance".format(approach_distance)



        # Compute PICK trajectory
        if compute and robot and robot.client and robot.client.is_connected:
            max_step = 0.2
            frames = [
                       robot.forward_kinematics(c, group, options=dict(solver='model'))
                       for c in (approach_pick_config, pick_config)
                     ]

            trajectory = robot.plan_cartesian_motion(frames,
                                                     start_configuration=approach_pick_config,
                                                     group=group,
                                                     options=dict(
                                                         max_step=max_step,
                                                     ))
            if trajectory.fraction < 1:
                raise Exception("Incomplete cartesian trajectory found. Only {:.1f}% of the trajectory could be planned".format(trajectory.fraction * 100))

            # Only assign if trajectory is greater then 1
            pick_trajectory = trajectory

        if pick_trajectory:
            for c in pick_trajectory.points:
                frame = robot.forward_kinematics(c, group, options=dict(solver='model'))
                pick_trajectory_frames.append(Artist(frame).draw())
        
        if pick_trajectory:
            self.Message = "Found all trajectories ({} points)".format(len(pick_trajectory.points))

        return pick_config, pick_trajectory, pick_trajectory_frames, approach_pick_config
# ---------- end plan_pickup ----------

# ----
# Read Configs as degrees
# Current, pick, and approach configs
merge_2 = Merge(Data2=plan_pickup.pick_config, Data3=plan_pickup.approach_pick_config)

# ----
# Pick Trajectory
merge_3 = GhPythonScript(pick_trajectory=plan_pickup.pick_trajectory)  # -> trajectory
# ---------- merge_3: Python ----------
if pick_trajectory:
    trajectory = pick_trajectory.points
# ---------- end merge_3 ----------
trajectory = Data(merge_3)

# ----
# pick_config
pickup_config = Data(plan_pickup.pick_config)

# ----
# approach_pick_config
approach_pickup_config = Data(plan_pickup.approach_pick_config)

# ----
# Pick Config
pickup_config_2 = Data(pickup_config)

# ----
# Approach Pick Config
approach_pickup_config_2 = Data(plan_pickup.approach_pick_config)

# ----
# Get current config and EE Frame
button_5 = Button()
get_config_2 = GhPythonScript(robot=robot_6, send=button_5, ip=panel_13)  # -> config, frame, a
# ---------- get_config_2: Python ----------
import os
from scriptcontext import sticky as st
#sticky is a persistent dictionary which can save values and also be acessed by other GH components
#we use it here with a custom key to store values we read from the robot
from compas.rpc import Proxy
package_path = ghdoc.Path

config_key = 'config_{}'.format(str(ghenv.Component.InstanceGuid))
new_key = 'new_key_{}'.format(str(ghenv.Component.InstanceGuid))
frame_key = 'frame_{}'.format(str(ghenv.Component.InstanceGuid))

if config_key not in st:
    st[config_key] = None

if send:
    canvas = ghenv.Component.OnPingDocument()
    path = os.path.abspath(os.path.join(package_path,"../../../cdf_unity/src/cdf_unity/robot"))
    print (path)
    rtde = Proxy('fabrication', path=path)
    
    st[config_key] = rtde.get_config(ip=ip)
    st[new_key] = rtde.get_config(ip=ip)
    st[frame_key] = robot.forward_kinematics(st[config_key], group, options=dict(solver='model'))
#    a = rtde.get_config(ip=ip)
config = st[config_key]
frame = st[frame_key]
# ---------- end get_config_2 ----------
draw_4 = Draw(cg=get_config_2.frame)  # -> rg; same code as draw

panel_31 = Panel(get_config_2.config)

# ----
# Internalize Trajectory and Config Data without Issues
# Feed the configs here:
# (configs = trajectory.points)
ghpython_script_12 = GhPythonScript(configs=pickup_config)  # -> configs_data; inputs configs: list
# ---------- ghpython_script_12: Python ----------
import json

configs_data =[]

for c in configs:
    data = c.to_data()
    d = json.dumps(data)
    configs_data.append(d)
# ---------- end ghpython_script_12 ----------

# ----
# Stick Holder Back
transform_2 = Transform(Geometry=geometry_4, Transform=ghpython_script_11.RCFtoWCF)

# ----
# Stick Holder Side
transform_3 = Transform(Geometry=geometry_5, Transform=ghpython_script_11.RCFtoWCF)

# ----
# Internalize this:
data_5 = Data(ghpython_script_12)

ghpython_script_13 = GhPythonScript(c=data_5)  # -> configs; inputs c: list
# ---------- ghpython_script_13: Python ----------
import json
import compas_fab.robots

configs =[]

for i in c:
    data = json.loads(i)
    conf = compas_fab.robots.JointTrajectoryPoint.from_data(data)
    configs.append(conf)
# ---------- end ghpython_script_13 ----------

# ----
# COLLISION MESH INSTATNTIATION
cluster_3 = Cluster_2(radius=radius, data=length)
cluster_4 = Cluster_2(radius=radius_2, data=length_2)
cluster_5 = Cluster_2(radius=radius_3, data=length_3)

# ----
# Geometry for Collision 80
mesh_10 = Mesh(cluster_3)

# ----
# Geometry for Collision 70
mesh_11 = Mesh(cluster_4)

# ----
# Geometry for Collision 60
mesh_12 = Mesh(cluster_5)

merge_4 = Merge(Data2=mesh_12, Data3=mesh_11, Data4=mesh_10)

# ----
# Import and make frames and geometry from JSON
ghpython_script_14 = GhPythonScript(json=data_2, current_stick_index=currentstick, radius=radius_4, lengths=panel_24, collision_meshes=merge_4)  # -> out, current_stick_plane, planes, built_sticks, unbuilt_sticks, human_robot, sticks_cm, current_stick_type; inputs current_stick_index: Int32, lengths: list, collision_meshes: list of Mesh
# ---------- ghpython_script_14: Python ----------
import compas.geometry
from compas.geometry import Vector
from compas.geometry import scale_vector, add_vectors
from compas import json_load
from compas_rhino.conversions import RhinoMesh
from compas_rhino.conversions import cylinder_to_rhino
from compas.artists import Artist

def offset_frame(frame, length):
    
    offset_frame = frame.copy()
    
    if length > 0:
        frame_normal = offset_frame.normal
        frame_normal_scaled = scale_vector(frame_normal, length)
        new_frame_origin = add_vectors(offset_frame.point, frame_normal_scaled)
        offset_frame = compas.geometry.Frame(new_frame_origin, offset_frame.xaxis, offset_frame.yaxis)
        
    return offset_frame

planes=[]
built_sticks = []
unbuilt_sticks = []
sticks_cm = []
human_robot = []

length = len(json)

for i in range(length-1):
    point = json[str(i)]['element']['frame']['point']
    xaxis = json[str(i)]['element']['frame']['xaxis']
    yaxis = json[str(i)]['element']['frame']['yaxis']
    zaxis = Vector.cross(Vector(xaxis[0],xaxis[1], xaxis[2]), Vector(yaxis[0], yaxis[1], yaxis[2]))
    frame = compas.geometry.Frame(point, xaxis, yaxis)
    plane = Artist(frame).draw()
    planes.append(plane)
    status = json[str(i)]["is_built"]
    builder = json[str(i)]["placed_by"]
    stick_type = json[str(i)]["type"]
    
    instance_frame = compas.geometry.Frame(point, zaxis, yaxis)
    cylinder_frame = offset_frame(instance_frame, ((lengths[stick_type]/2)*-1))
    #print lengths[stick_type]
    circle = compas.geometry.Circle(compas.geometry.Plane.from_frame(instance_frame), radius)
    compas_stick = compas.geometry.Cylinder(circle, lengths[stick_type])
    stick = cylinder_to_rhino(compas_stick)
    
    stick_cm = collision_meshes[stick_type]
    compas_mesh = RhinoMesh.from_geometry(stick_cm).to_compas()
    #print (compas_mesh)
    world_frame = compas.geometry.Frame.worldXY()
    transformation = compas.geometry.Transformation.from_frame_to_frame(world_frame, frame)
    stick_cm = compas_mesh.transformed(transformation)
    stick_cm = Artist(stick_cm).draw()
    #print (stick_cm)
    
    if i == current_stick_index:
        current_stick_plane = plane
        current_stick_type = stick_type
    
    if status:
        sticks_cm.append(stick_cm)
        built_sticks.append(stick)
        
    else:
        unbuilt_sticks.append(stick)
        
        if builder == "human" :
            human_robot.append(True)
        else:
            human_robot.append(False)
# ---------- end ghpython_script_14 ----------

geo = Geometry(ghpython_script_14.unbuilt_sticks)
dispatch = Dispatch(List=geo, DispatchPattern=ghpython_script_14.human_robot)  # -> ListA, ListB

# ----
# Unbuilt_human
colour_swatch_2 = ColourSwatch(SwatchColor=RGBA(253, 255, 0, 154))
custom_preview_2 = CustomPreview(Geometry=dispatch.ListA, Material=colour_swatch_2)

# ----
# Unbuilt_robot
colour_swatch_3 = ColourSwatch(SwatchColor=RGBA(0, 255, 255, 111))
custom_preview_3 = CustomPreview(Geometry=dispatch.ListB, Material=colour_swatch_3)

# ----
# Built_Collision
colour_swatch_4 = ColourSwatch(SwatchColor=RGBA(94, 94, 94, 27))
custom_preview_4 = CustomPreview(Geometry=ghpython_script_14.sticks_cm, Material=colour_swatch_4)

# ----
# All Elements
# indices
deconstruct_plane = DeconstructPlane(Plane=ghpython_script_14.planes)  # -> Origin, XAxis, YAxis, ZAxis
point_list = PointList(Points=deconstruct_plane.Origin, Size=Slider(0.03, range=0..1))

# ----
# Built
colour_swatch_5 = ColourSwatch(SwatchColor=RGBA(94, 94, 94, 226))
custom_preview_5 = CustomPreview(Geometry=ghpython_script_14.built_sticks, Material=colour_swatch_5)

# ----
# Current_stick_plane
plane_7 = Plane(ghpython_script_14.current_stick_plane)
ghpython_script_15 = GhPythonScript(plane=plane_7)  # -> out, adjusted_plane; inputs plane: Plane
# ---------- ghpython_script_15: Python ----------
import Rhino.Geometry as rg
import math

world_z_vector = rg.Vector3d.ZAxis

plane_x_axis = plane.XAxis

#Dot Product comparison
dot_product = rg.Vector3d.Multiply(world_z_vector, plane_x_axis)


if dot_product > 0:
    adjusted_plane = plane

else:
    angle = math.radians(180)
    rotation_axis = plane.ZAxis
    rotated_plane = plane.Clone()
    rotated_plane.Rotate(angle, rotation_axis, plane.Origin)
    adjusted_plane = rotated_plane
# ---------- end ghpython_script_15 ----------

# ----
# Unbuilt Geometry
transform_4 = Transform(Geometry=ghpython_script_14.unbuilt_sticks, Transform=ghpython_script_11.WCFtoRCF)

# ----
# Transform Design from:
# WCF to RCF space
# Design Transformed
# Place Plane
transform_5 = Transform(Geometry=ghpython_script_15.adjusted_plane, Transform=ghpython_script_11.WCFtoRCF)

# ----
# Built Geometry
transform_6 = Transform(Geometry=ghpython_script_14.built_sticks, Transform=ghpython_script_11.WCFtoRCF)

# ----
# Built Geometry:
# Collision Meshes
transform_7 = Transform(Geometry=ghpython_script_14.sticks_cm, Transform=ghpython_script_11.WCFtoRCF)

# ----
# Place Plane
plane_8 = Plane(transform_5)

# ----
# New Stick CM
orient = Orient(Geometry=mesh_12, Source=PlaneXY(0, 0, 0), Target=cluster)  # -> Geometry, Transform
mesh_13 = Mesh(orient.Geometry)

# ---- group: EDIT PICK AND PLACE LOCATION
cluster_6 = Cluster(geometry=plane_8, plane=plane_8, amplitude=number_slider)

# ----
place_approach = Slider(0.1, range=0..1)
ghpython_script_16 = GhPythonScript(
    robot=robot_6,
    approach_pick_config=plan_pickup.approach_pick_config,
    place_plane=cluster_6,
    sticks_cm=transform_7,
    table_cm=mesh_7,
    approach_distance=place_approach,
    update=ghpython_script_5.place_config_update)  # -> place_config, approach_place_config; inputs place_plane: Plane, sticks_cm: list of Mesh, table_cm: Mesh, update: Boolean
# ---------- ghpython_script_16: Python ----------
import math
from ghpythonlib.componentbase import executingcomponent as component
from scriptcontext import sticky as st

from compas.artists import Artist
from compas.geometry import Frame
from compas.geometry import Transformation
from compas_rhino.conversions import RhinoPlane
from compas_rhino.conversions import RhinoMesh
from compas.geometry import scale_vector, add_vectors
from compas_fab.ghpython.components import create_id
from compas_fab.robots import AttachedCollisionMesh
from compas_rhino.conversions import plane_to_compas_frame
from compas_fab.robots import CollisionMesh
from compas_fab.robots import PlanningScene

class MyComponent(component):
    
    def RunScript(self, robot, group, approach_pick_config, place_plane, sticks_cm, table_cm, approach_distance, update):
        
        
        place_config = None
        approach_place_config = None
        place_frame = plane_to_compas_frame(place_plane)
        
        if not approach_pick_config or not place_frame:
            self.Message = "No approach config or place config or approach place config defined"
            return place_config, approach_place_config
        
        
        # Clean scene
        if (update or not place_config or not approach_place_config) and robot and robot.client and robot.client.is_connected:
            scene = PlanningScene(robot)
            scene.remove_collision_mesh("sticks")
            #Remove attached collision mesh?
            scene.remove_collision_mesh("attachedstick")
            scene.reset()

            #Add Stick Collision Meshes Again
            for mesh in sticks_cm:
                mesh = RhinoMesh.from_geometry(table_cm).to_compas()
                stick_cm = CollisionMesh(mesh, "sticks")
                scene.append_collision_mesh(stick_cm)
            
            #Add Table Collision Mesh Again
            table_compas_mesh = RhinoMesh.from_geometry(table_cm).to_compas()
            table_cm = CollisionMesh(table_compas_mesh, "table")
            scene.add_collision_mesh(table_cm)
            
         
        #Compute place config and approach place config
        if (update or not place_config or not approach_place_config) and robot and robot.client and robot.client.is_connected:
            scene = PlanningScene(robot)
            scene.remove_collision_mesh("sticks")

            approach_place_frame = self._offset_approach_frame(place_frame, approach_distance)
            
            approach_place_config = robot.inverse_kinematics(approach_place_frame, approach_pick_config, group)
            place_config = robot.inverse_kinematics(place_frame, approach_place_config, group)

        self.Message = "Found place configurations\nusing {:.2f}m approach distance".format(approach_distance)

        return place_config, approach_place_config
        
    def _offset_approach_frame(self, frame, approach_distance):
        
        frame = frame.copy()
        offset_frame = frame.copy()
            
        if approach_distance > 0:
            frame_normal = offset_frame.normal
            frame_normal_scaled = scale_vector(frame_normal, approach_distance)
            new_frame_origin = add_vectors(offset_frame.point, frame_normal_scaled)
            offset_frame = Frame(new_frame_origin, offset_frame.xaxis, offset_frame.yaxis)
        
        return offset_frame
# ---------- end ghpython_script_16 ----------

# ----
# COMMUNICATION: Place Config
# MQTT: Place and Approach
ghpython_script_17 = GhPythonScript(
    place_config=ghpython_script_16.place_config,
    approach_place_config=ghpython_script_16.approach_place_config,
    index=ghpython_script_5.index,
    robot_name=robot_name)  # -> out, message_MQTT; inputs index: Int32
# ---------- ghpython_script_17: Python ----------
if place_config == None or approach_place_config == None:
    message_MQTT = [{"result": False, "index": index, "robot_name" : robot_name}]
    ghenv.Component.Message = "Approach or Place Configs Are Null"

else:
    message_MQTT = [{"result": True, "index": index, "robot_name" : robot_name}]
    ghenv.Component.Message = "MQTT: Message Sent"

print "message = " , message_MQTT
# ---------- end ghpython_script_17 ----------
panel_32 = Panel(ghpython_script_17.out)

# ----
# ROS: Place and Approach
ghpython_script_18 = GhPythonScript(
    message_MQTT=ghpython_script_17.message_MQTT,
    place_config=ghpython_script_16.place_config,
    robot_base_plane=ghpython_script_11.base_frame,
    index=ghpython_script_5.index,
    robot_name=robot_name)  # -> out, message_ROS; inputs robot_base_plane: Plane, index: Int32
# ---------- ghpython_script_18: Python ----------
import json
import compas_fab.robots
message_result = message_MQTT["result"]


if message_result:
    
    #Make List from joint values
    joint_values = place_config.joint_values
    #    print joint_values
    
    
    #Turn Base Frame Elements in to lists
    point = list(robot_base_plane.Origin)
    xaxis = list(robot_base_plane.XAxis)
    yaxis = list(robot_base_plane.YAxis)
    
    #Make dictionary from Baseplane Elements
    robot_base_frame = {"point": point, "xaxis": xaxis, "yaxis": yaxis}
    
    message_ROS = [{"index": index, "robot_name": robot_name, "robot_base_frame": robot_base_frame, "joint_values": joint_values}]
    print "ROS Message is:", message_ROS
    ghenv.Component.Message = "ROS: Message Sent"

else:
    ghenv.Component.Message = "ROS: Message NOT Sent {MQTT: Message FAILED}"
# ---------- end ghpython_script_18 ----------
panel_33 = Panel(ghpython_script_18.out)

# ----
# Solve IK Solutions & Plan: Exit, Move to Pick, Move, and Place Trajectories
exit_dist = Slider(0.1, range=0..1)
plan_trajectories = GhPythonScript(
    robot=robot_6,
    current_config=get_config.config,
    approach_pick_config=plan_pickup.approach_pick_config,
    place_config=ghpython_script_16.place_config,
    approach_place_config=ghpython_script_16.approach_place_config,
    sticks_cm=transform_7,
    new_stick_cm=mesh_13,
    table_cm=mesh_7,
    calculate_topic_name=panel_6,
    planner_id=planner_id,
    approach_distance=exit_dist,
    compute=ghpython_script_4.calculate_trajectory)  # -> exit_trajectory, exit_trajectory_frames, exit_safe_config, move_to_pick_trajectory, move_to_pick_trajectory_frames, place_trajectory, place_trajectory_frames, move_trajectory, move_trajectory_frames; inputs sticks_cm: list of Mesh, new_stick_cm: Mesh, table_cm: Mesh, compute: Boolean
# ---------- plan_trajectories: Python ----------
"""
Calculate pickup trajectory of a part.
"""
import math
from ghpythonlib.componentbase import executingcomponent as component
from scriptcontext import sticky as st

from compas.artists import Artist
from compas.geometry import Frame
from compas.geometry import Transformation
from compas_rhino.conversions import RhinoPlane
from compas_rhino.conversions import RhinoMesh
from compas.geometry import scale_vector, add_vectors
from compas_fab.ghpython.components import create_id
from compas_fab.robots import AttachedCollisionMesh
from compas_rhino.conversions import plane_to_compas_frame
from compas_fab.robots import CollisionMesh
from compas_fab.robots import PlanningScene


class PlanPartPickupTrajectory(component):
    def RunScript(self, robot, group, current_config, approach_pick_config, place_config, approach_place_config, sticks_cm, new_stick_cm, table_cm, calculate_topic_name, planner_id, approach_distance, compute):
        self.Message = ""
        
        exit_trajectory = None
        move_to_pick_trajectory = None
        place_trajectory = None
        move_trajectory = None


        exit_trajectory_frames = []
        move_to_pick_trajectory_frames = []
        place_trajectory_frames = []
        move_trajectory_frames = []
        attached_collision_meshes = []

        exit_safe_config = None
        send_calculate_key = 'send_calculate_key' + calculate_topic_name

        planning_failure_key = 'planning_failure_key' + calculate_topic_name
        st[planning_failure_key] = False

        #CHECK IF STICKY IS FALSE, AND TURN IT BACK TO TRUE.
        if st[send_calculate_key] == False:
            self.Message = "A place config has not been selected yet"
            return exit_trajectory, exit_trajectory_frames, exit_safe_config, move_to_pick_trajectory, move_to_pick_trajectory_frames, place_trajectory, place_trajectory_frames, move_trajectory, move_trajectory_frames
        
        #Set calculate sticky to false
        st[send_calculate_key] = False
        
        
        if not approach_pick_config or not current_config or not place_config or not approach_place_config:
            self.Message = "A config is not defined"
            return exit_trajectory, exit_trajectory_frames, exit_safe_config, move_to_pick_trajectory, move_to_pick_trajectory_frames, place_trajectory, place_trajectory_frames, move_trajectory, move_trajectory_frames

        # Clean scene
        if compute and robot and robot.client and robot.client.is_connected:
            scene = PlanningScene(robot)
            scene.remove_collision_mesh("sticks")
            #Remove attached collision mesh?
            scene.remove_collision_mesh("attachedstick")
            scene.reset()

            #Add Stick Collision Meshes Again
            for mesh in sticks_cm:
                mesh = RhinoMesh.from_geometry(table_cm).to_compas()
                stick_cm = CollisionMesh(mesh, "sticks")
                scene.append_collision_mesh(stick_cm)
            
            #Add Table Collision Mesh Again
            table_compas_mesh = RhinoMesh.from_geometry(table_cm).to_compas()
            table_cm = CollisionMesh(table_compas_mesh, "table")
            scene.add_collision_mesh(table_cm)
            
    #            #Add Stick Holder Collision Meshes Again
    #            for mesh_holder in holder_cm:
    #                mesh_holder = RhinoMesh.from_geometry(mesh_holder).to_compas()
    #                holder_cm = CollisionMesh(mesh_holder, "stickholder")
    #                scene.append_collision_mesh(holder_cm)


        # Compute Exit safe configuration
        current_robot_frame = robot.forward_kinematics(current_config, group, options=dict(solver='model'))
        exit_safe_frame = self._offset_approach_frame(current_robot_frame, approach_distance)
        exit_safe_config = robot.inverse_kinematics(exit_safe_frame, current_config, group)


        #Compute Exit Trajectory
        if compute and robot and robot.client and robot.client.is_connected:
            
            max_step = 0.1
            frames = [
                       robot.forward_kinematics(c, group, options=dict(solver='model'))
                       for c in (current_config, exit_safe_config)
                     ]
            
            trajectory = robot.plan_cartesian_motion(frames,
                                                     start_configuration=current_config,
                                                     group=group,
                                                     options=dict(
                                                         max_step=max_step,
                                                         attached_collision_meshes = attached_collision_meshes
                                                     ))
            if trajectory.fraction < 1:
                st[send_calculate_key] = False
                st[planning_failure_key] = True
                raise Exception("Incomplete cartesian trajectory found for exit trajectory. Only {:.1f}% of the trajectory could be planned".format(trajectory.fraction * 100))

            # Only assign if fraction is full
            exit_trajectory = trajectory

        if exit_trajectory:
            for c in exit_trajectory.points:
                frame = robot.forward_kinematics(c, group, options=dict(solver='model'))
                exit_trajectory_frames.append(Artist(frame).draw())

        # INCLUDE EXCEPTION IN ORDER TO CHANGE THE BOOL PLANNING BOOL
        try:
            #Compute Move to Approach Pick config
            if compute and robot and robot.client and robot.client.is_connected:
                planner_id = planner_id or 'TRRT'
    
                tolerance_above = self._generate_default_tolerances(robot.get_configurable_joints(group))
                tolerance_below = self._generate_default_tolerances(robot.get_configurable_joints(group))
                goal_constraints = robot.constraints_from_configuration(
                    configuration=approach_pick_config,
                    tolerances_above=tolerance_above,
                    tolerances_below=tolerance_below,
                    group=group
                )
    
                move_to_pick_trajectory = robot.plan_motion(goal_constraints,
                                                                       start_configuration=exit_safe_config,
                                                                       group=group,
                                                                       options=dict(
                                                                           planner_id=planner_id,
                                                                           attached_collision_meshes=attached_collision_meshes
                                                                       ))
    
            move_to_pick_trajectory = move_to_pick_trajectory

            if move_to_pick_trajectory:
                for c in move_to_pick_trajectory.points:
                    frame = robot.forward_kinematics(c, group, options=dict(solver='model'))
                    move_to_pick_trajectory_frames.append(Artist(frame).draw())
        
        except Exception as e:
        # Handle the exception here, e.g., log it, raise a custom exception, etc.
            st[send_calculate_key] = False
            st[planning_failure_key] = True
            raise Exception("Move to pick trajectory planning failed".format(e))

        # Compute PLACE trajectory
        if compute and robot and robot.client and robot.client.is_connected:
            
            # Add New Stick CM on robot
            new_stick_compas_mesh = RhinoMesh.from_geometry(new_stick_cm).to_compas()
            cm = CollisionMesh(new_stick_compas_mesh, "attachedstick")
            ee_link_name = 'tool'
            acm = AttachedCollisionMesh(cm, ee_link_name) 
            attached_collision_meshes.append(acm)
            scene.attach_collision_mesh_to_robot_end_effector(cm)
            
            max_step = 0.10
            frames = [
                       robot.forward_kinematics(c, group, options=dict(solver='model'))
                       for c in (approach_place_config, place_config)
                     ]
            
            trajectory = robot.plan_cartesian_motion(frames,
                                                     start_configuration=approach_place_config,
                                                     group=group,
                                                     options=dict(
                                                         max_step=max_step,
                                                         attached_collision_meshes = attached_collision_meshes
                                                     ))
            if trajectory.fraction < 1:
                st[send_calculate_key] = False
                st[planning_failure_key] = True
                raise Exception("Incomplete cartesian trajectory found for place trajectory. Only {:.1f}% of the trajectory could be planned".format(trajectory.fraction * 100))

            # Only assign if fraction is full
            place_trajectory = trajectory

        if place_trajectory:
            for c in place_trajectory.points:
                frame = robot.forward_kinematics(c, group, options=dict(solver='model'))
                place_trajectory_frames.append(Artist(frame).draw())


        # INCLUDE EXCEPTION IN ORDER TO CHANGE THE SEND CALCULATE BOOL
        try:
            # Compute MOVE trajectory
            if compute and robot and robot.client and robot.client.is_connected:
                planner_id = planner_id or 'TRRT'
    
                # Add New Stick CM on robot
                new_stick_compas_mesh = RhinoMesh.from_geometry(new_stick_cm).to_compas()
                cm = CollisionMesh(new_stick_compas_mesh, "attachedstick")
                ee_link_name = 'tool'
                acm = AttachedCollisionMesh(cm, ee_link_name) 
                attached_collision_meshes.append(acm)
                scene.attach_collision_mesh_to_robot_end_effector(cm)
    
                tolerance_above = self._generate_default_tolerances(robot.get_configurable_joints(group))
                tolerance_below = self._generate_default_tolerances(robot.get_configurable_joints(group))
                goal_constraints = robot.constraints_from_configuration(
                    configuration=approach_place_config,
                    tolerances_above=tolerance_above,
                    tolerances_below=tolerance_below,
                    group=group
                )
    
                move_trajectory = robot.plan_motion(goal_constraints,
                                                                       start_configuration=approach_pick_config,
                                                                       group=group,
                                                                       options=dict(
                                                                           planner_id=planner_id,
                                                                           attached_collision_meshes=attached_collision_meshes
                                                                       ))
    
            move_trajectory = move_trajectory
    
            if move_trajectory:
                for c in move_trajectory.points:
                    frame = robot.forward_kinematics(c, group, options=dict(solver='model'))
                    move_trajectory_frames.append(Artist(frame).draw())

        except Exception as e:
        # Handle the exception here, e.g., log it, raise a custom exception, etc.
            st[send_calculate_key] = False
            st[planning_failure_key] = True
            raise Exception("Move trajectory planning failed".format(e))


        if exit_trajectory and move_to_pick_trajectory and place_trajectory and move_trajectory:
            self.Message = "Found all trajectories ({} points)".format(len(exit_trajectory.points) + len(move_to_pick_trajectory.points) + len(place_trajectory.points) + len(move_trajectory.points))

        return exit_trajectory, exit_trajectory_frames, exit_safe_config, move_to_pick_trajectory, move_to_pick_trajectory_frames,  place_trajectory, place_trajectory_frames, move_trajectory, move_trajectory_frames

    def _generate_default_tolerances(self, joints):
        DEFAULT_TOLERANCE_METERS = .001
        DEFAULT_TOLERANCE_RADIANS = math.radians(1)

        return [
            DEFAULT_TOLERANCE_METERS if j.is_scalable()
            else DEFAULT_TOLERANCE_RADIANS
            for j in joints
        ]
        
    def _offset_approach_frame(self, frame, approach_distance):
        
        frame = frame.copy()
        offset_frame = frame.copy()
            
        if approach_distance > 0:
            frame_normal = offset_frame.normal
            frame_normal_scaled = scale_vector(frame_normal, approach_distance)
            new_frame_origin = add_vectors(offset_frame.point, frame_normal_scaled)
            offset_frame = Frame(new_frame_origin, offset_frame.xaxis, offset_frame.yaxis)
        
        return offset_frame
# ---------- end plan_trajectories ----------

# ----
# PUB: Place Config
# >> Publisher MQTT
panel_34 = Panel("/caa_place_config_status/")
mqtt_publisher = MQTTPublisher(host=panel_3, topic_name=panel_34, msg=ghpython_script_17.message_MQTT)  # -> topic, is_advertised
# ---------- mqtt_publisher: Python ----------
import time

import json
from ghpythonlib.componentbase import executingcomponent as component
from scriptcontext import sticky as st

from threading import Event

from compas_eve import Message
from compas_eve import Publisher
from compas_eve import Subscriber
from compas_eve import Topic
from compas_eve import set_default_transport
from compas_eve.mqtt import MqttTransport

from compas_fab.ghpython.components import create_id

class MQTTTopicPublish(component):
    
    def RunScript(self, host, topic_name, msg):
        if not host:
            raise ValueError('Please specify host')
        if not topic_name:
            raise ValueError('Please specify the name of the topic')
            
        key = create_id(self, 'mqtt_topic'+ topic_name)
        topic = st.get(key, None)
        
        if host:
            tx = MqttTransport(host)
            if not topic:
                topic = Topic(topic_name, Message)
                time.sleep(0.2)

                st[key] = topic

        self.is_advertised = topic
        
        if msg :
            Publisher(topic, transport=tx).publish(Message(msg))
            self.Message = 'Message published'
        else:
            if self.is_advertised:
                self.Message = 'Topic advertised'
                
        return (topic, self.is_advertised)
# ---------- end mqtt_publisher ----------

# ----
# >>Publisher ROS
panel_35 = Panel("/caa_place_info")
# PUB: Trajectory
panel_36 = Panel("/std_msgs/String")
publish_to_topic = PublishToTopic(ros_client=ros.ros_client, topic_name=panel_35, topic_type=panel_36, msg=ghpython_script_18.message_ROS)  # -> topic, is_advertised
#   port ros_client: The ROS client.
#   port topic_name: Name of the topic to publish to, eg. /joint_states
#   port topic_type: Type of the topic to publish to, eg. sensor_msgs/JointState
#   port msg: The message to publish. It can be an instance of ROSMsg, a Python dict, or a JSON string.
#   port topic: The topic instance.
#   port is_advertised: Indicates if the topic is current advertised or not.
# ---------- publish_to_topic: Python ----------
"""
Publishes messages to a ROS topic

COMPAS FAB v0.27.0
"""
import time

import json
from ghpythonlib.componentbase import executingcomponent as component
from roslibpy import Topic
from scriptcontext import sticky as st

from compas_fab.backends.ros.messages import ROSmsg
from compas_fab.ghpython.components import create_id


class ROSTopicPublish(component):
    def RunScript(self, ros_client, topic_name, topic_type, msg):
        if not topic_name:
            raise ValueError('Please specify the name of the topic')
        if not topic_type:
            raise ValueError('Please specify the type of the topic')

        key = create_id(self, 'topic'+ topic_name)

        topic = st.get(key, None)

        if ros_client and ros_client.is_connected:
            if not topic or topic.ros != ros_client:
                topic = Topic(ros_client, topic_name, topic_type, reconnect_on_close=False)
                topic.advertise()
                time.sleep(0.2)

                st[key] = topic

        self.is_advertised = topic and topic.is_advertised

        if msg:
            topic.publish({"data": json.dumps(msg)})
            self.Message = 'Message published'
        else:
            if self.is_advertised:
                self.Message = 'Topic advertised'

        return (topic, self.is_advertised)
# ---------- end publish_to_topic ----------

# ----
# Subscriber
panel_37 = Panel("/std_msgs/String")
subscribe_to_topic = SubscribeToTopic(ros_client=ros.ros_client, topic_name=panel_35, topic_type=panel_37, start=Toggle(True))  # -> topic, last_msg, last_msg_data, is_subscribed; inputs interval: Int32, start: Boolean, stop: Boolean
#   port ros_client: The ROS client.
#   port topic_name: Name of the topic to subscribe to, eg. /joint_states
#   port topic_type: Type of the topic to subscribe to, eg. sensor_msgs/JointState
#   port interval: Interval in milliseconds at which to expire the solution to propagate received messages. Defaults to 25ms. Messages are not queued, so if the interval is greater than the rate at which messages are published, some messages will be dropped.
#   port start: Start receiving messages.
#   port stop: Stop receiving messages.
#   port topic: The subscribed topic instance.
#   port last_msg: The last received message.
#   port is_subscribed: Indicates if the topic is currently subscribed or not.
# ---------- subscribe_to_topic: Python ----------
"""
Subscribe to a ROS topic.

COMPAS FAB v0.27.0
"""
import time

import Grasshopper.Kernel
from ghpythonlib.componentbase import executingcomponent as component
from roslibpy import Topic
from scriptcontext import sticky as st

from compas_fab.backends.ros.messages import ROSmsg
from compas_fab.ghpython.components import create_id


class ROSTopicSubscribe(component):
    def RunScript(self, ros_client, topic_name, topic_type, interval, start, stop):
        if not topic_name:
            raise ValueError('Please specify the name of the topic')
        if not topic_type:
            raise ValueError('Please specify the type of the topic')

        if not hasattr(self, 'message_count'):
            self.message_count = 0

        self.interval = interval or 25  # in milliseconds
        self.is_updating = False
        self.is_subscribed = False

        self.msg_key = create_id(self, 'last_msg')
        key = create_id(self, 'topic'+ topic_name)

        last_msg = st.get(self.msg_key, None)
        topic = st.get(key, None)

        if ros_client and ros_client.is_connected:
            if start:
                self._unsubscribe(topic)

                topic = Topic(ros_client, topic_name, topic_type)
                topic.subscribe(self.topic_callback)
                time.sleep(0.2)

                st[key] = topic

            if stop:
                self._unsubscribe(topic)

        self.is_subscribed = topic and topic.is_subscribed
        
        last_msg_data= None
        if last_msg:
            if topic_type == "/std_msgs/String":
                last_msg_data = last_msg["data"]
            else:
                last_msg_data = "last_msg_data works only for topic type /std_msgs/String" 
            last_msg = ROSmsg.parse(last_msg, topic_type)

        if self.is_subscribed:
            self.Message = 'Subscribed, {} messages'.format(self.message_count)
        else:
            self.Message = 'Not subscribed'

        return (topic, last_msg, last_msg_data, self.is_subscribed)

    def _unsubscribe(self, topic):
        if topic and topic.is_subscribed:
            topic.unsubscribe()
            time.sleep(0.2)

    def topic_callback(self, msg):
        self.message_count += 1
        st[self.msg_key] = msg

        if self.is_subscribed:
            ghdoc = ghenv.Component.OnPingDocument()     # noqa: F821 This is defined by Grasshopper
            if not self.is_updating and ghdoc.SolutionState != Grasshopper.Kernel.GH_ProcessStep.Process:
                self.is_updating = True
                ghdoc.ScheduleSolution(
                    self.interval, Grasshopper.Kernel.GH_Document.GH_ScheduleDelegate(self.expire_callback))

    def expire_callback(self, ghdoc):
        if ghdoc.SolutionState != Grasshopper.Kernel.GH_ProcessStep.Process:
            ghenv.Component.ExpireSolution(False)        # noqa: F821 This is defined by Grasshopper
        self.is_updating = False
# ---------- end subscribe_to_topic ----------
last_msg_data = Panel(subscribe_to_topic.last_msg_data)

# ----
# Full Trajectory
merge_5 = GhPythonScript(
    exit_trajectory=plan_trajectories.exit_trajectory,
    move_to_pick_trajectory=plan_trajectories.move_to_pick_trajectory,
    pick_trajectory=plan_pickup.pick_trajectory,
    place_trajectory=plan_trajectories.place_trajectory,
    move_trajectory=plan_trajectories.move_trajectory)  # -> trajectory, start_of_place_path, message_bool
# ---------- merge_5: Python ----------
message_bool = True

if exit_trajectory and move_to_pick_trajectory and pick_trajectory and move_trajectory and place_trajectory:
    
    start_of_place_path = (len(exit_trajectory.points) + len(move_to_pick_trajectory.points) + len(pick_trajectory.points))
    
    trajectory = exit_trajectory.points + \
                 move_to_pick_trajectory.points + \
                 pick_trajectory.points + \
                 list(reversed(pick_trajectory.points)) + \
                 move_trajectory.points + \
                 place_trajectory.points

else:
    trajectory = None
    message_bool = False
# ---------- end merge_5 ----------
trajectory_2 = Data(merge_5.trajectory)

# ----
# COMMUNICATION: Trajectory
# MQTT: Place and Approach
ghpython_script_19 = GhPythonScript(
    trajectory=trajectory_2,
    message_bool=merge_5.message_bool,
    index=ghpython_script_5.index,
    robot_name=robot_name,
    calculate_topic_name=panel_6)  # -> out, message_MQTT; inputs trajectory: list, message_bool: Boolean, index: Int32
# ---------- ghpython_script_19: Python ----------
from scriptcontext import sticky as st

planning_failure_key = 'planning_failure_key' + calculate_topic_name

print st[planning_failure_key]

if st[planning_failure_key] == True:
    message_MQTT = [{"result": False, "index": index, "robot_name" : robot_name}]
    ghenv.Component.Message = "A planning sequence has failed"

elif trajectory.count == 0 or message_bool == False:
    ghenv.Component.Message = "No Message Should be Sent"

else:
    message_MQTT = [{"result": True, "index": index, "robot_name" : robot_name}]
    ghenv.Component.Message = "MQTT: Message Sent"

print "message = " , message_MQTT
# ---------- end ghpython_script_19 ----------
panel_38 = Panel(ghpython_script_19.out)

# ----
# ROS: Place and Approach
# Internalized
# exit_trajectory
# Internalized
# Internalized
# Internalized
# move_to_pick_trajectory
# Internalized
# Internalized
# pick_trajectory
# Internalized
# Internalized
# move_trajectory
# place_trajectory
# Internalized
# Internalized
ghpython_script_20 = GhPythonScript(
    message_MQTT=ghpython_script_19.message_MQTT,
    trajectory=trajectory_2,
    robot_base_plane=ghpython_script_11.base_frame,
    index=ghpython_script_5.index,
    start_of_place_path=merge_5.start_of_place_path,
    robot_name=robot_name)  # -> out, message_ROS; inputs trajectory: list, robot_base_plane: Plane, index: Int32, start_of_place_path: Int32
# ---------- ghpython_script_20: Python ----------
import json
import compas_fab.robots
message_result = message_MQTT["result"]


if message_result:
    #Make a dictionary of trajectory points
    trajectory_points = {}
    
    i = 0
    #Make_list of joints values
    for c in trajectory:
        trajectory_points[str(i)] = {"joint_values": c.joint_values}
        i += 1
    
#    print trajectory_points
    
    
    #Turn Base Frame Elements in to lists
    point = list(robot_base_plane.Origin)
    xaxis = list(robot_base_plane.XAxis)
    yaxis = list(robot_base_plane.YAxis)
    
    #Make dictionary from Baseplane Elements
    robot_base_frame = {"point": point, "xaxis": xaxis, "yaxis": yaxis}
    
    message_ROS = [{"index": index, "robot_name": robot_name, "robot_base_frame": robot_base_frame,"start_of_place_path": start_of_place_path, "trajectory_points": trajectory_points}]
    print "ROS Message is:", message_ROS
    ghenv.Component.Message = "ROS: Message Sent"

else:
    ghenv.Component.Message = "ROS: Message NOT Sent {MQTT: Message FAILED}"
# ---------- end ghpython_script_20 ----------
panel_39 = Panel(ghpython_script_20.out)

# ----
# >>Publisher ROS
panel_40 = Panel("/caa_trajectory_info")
publish_to_topic_2 = PublishToTopic(ros_client=ros.ros_client, topic_name=panel_40, topic_type="/std_msgs/String", msg=ghpython_script_20.message_ROS)  # -> topic, is_advertised; same code as publish_to_topic

# ----
# >> Publisher MQTT
panel_41 = Panel("/caa_planning_status/")
mqtt_publisher_2 = MQTTPublisher(host=panel_3, topic_name=panel_41, msg=ghpython_script_19.message_MQTT)  # -> topic, is_advertised; same code as mqtt_publisher

# ----
# Subscriber
panel_42 = Panel("/std_msgs/String")
subscribe_to_topic_2 = SubscribeToTopic(ros_client=ros.ros_client, topic_name=panel_40, topic_type=panel_42, start=Toggle(True))  # -> topic, last_msg, last_msg_data, is_subscribed; inputs interval: Int32, start: Boolean, stop: Boolean; same code as subscribe_to_topic
last_msg_data_2 = Panel(subscribe_to_topic_2.last_msg_data)

# ----
# >> Subscriber | Place
button_6 = Button()
mqtt_subscriber_4 = MQTTSubscriber(host=panel_3, topic=panel_41, reset=button_6)  # -> out, last_message; same code as mqtt_subscriber
panel_43 = Panel(mqtt_subscriber_4.out)

# ----
# SUB: For reference
# >> Subscriber | Place
button_7 = Button()
mqtt_subscriber_5 = MQTTSubscriber(host=panel_3, topic=panel_34, reset=button_7)  # -> out, last_message; same code as mqtt_subscriber
panel_44 = Panel(mqtt_subscriber_5.out)

# ----
# approach_place_config
approach_place_config = Data(ghpython_script_16.approach_place_config)

# ----
# exit_safe_config
trajectory_3 = Data(plan_trajectories.exit_safe_config)

# ----
# place_config
place_config = Data(ghpython_script_16.place_config)

# ----
# Pick and Place Routine
# Trajectory Compiling
merge_6 = GhPythonScript(
    exit_trajectory=plan_trajectories.exit_trajectory,
    move_to_pick_trajectory=plan_trajectories.move_to_pick_trajectory,
    pick_trajectory=plan_pickup.pick_trajectory,
    move_trajectory=plan_trajectories.move_trajectory,
    place_trajectory=plan_trajectories.place_trajectory)  # -> exit_trajectory_points, move_to_pick_trajectory_points, pick_trajectory_points, move_trajectory_points, place_trajectory_points, complete_trajectory
# ---------- merge_6: Python ----------
if exit_trajectory and move_to_pick_trajectory and pick_trajectory and move_trajectory and place_trajectory:
    complete_trajectory = exit_trajectory.points + \
                 move_to_pick_trajectory.points + \
                 pick_trajectory.points + \
                 list(reversed(pick_trajectory.points)) + \
                 move_trajectory.points + \
                 place_trajectory.points

    exit_trajectory_points = exit_trajectory.points
    
    move_to_pick_trajectory_points = move_to_pick_trajectory.points
    
    pick_trajectory_points = pick_trajectory.points
    
    move_trajectory_points = move_trajectory.points
    
    place_trajectory_points = place_trajectory.points
# ---------- end merge_6 ----------

# ----
# Place Config
place_config_2 = Data(place_config)

# ----
# Complete Trajectory
trajectory_4 = Data(trajectory_2)

# ----
# Approach Place Config
approach_place_config_2 = Data(approach_place_config)

# ----
# Exit Safe Config
approach_pickup_config_3 = Data(trajectory_3)

# ----
# Complete_Trajectory
trajectory_5 = Data(merge_6.complete_trajectory)

# ----
# exit_trajectory
data_6 = Data(merge_6.exit_trajectory_points)

# ----
# Exit Trajectory
trajectory_6 = Data(data_6)

# ----
# move_to_pick_trajectory
data_7 = Data(merge_6.move_to_pick_trajectory_points)

# ----
# Move to Pick Trajectory
trajectory_7 = Data(data_7)

# ----
# pick_trajectory
data_8 = Data(merge_6.pick_trajectory_points)

# ----
# Pick Trajectory
trajectory_8 = Data(data_8)

# ----
# move_trajectory
data_9 = Data(merge_6.move_trajectory_points)

# ----
# Move Trajectory
trajectory_9 = Data(data_9)

# ----
# place_trajectory
data_10 = Data(merge_6.place_trajectory_points)

# ----
# Place Trajectory
# Sending to UR
trajectory_10 = Data(data_10)

# ----
# All trajectories and configs
trajectories_and_configs = ValueList({"Current config": 0, "Exit Safe config": 1, "Approach pick config": 2, "Pick config": 3, "Approach Place config": 4, "Place Config": 5, "Full Trajectory": 6, "Exit Trajectory": 7, "Move to Pick Trajectory": 8, "Pick Trajectory": 9, "Move Trajectory": 10, "Place Trajectory": 11}, selected="Place Config")
stream_filter = StreamFilter(
    Gate=trajectories_and_configs,
    Stream0=robot,
    Stream1=approach_pickup_config_3,
    Stream2=approach_pickup_config_2,
    Stream3=pickup_config_2,
    Stream4=approach_place_config_2,
    Stream5=place_config_2,
    Stream6=trajectory_4,
    Stream7=trajectory_6,
    Stream8=trajectory_7,
    Stream9=trajectory_8,
    Stream10=trajectory_9,
    Stream11=trajectory_10)
list_item = ListItem(List=stream_filter, Index=Slider(0, range=0..200), Wrap=True)

# ----
# Send a Pick and Place Routine
button_8 = Button()
pick_and_place = GhPythonScript(
    exit_trajectory=data_6,
    move_to_pick_trajectory=data_7,
    pick_trajectory=data_8,
    move_trajectory=data_9,
    place_trajectory=data_10,
    speed=Slider(0.24, range=0..2),
    accel=Slider(0.1, range=0..3.14),
    radius=Slider(0.001, range=0..3.14),
    send=ghpython_script_3.send_trajectory,
    send_topic_name=panel_8,
    ip=panel_13)  # -> a; inputs exit_trajectory: list, move_to_pick_trajectory: list, pick_trajectory: list, move_trajectory: list, place_trajectory: list
# ---------- pick_and_place: Python ----------
import os
import math
import time
from scriptcontext import sticky as st
import Grasshopper.Kernel as gh
from compas.rpc import Proxy
from compas.geometry import Translation, Vector, Transformation, Frame

vaccum_io = 0
package_path = ghdoc.Path
send_trajectory_key = 'send_trajectory_key' + send_topic_name

#print send
print st[send_trajectory_key]

#Check if value is true and sticky of the value has been updated
if send and st[send_trajectory_key] == True:
    if not pick_trajectory: #if no frames provided, then display message
        ghenv.Component.Message = "No pick trajectory to move to!"
    
    if not move_trajectory: #if no frames provided, then display message
        ghenv.Component.Message = "No move trajectory to move to!"
    
    if not place_trajectory: #if no frames provided, then display message
        ghenv.Component.Message = "No place trajectory to move to!"
    
    else:
        
    #        canvas = ghenv.Component.OnPingDocument()
    #        path = os.path.abspath(os.path.join(package_path,"../../../cdf_unity/src/cdf_unity/robot"))
    #        rtde = Proxy('fabrication', path=path)   
    #        rtde.pick_and_place_sticks_trajectories(exit_trajectory, move_to_pick_trajectory, pick_trajectory, move_trajectory, place_trajectory, speed, accel, radius, ip, vaccum_io) 
    ##        rtde.pick_and_place_sticks_configs_trajectories(exit_safe_config, move_to_pick_trajectory, approach_pick_config, pick_config, move_trajectory, place_config, speed, accel, radius, ip, vaccum_io)
        st[send_trajectory_key] = False
        print st[send_trajectory_key]
        ghenv.Component.Message = "Sent frames" #display message on component
#        a = st['send_trajectory_key']

else:
            ghenv.Component.Message = "Send has not been received yet" #display message on component = "Send has not been received yet"
# ---------- end pick_and_place ----------

# ----
# Pick & Place Trajectory
merge_7 = Merge(
    Data1=plan_trajectories.exit_trajectory_frames,
    Data2=plan_trajectories.move_to_pick_trajectory_frames,
    Data3=plan_pickup.pick_trajectory_frames,
    Data4=plan_trajectories.move_trajectory_frames,
    Data5=plan_trajectories.place_trajectory_frames)
transform_8 = Transform(Geometry=merge_7, Transform=ghpython_script_11.RCFtoWCF)

# ----
# Sticks Along place
merge_8 = Merge(
    Data1=plan_pickup.pick_trajectory_frames,
    Data2=plan_trajectories.move_trajectory_frames,
    Data3=plan_trajectories.place_trajectory_frames)
transform_9 = Transform(Geometry=merge_8, Transform=ghpython_script_11.RCFtoWCF)
cluster_7 = Cluster(geometry=transform_9, plane=transform_9, amplitude=neg)
orient_2 = Orient(Source=PlaneXY(0, 0, 0), Target=cluster_7)  # -> Geometry, Transform

# ----
# Pick Plane
transform_10 = Transform(Geometry=cluster_6, Transform=ghpython_script_11.RCFtoWCF)

# ----
# Model Plane: Are you are Measuring a QR?
value_list_3 = ValueList({"QR Code 0": 0, "QR Code 1": 1, "QR Code 2": 2, "QR Code 3": 3, "QR Code 4": 4}, selected="QR Code 0")

# ----
# QR Data
data_11 = Data(read_2.realtime_json_data_QR)

# ----
# 2. Make frames from JSON Data
ghpython_script_21 = GhPythonScript(json=data_11)  # -> out, planes
# ---------- ghpython_script_21: Python ----------
import compas.geometry
from compas.geometry import Vector
from compas import json_load
from compas.artists import Artist

unbuilt_frames_human = []
unbuilt_frames_robot = []
unbuilt_frames = []
planes=[]
built_frames = []
length = len(json)

for i in range(length):
    point = json[str(i)]['point']
    quaternion = json[str(i)]['quaternion']
    xaxis = json[str(i)]['xaxis']
    yaxis = json[str(i)]['yaxis']
    zaxis = Vector.cross(Vector(yaxis[0], yaxis[1], yaxis[2]), Vector(xaxis[0],xaxis[1], xaxis[2]))
    frame = compas.geometry.Frame.from_quaternion(quaternion, point)
    plane = Artist(frame).draw()
    planes.append(plane)
# ---------- end ghpython_script_21 ----------

plane_9 = Plane(ghpython_script_21.planes)

plane_10 = Plane(plane_9)
ghpython_script_22 = GhPythonScript(selected_QR_index=value_list_3, model_planes=plane_10)  # -> out, selected_plane; inputs model_planes: list of Plane
# ---------- ghpython_script_22: Python ----------
import Rhino.Geometry as rg

if selected_QR_index == 0:
    selected_plane = model_planes[selected_QR_index]

elif selected_QR_index == 1:
    selected_plane = model_planes[selected_QR_index]

elif selected_QR_index == 2:
    selected_plane = model_planes[selected_QR_index]

elif selected_QR_index == 3:
    selected_plane = model_planes[selected_QR_index]

elif selected_QR_index == 4:
    selected_plane = model_planes[selected_QR_index]
# ---------- end ghpython_script_22 ----------

# ----
# robot space
boolean_toggle_4 = BooleanToggle(True)
robot_visualize = RobotVisualize(
    robot=robot_5,
    configuration=list_item,
    show_collision=boolean_toggle_4,
    show_base_frame=Toggle(True),
    show_end_effector_frame=Toggle(True),
    show_cm=Toggle(True),
    show_acm=Toggle(False))  # -> visual, collision, collision_meshes, attached_meshes, frames, base_frame, ee_frame; inputs show_visual: Boolean, show_collision: Boolean, show_frames: Boolean, show_base_frame: Boolean, show_end_effector_frame: Boolean, show_cm: Boolean, show_acm: Boolean
#   port group: The planning group used for end-effector and base visualization.
#   port configuration: The robot's full configuration.
#   port show_visual: Whether or not to show the robot's visual meshes.
#   port show_collision: Whether or not to show the robot's collision meshes.
#   port show_frames: Whether or not to show the robot's joint frames.
#   port show_base_frame: Whether or not to show the robot's base frame.
#   port show_end_effector_frame: Whether or not to show the robot's end-effector frame.
#   port show_cm: Whether or not to show the collision meshes (if any).
#   port show_acm: Whether or not to show the attached collision meshes (if any).
#   port visual: Rhino meshes of the robot's visual geometry (if any).
#   port collision: Rhino meshes of the robot's collision geometry (if any).
#   port collision_meshes: Rhino meshes of the scene's collision meshes (if any).
#   port attached_meshes: Rhino meshes of the scene's attached collision meshes (if any).
#   port frames: The robot's joint frames as Rhino planes (if any).
#   port base_frame: The robot's base frame as a Rhino plane (if any).
#   port ee_frame: The robot's end-effector frame as a Rhino plane (if any).
# ---------- robot_visualize: Python ----------
"""
Visualizes the robot.

COMPAS FAB v0.27.0
"""
import time

from compas.artists import Artist
from compas.geometry import Frame
from compas.geometry import Transformation
from ghpythonlib.componentbase import executingcomponent as component
from scriptcontext import sticky as st

from compas_fab.ghpython.components import create_id
from compas_fab.robots import PlanningScene


class RobotVisualize(component):
    def RunScript(
        self,
        robot,
        group,
        configuration,
        show_visual,
        show_collision,
        show_frames,
        show_base_frame,
        show_end_effector_frame,
        show_cm,
        show_acm,
    ):

        visual = None
        collision = None
        collision_meshes = None
        attached_meshes = None
        frames = None
        base_frame = None
        ee_frame = None

        if robot:
            show_visual = True if show_visual is None else show_visual
            show_cm = True if show_cm is None else show_cm
            show_acm = True if show_acm is None else show_acm
            configuration = configuration or robot.zero_configuration()

            robot.update(configuration, visual=show_visual, collision=show_collision)
            compas_frames = robot.transformed_frames(configuration, group)

            if show_visual:
                visual = robot.artist.draw_visual()

            if show_collision:
                collision = robot.artist.draw_collision()

            if show_base_frame:
                base_compas_frame = compas_frames[0]
                artist = Artist(base_compas_frame)
                base_frame = artist.draw()

            if show_end_effector_frame:
                ee_compas_frame = robot.forward_kinematics(configuration, group, options=dict(solver="model"))
                artist = Artist(ee_compas_frame)
                ee_frame = artist.draw()

            if show_frames:
                frames = []
                for compas_frame in compas_frames[1:]:
                    artist = Artist(compas_frame)
                    frame = artist.draw()
                    frames.append(frame)

            cached_scene_key = create_id(self, "cached_scene")

            if show_cm or show_acm:
                cached_scene = st.get(cached_scene_key)
                if not cached_scene:
                    cached_scene = {"time": 0}

                # expire cache if the component has not been executed in the last 2 seconds
                # this allows to slide through a list of configurations
                # without triggering refreshes of the scene in the middle of it
                if time.time() - cached_scene["time"] > 2:
                    update_scene = True
                else:
                    update_scene = False

                if update_scene:
                    scene = PlanningScene(robot)
                    scene = robot.client.get_planning_scene()

                if update_scene and show_cm:
                    collision_meshes = []

                    for co in scene.world.collision_objects:
                        header = co.header
                        frame_id = header.frame_id
                        cms = co.to_collision_meshes()

                        for cm in cms:
                            if cm.frame != Frame.worldXY():
                                t = Transformation.from_frame(cm.frame)
                                mesh = cm.mesh.transformed(t)
                            else:
                                mesh = cm.mesh

                            collision_meshes.append(Artist(mesh).draw())

                        cached_scene["cm"] = collision_meshes

                collision_meshes = cached_scene.get("cm", [])

                if update_scene and show_acm:
                    attached_meshes = []

                    for aco in scene.robot_state.attached_collision_objects:
                        for acm in aco.to_attached_collision_meshes():
                            frame_id = aco.object["header"]["frame_id"]
                            frame = robot.forward_kinematics(configuration, options=dict(link=frame_id))
                            t = Transformation.from_frame(frame)

                            # Local CM frame
                            if acm.collision_mesh.frame and acm.collision_mesh.frame != Frame.worldXY():
                                t = t * Transformation.from_frame(acm.collision_mesh.frame)

                            mesh = acm.collision_mesh.mesh.transformed(t)

                            attached_meshes.append(Artist(mesh).draw())

                    cached_scene["acm"] = attached_meshes

                attached_meshes = cached_scene.get("acm", [])

                cached_scene["time"] = time.time()
                st[cached_scene_key] = cached_scene

        return (
            visual,
            collision,
            collision_meshes,
            attached_meshes,
            frames,
            base_frame,
            ee_frame,
        )
# ---------- end robot_visualize ----------
mesh_14 = Mesh(robot_visualize.collision_meshes)
plane_11 = Plane(robot_visualize.ee_frame)

# ----
# TRANSFORM
ghpython_script_23 = GhPythonScript(original_robot_base=robot_visualize.base_frame, measured_plane=plane_2, model_plane=plane)  # -> out, RCFtoWCF, WCFtoRCF; inputs original_robot_base: Plane, measured_plane: Plane, model_plane: Plane; disabled
# ---------- ghpython_script_23: Python ----------
from compas.geometry import Transformation
from compas.geometry import Frame
from compas_rhino.conversions import plane_to_compas_frame
from compas_rhino.conversions import xform_to_rhino
from Rhino.Geometry import Transform

#from compas_rhino.conversions import Transform

#Planes to fix robot orientation
origin = Frame.worldXY()
rotated_original = plane_to_compas_frame(original_robot_base)

#Transform from base plane to origin to fix robot orientation
t1 = Transformation.from_frame_to_frame(rotated_original, origin)

#Transform from measured point to actual point
measured_frame = plane_to_compas_frame(measured_plane)
model_frame = plane_to_compas_frame(model_plane)

t2 = Transformation.from_frame_to_frame(model_frame, measured_frame)
t2_inverse = t2.inverse()

#Combined transromation
transformation = t2_inverse.concatenated(t1)

#Convert to rhino
RCFtoWCF = xform_to_rhino(transformation)
WCFtoRCF = xform_to_rhino(transformation.inverse())
# ---------- end ghpython_script_23 ----------

mesh_15 = Mesh(robot_visualize.visual)
plane_12 = Plane(robot_visualize.base_frame)

mesh_16 = Mesh(robot_visualize.collision)

# ----
# Transform Robot from:
# RCF to WCF space
# Attached Meshes
transform_11 = Transform(Geometry=mesh_14, Transform=ghpython_script_11.RCFtoWCF)

# ----
# Robot Visual Mesh
transform_12 = Transform(Geometry=robot_visualize.visual, Transform=ghpython_script_11.RCFtoWCF)

# ----
# Robot Base Plane
transform_13 = Transform(Geometry=plane_12, Transform=ghpython_script_11.RCFtoWCF)

# ----
# EE - Frame
transform_14 = Transform(Geometry=plane_11, Transform=ghpython_script_11.RCFtoWCF)

# ----
# Robot cm
transform_15 = Transform(Geometry=mesh_16, Transform=ghpython_script_11.RCFtoWCF)

# ==== cluster Cluster
plane = ClusterInput()
amplitude = ClusterInput()
deconstruct_plane = DeconstructPlane(Plane=plane)  # -> Origin, XAxis, YAxis, ZAxis
amplitude_2 = Amplitude(Vector=unitize(deconstruct_plane.XAxis), Amplitude=amplitude)
geometry = ClusterInput()
move = Move(Geometry=geometry, Motion=amplitude_2)  # -> Geometry, Transform
geometry_2 = ClusterOutput(move.Geometry)

# ==== cluster Cluster_2
data = ClusterInput()
data_2 = Data(data)
division = Division(A=data_2, B=2)
unit_z = UnitZ(Factor=division)
construct_point = ConstructPoint(XCoordinate=0, YCoordinate=0, ZCoordinate=0)
negative = Negative(Value=unit_z)
move = Move(Geometry=construct_point, Motion=negative)  # -> Geometry, Transform
radius = ClusterInput()
unit_z_2 = UnitZ(Factor=data_2)
polygon = Polygon(Plane=move.Geometry, Radius=radius, Segments=6, FilletRadius=0)  # -> Polygon, Length
unit_y = UnitY(Factor=1)
extrude = Extrude(Base=polygon.Polygon, Direction=unit_z_2)
cap_holes = CapHoles(Brep=extrude)
rotate_3d = Rotate3D(Geometry=cap_holes, Angle=degrees(Slider(90, range=0..100)), Center=Point(0, 0, 0), Axis=unit_y)  # -> Geometry, Transform
geometry = ClusterOutput(rotate_3d.Geometry)
